# Grasshopper definition Noptiera ND01xx_test_suruburi.gh (Grasshopper 1.0.8)
# plug-ins: Pufferfish, MetaHopper, GrasshopperHyperGooComponents, ShapeDiverForGrasshopper, eleFront

# ---- group: Class furnitura
# Furniture class
panel = Panel("https://cdn.artcharm.md/imagini\ico\furnitura_standard.png")
merge = Merge(Data1="Standard", Data2="Mediu", Data3="Premium")
merge_2 = Merge(
    Data1=panel,
    Data2="https://cdn.artcharm.md/imagini\ico\furnitura_mediu.png",
    Data3="https://cdn.artcharm.md/imagini\ico\furnitura_premium.png")
merge_3 = Merge(Data1="Standard", Data2="Mediu", Data3="Premium")
vlitemdata = ValueListItemData(Name=merge_3, DisplayName=merge, Tooltip=merge, ImageUrl=merge_2)
type = ValueList({"dropdown", "buttonflex", "buttongroup", "carousel", "chipgroup", "color", "fullwidthcards", "grid", "imagedropdown"}, selected="grid")
valuelistsettings = ValueListSettings(Type=type, ItemData=vlitemdata, N=False)
paramctrl = ParameterControl(Name="Clasa furnitura", DisplayName="Clasa furnitură", Settings=valuelistsettings)
controlswidget = ControlsWidget(Controls=paramctrl)

# ---- group: Handle type
panel_2 = Panel("https://cdn.artcharm.md/imagini/butontextura/manere/UU58-128.png")
panel_3 = Panel("https://cdn.artcharm.md/imagini/butontextura/manere/GU11-L36.jpg")
panel_4 = Panel("https://cdn.artcharm.md/imagini\ico\p2o.png")
panel_5 = Panel("https://cdn.artcharm.md/imagini\butontextura\manere\aplicat.png")

merge_4 = Merge(Data1="Push P2O", Data2="Aplicat", Data3="Maner T1", Data4="Punct")
merge_5 = Merge(Data1="Push P2O", Data2="Aplicat", Data3="Maner T1", Data4="Punct")
merge_6 = Merge(Data1=panel_4, Data2=panel_5, Data3=panel_2, Data4=panel_3)
vlitemdata_2 = ValueListItemData(Name=merge_5, DisplayName=merge_4, Tooltip=merge_4, ImageUrl=merge_6)
type_2 = ValueList({"dropdown", "buttonflex", "buttongroup", "carousel", "chipgroup", "color", "fullwidthcards", "grid", "imagedropdown"}, selected="grid")
valuelistsettings_2 = ValueListSettings(Type=type_2, ItemData=vlitemdata_2, N=False)
paramctrl_2 = ParameterControl(Name="Handle type", DisplayName="Tip mânere", Settings=valuelistsettings_2)
controlswidget_2 = ControlsWidget(Controls=paramctrl_2)

# ----
panel_6 = Panel("""0
1
0""")

# ---- group: Dimensions
merge_7 = Merge(Data1="Lungime", Data2="Adancime", Data3="Inaltime", Data4="Show Environment?")
merge_8 = Merge(Data1="Lungime (cm)", Data2="Adâncime (cm)", Data3="Inalțime (cm)", Data4="Încapere")
paramctrl_3 = ParameterControl(Name=merge_7, DisplayName=merge_8)
controlswidget_3 = ControlsWidget(Controls=paramctrl_3)

# ---- group: MATERIAL TAB / Interior color
panel_7 = Panel("Alb")
panel_8 = Panel("Satin")
panel_9 = Panel("Gri rece")
panel_10 = Panel("Basalt")

# ---- group: MATERIAL TAB / Facade inchise/deschise
# Open/close facades
panel_11 = Panel("https://cdn.artcharm.md/imagini/ico/fatade_inchise.jpg")
merge_9 = Merge(Data1="Fatade inchise", Data2="Fatade deschise")
merge_10 = Merge(Data1="Închise", Data2="Deschise")
merge_11 = Merge(Data1=panel_11, Data2="https://cdn.artcharm.md/imagini/ico/fatade_deschise.jpg")
vlitemdata_3 = ValueListItemData(Name=merge_9, DisplayName=merge_10, ImageUrl=merge_11)
type_3 = ValueList({"dropdown", "buttonflex", "buttongroup", "carousel", "chipgroup", "color", "fullwidthcards", "grid", "imagedropdown"}, selected="grid")
valuelistsettings_3 = ValueListSettings(Type=type_3, ItemData=vlitemdata_3, N=False)
paramctrl_4 = ParameterControl(Name="Vizualizare", DisplayName="Fațade", Settings=valuelistsettings_3)
controlswidget_4 = ControlsWidget(Controls=paramctrl_4)

# ---- group: MATERIAL TAB / Base color
panel_12 = Panel("Alpine White")
panel_13 = Panel("Sand Beige")
panel_14 = Panel("Cashmere Grey")
panel_15 = Panel("Pearl Grey")
panel_16 = Panel("Dust Grey")
panel_17 = Panel("Onyx Grey")
panel_18 = Panel("Stone Grey")
panel_19 = Panel("Cubanit Grey")

# ---- group: MATERIAL TAB / Second color
panel_20 = Panel("Alpine White")
panel_21 = Panel("Cashmere Grey")
panel_22 = Panel("Stone Grey")
panel_23 = Panel("Natural Kendal Oak")
panel_24 = Panel("În culoare fațadei")
panel_25 = Panel("Onyx Grey")
panel_26 = Panel("Natural Tonsberg Oak")
panel_27 = Panel("Black Pietra Grigia")

# ---- group: Descarca DWG
isdsg = BooleanToggle(False)
exportctrl = ExportControl(Name="Descarca_DWG", DisplayName="Descarca fisierul DWG", Tooltip="Descarca fisierul DWG")
null = NullPlaceholder()
filter = StreamFilter(Gate=isdsg, Stream0=null, Stream1=exportctrl)
controlswidget_5 = ControlsWidget(Controls=filter)

# ----
# PRICE TAB
pret = Integer()
expression = Expression(x=pret, Expression="(round(x/10))*10")
valuta = Panel(" MDL")
cart = AddToCartAction(Price=expression)
denumire_pret = Panel("Preț: ")
concat = Concatenate(FragmentA=denumire_pret, FragmentB=expression, FragmentC=valuta)
actionctrl = ActionControl(Label="Adauga in cos", Action=cart)
textwidget = TextWidget(Text=concat)
controlswidget_6 = ControlsWidget(Controls=actionctrl)
merge_12 = Merge(Data1=textwidget, Data2=controlswidget_6, Data3=controlswidget_5)
tab = Tab(Name=concat, Icon="coins", Widgets=merge_12)

# ---- group: Price list
pret_pal_taiere_mdl_m = Slider(5, range=0..100)
pret_abs_incleiere_unicolor_mdl_m = Slider(16, range=0..100)
pret_abs_incleiere_interior_mdl_m = Slider(11, range=0..100)
pret_pal_unicolor_mdl_m2 = Slider(190, range=0..1000)
pret_pal_textura_mdl_m2 = Slider(200, range=0..500)
pret_pal_interior_color_mdl_m2 = Slider(130, range=0..1000)
pret_abs_incleiere_textura_mdl_m = Slider(16, range=0..100)
price_coef = Slider(2.9, range=2..4)
suruburi = Panel("300")

# ---- group: Price list / Handles price
aplicat = Slider(110, range=0..200)
maner_t1 = Slider(60, range=0..100)
punct = Slider(80, range=0..100)
p2o = Slider(130, range=0..250)
merge_13 = Merge(Data1=p2o, Data2=aplicat, Data3=maner_t1, Data4=punct)

# ---- group: Price list / Pret glisiere
glisiere_standard = Slider(150, range=0..1000)
glisiere_rejs = Slider(220, range=0..1000)
glisiere_blum = Slider(420, range=0..1000)
merge_14 = Merge(Data1=glisiere_standard, Data2=glisiere_rejs, Data3=glisiere_blum)

# ----
panel_28 = Panel(concat)

base_color = ValueList({"PAL_W1100_ST9": 0, "PAL_U156_ST9": 1, "PAL_U702_ST9": 2, "PAL_U727_ST9": 3, "PAL_U763_ST9": 4, "PAL_U732_ST9": 5, "PAL_U960_ST9": 6, "PAL_U767_ST9": 7}, selected="PAL_W1100_ST9")
connected = GetConnectedObjects(Objects=base_color)
listdata = GetListData(ObjectToSet=connected)  # -> NickName, flatten(Keys), flatten(Values), flatten(SelectedIndex)
item = ListItem(List=listdata.Keys, Index=listdata.SelectedIndex, Wrap=True)
base_color_list = Text(listdata.Keys)
base_color_index = Integer(listdata.SelectedIndex)
base_color_name = Text(item)

# ---- group: MATERIAL TAB / Base color
# Base color
panel_29 = Panel("https://cdn.artcharm.md/imagini/butontextura/pal/PAL_U702_ST9_thumb.jpg")
panel_30 = Panel("https://cdn.artcharm.md/imagini/butontextura/pal/PAL_U727_ST9_thumb.jpg")
panel_31 = Panel("https://cdn.artcharm.md/imagini/butontextura/pal/PAL_U156_ST9_thumb.jpg")
panel_32 = Panel("https://cdn.artcharm.md/imagini/butontextura/pal/PAL_U767_ST9_thumb.jpg")
panel_33 = Panel("https://cdn.artcharm.md/imagini/butontextura/pal/PAL_W1100_ST9_thumb.jpg")
panel_34 = Panel("https://cdn.artcharm.md/imagini/butontextura/pal/PAL_U763_ST9_thumb.jpg")
panel_35 = Panel("https://cdn.artcharm.md/imagini/butontextura/pal/PAL_U732_ST9_thumb.jpg")
panel_36 = Panel("https://cdn.artcharm.md/imagini/butontextura/pal/PAL_U960_ST9_thumb.jpg")
merge_15 = Merge(
    Data1=panel_12,
    Data2=panel_13,
    Data3=panel_14,
    Data4=panel_18,
    Data5=panel_15,
    Data6=panel_16,
    Data7=panel_17,
    Data8=panel_19)
merge_16 = Merge(
    Data1=panel_33,
    Data2=panel_31,
    Data3=panel_29,
    Data4=panel_30,
    Data5=panel_34,
    Data6=panel_35,
    Data7=panel_36,
    Data8=panel_32)
base_color_list_2 = Text(base_color_list)
vlitemdata_4 = ValueListItemData(Name=base_color_list_2, DisplayName=merge_15, Tooltip=merge_15, ImageUrl=merge_16)
type_4 = ValueList({"dropdown", "buttonflex", "buttongroup", "carousel", "chipgroup", "color", "fullwidthcards", "grid", "imagedropdown"}, selected="grid")
valuelistsettings_4 = ValueListSettings(Type=type_4, ItemData=vlitemdata_4, N=False)
paramctrl_5 = ParameterControl(Name="Color corp", DisplayName="Culoare de bază", Settings=valuelistsettings_4)
controlswidget_7 = ControlsWidget(Controls=paramctrl_5)

# ----
second_color = ValueList({"PAL_W1100_ST9": 0, "PAL_U702_ST9": 1, "PAL_U727_ST9": 2, "PAL_U960_ST9": 3, "PAL_H305_ST12": 4, "PAL_H3170_ST12": 5, "PAL_F206_ST9": 6, "Exterior": 7}, selected="Exterior")
istexture = Expression(x=second_color, Expression="if(x=4,1,0)|if(x=5,1,0)|if(x=6,1,0)")
connected_2 = GetConnectedObjects(Objects=second_color)
listdata_2 = GetListData(ObjectToSet=connected_2)  # -> NickName, flatten(Keys), flatten(Values), flatten(SelectedIndex)
isexterior = Expression(x=second_color, Expression="if(x=7,1,0)")
item_2 = ListItem(List=listdata_2.Keys, Index=listdata_2.SelectedIndex, Wrap=True)
filter_2 = StreamFilter(Gate=isexterior, Stream0=item_2, Stream1=item)
second_color_list = Text(listdata_2.Keys)
second_color_name = Text(filter_2)
second_color_index = Integer(listdata_2.SelectedIndex)
istexture_2 = Boolean(istexture)

# ---- group: MATERIAL TAB / Second color
panel_37 = Panel("https://cdn.artcharm.md/imagini/butontextura/pal/PAL_U727_ST9_thumb.jpg")
panel_38 = Panel("https://cdn.artcharm.md/imagini/butontextura/pal/PAL_U702_ST9_thumb.jpg")
panel_39 = Panel("https://cdn.artcharm.md/imagini/butontextura/pal/PAL_U960_ST9_thumb.jpg")
panel_40 = Panel("https://cdn.artcharm.md/imagini/butontextura/pal/PAL_W1100_ST9_thumb.jpg")
panel_41 = Panel("https://cdn.artcharm.md/imagini/butontextura/pal/PAL_H305_ST12_thumb.jpg")
panel_42 = Panel("https://cdn.artcharm.md/imagini/butontextura/pal/PAL_H3170_ST12_thumb.jpg")
panel_43 = Panel("https://cdn.artcharm.md/imagini/butontextura/pal/PAL_F206_ST9_thumb.jpg")
item_3 = ListItem(List=merge_16, Index=0, Wrap=True)
merge_17 = Merge(
    Data1=panel_20,
    Data2=panel_21,
    Data3=panel_22,
    Data4=panel_25,
    Data5=panel_26,
    Data6=panel_23,
    Data7=panel_27,
    Data8=panel_24)
merge_18 = Merge(
    Data1=panel_40,
    Data2=panel_38,
    Data3=panel_37,
    Data4=panel_39,
    Data5=panel_41,
    Data6=panel_42,
    Data7=panel_43,
    Data8=item_3)
second_color_list_2 = Text(second_color_list)
vlitemdata_5 = ValueListItemData(Name=second_color_list_2, DisplayName=merge_17, Tooltip=merge_17, ImageUrl=merge_18)
type_5 = ValueList({"dropdown", "buttonflex", "buttongroup", "carousel", "chipgroup", "color", "fullwidthcards", "grid", "imagedropdown"}, selected="grid")
valuelistsettings_5 = ValueListSettings(Type=type_5, ItemData=vlitemdata_5, N=False)
paramctrl_6 = ParameterControl(Name="Color facade", DisplayName="Culoare secundară", Settings=valuelistsettings_5)
controlswidget_8 = ControlsWidget(Controls=paramctrl_6)

# ----
interior_color = ValueList({"Alb": 0, "Gri_rece": 1, "Satin": 2, "Basalt": 3}, selected="Satin")
connected_3 = GetConnectedObjects(Objects=interior_color)
listdata_3 = GetListData(ObjectToSet=connected_3)  # -> NickName, flatten(Keys), flatten(Values), flatten(SelectedIndex)
item_4 = ListItem(List=listdata_3.Keys, Index=listdata_3.SelectedIndex, Wrap=True)
interior_color_list = Text(listdata_3.Keys)
interior_color_name = Text(item_4)
interior_color_index = Integer(listdata_3.SelectedIndex)

# ---- group: MATERIAL TAB / Interior color
panel_44 = Panel("https://cdn.artcharm.md/imagini/butontextura/pal/PAL_U899_ST9_thumb.jpg")
merge_19 = Merge(Data1=panel_7, Data2=panel_9, Data3=panel_8, Data4=panel_10)
merge_20 = Merge(Data1=panel_33, Data2=panel_34, Data3=panel_31, Data4=panel_44)
interior_color_list_2 = Text(interior_color_list)
vlitemdata_6 = ValueListItemData(Name=interior_color_list_2, DisplayName=merge_19, Tooltip=merge_19, ImageUrl=merge_20)
type_6 = ValueList({"dropdown", "buttonflex", "buttongroup", "carousel", "chipgroup", "color", "fullwidthcards", "grid", "imagedropdown"}, selected="grid")
valuelistsettings_6 = ValueListSettings(Type=type_6, ItemData=vlitemdata_6, N=False)
paramctrl_7 = ParameterControl(Name="Interior color", DisplayName="Culoare interior", Settings=valuelistsettings_6)
controlswidget_9 = ControlsWidget(Controls=paramctrl_7)

# ---- group: MATERIAL TAB
# INTERIOR TAB
panel_45 = Panel("Culori")
merge_21 = Merge(Data1=controlswidget_4, Data2=controlswidget_7, Data3=controlswidget_8, Data4=controlswidget_9)
tab_2 = Tab(Name=panel_45, Icon="color-swatch", Widgets=merge_21)

# ----
culoare_maner = ValueList({"Negru": 0, "Alb": 1, "Auriu": 2}, selected="Auriu")
connected_4 = GetConnectedObjects(Objects=culoare_maner)
expression_2 = Expression(x=culoare_maner, Expression="if(x=2,1,0)")
listdata_4 = GetListData(ObjectToSet=connected_4)  # -> NickName, flatten(Keys), flatten(Values), flatten(SelectedIndex)
item_5 = ListItem(List=listdata_4.Keys, Index=listdata_4.SelectedIndex, Wrap=True)
maner_color_list = Text(listdata_4.Keys)
manere_color_name = Text(item_5)
maner_color_index = Integer(listdata_4.SelectedIndex)
ismetallic = Boolean(expression_2)

# ---- group: Handles color
# Handle color
panel_46 = Panel("""https://cdn.artcharm.md/imagini/butontextura/manere/negru.jpg

https://cdn.artcharm.md/imagini/butontextura/manere/auriu.jpg""")
panel_47 = Panel("""Negru
Auriu""")
type_7 = ValueList({"dropdown", "buttonflex", "buttongroup", "carousel", "chipgroup", "color", "fullwidthcards", "grid", "imagedropdown"}, selected="grid")
maner_color_list_2 = Text(maner_color_list)
vlitemdata_7 = ValueListItemData(Name=maner_color_list_2, DisplayName=panel_47, Tooltip=panel_47, ImageUrl=panel_46, Hidden=panel_6)
panel_48 = Panel("Culoare manere")
valuelistsettings_7 = ValueListSettings(Type=type_7, ItemData=vlitemdata_7, N=False)
paramctrl_8 = ParameterControl(Name=listdata_4.NickName, DisplayName="Culoare mânere", Settings=valuelistsettings_7)
controlswidget_10 = ControlsWidget(Controls=paramctrl_8)

# ----
# EXTERIOR TAB
panel_49 = Panel("Dimensiuni și feronerie")
merge_22 = Merge(Data1=controlswidget_3, Data2=controlswidget_2, Data3=controlswidget_10, Data4=controlswidget)
tab_3 = Tab(Name=panel_49, Icon="adjustments-alt", Widgets=merge_22)

# ---- group: Manere selection
handle_type = ValueList({"P2O": 0, "US35-160-L36-220": 1, "GU11-L36": 2, "UU58-128": 3, "Citterio_402B": 4}, selected="GU11-L36")
handle_offset = Slider(40, range=0..100)
connected_5 = GetConnectedObjects(Objects=handle_type)
listdata_5 = GetListData(ObjectToSet=connected_5)  # -> NickName, flatten(Keys), flatten(Values), flatten(SelectedIndex)
p2o_or_not_check = Expression(x=handle_type, Expression="if(x=0,1,0)")
aplicat_or_not_check = Expression(x=handle_type, Expression="if(x=1,1,0)")
item_6 = ListItem(List=listdata_5.Keys, Index=listdata_5.SelectedIndex, Wrap=True)
is_p2o = Boolean(p2o_or_not_check)
is_aplicat = Boolean(aplicat_or_not_check)
handle_type_list = Text(listdata_5.Keys)
handle_type_name = Text(item_6)
handle_type_index = Integer(listdata_5.SelectedIndex)
handle_offset_2 = Number(handle_offset)

# ----
yz = YZPlane(Origin=Point(0, 0, 0))
gaurire = BooleanToggle(True)
background_scale = Slider(3500, range=0..10000)
suruburi_2 = BooleanToggle(True)

# ---- group: Colors
texture_scale = Slider(1000, range=0..1000)
object_height = Slider(600, range=0..1000)
vizualizare = ValueList({"Fatade inchise": 0, "Fatade deschise": 1}, selected="Fatade inchise")
clasa_furnitura = ValueList({"Standard": 0, "Mediu": 1, "Premium": 2}, selected="Standard")

# ---- group: Dimensiuni
lungime = Slider(40, range=40..60)
inaltime = Slider(18, range=18..30)
adancime = Slider(26, range=26..45)

# ----
show_environment = BooleanToggle(False)
inaltime_sub_tumba_t = Panel("150")
grosime = Panel("18")
suruburi_3 = Boolean(suruburi_2)

# ---- group: Admin tab
# Admin Tab
panel_50 = Panel("""Descarcă fișierul DWG
Descarcă detalierea""")
panel_51 = Panel("""Export_DWG
Export_Detaliere""")
exportctrl_2 = ExportControl(Name=panel_51, DisplayName=panel_50, Tooltip=panel_50)
paramctrl_9 = ParameterControl(Name="Suruburi", DisplayName="Afișează fixări", Tooltip="Afișează fixări")
paramctrl_10 = ParameterControl(Name="Gaurire", DisplayName="Creează găuri", Tooltip="Creează găuri")
# APP BUILDER
suruburi_4 = Boolean(suruburi_3)
filter_3 = StreamFilter(Gate=suruburi_4, Stream0=paramctrl_9, Stream1=[paramctrl_9, paramctrl_10])
controlswidget_11 = ControlsWidget(Controls=exportctrl_2)
controlswidget_12 = ControlsWidget(Controls=filter_3)
merge_23 = Merge(Data1=controlswidget_12, Data2=controlswidget_11)
isdsg_2 = BooleanToggle(False)
admin = Tab(Name="Admin", Icon="highlight", Tooltip="Admin", Widgets=merge_23)
filter_4 = StreamFilter(Gate=isdsg_2, Stream1=admin)

# ----
# CONTAINER
merge_24 = Merge(Data1=tab_3, Data2=tab_2, Data3=tab, Data4=filter_4)
container = Container(Name="right", Tabs=merge_24)
app = App(Containers=container)

gaurire_2 = Boolean(gaurire)
show_environment_2 = Boolean(show_environment)
expression_3 = Expression(H=inaltime, Expression="H*10")
expression_4 = Expression(D=adancime, Expression="D*10")
expression_5 = Expression(L=lungime, Expression="L*10")

# ---- group: Fatada
offset = Panel("3")
addition = Addition(A=grosime, B=offset)
addition_2 = Addition(A=grosime, B=offset)
expression_6 = Expression(h=expression_3, th=grosime, Expression="h-(th*2)")
expression_7 = Expression(h=expression_5, th=grosime, Expression="h-(th*2)")
pt = ConstructPoint(XCoordinate=addition, YCoordinate=0, ZCoordinate=addition_2)
multiplication = Multiplication(A=offset, B=2)
multiplication_2 = Multiplication(A=offset, B=2)
xz = XZPlane(Origin=pt)
neg = Negative(Value=grosime)
subtraction = Subtraction(A=expression_7, B=multiplication_2)
subtraction_2 = Subtraction(A=expression_6, B=multiplication)
fatada = DomainBox(Base=xz, X=subtraction, Y=subtraction_2, Z=neg)

# ---- group: puncte podea
planesrf = PlaneSurface(Plane=PlaneXY(0, 0, 0), XSize=".1", YSize=".1")

# ----
smooth_normal_texture = Panel("https://cdn.artcharm.md/imagini/normalmap/PAL_smooth_normal.png")
wooden_normal_texture = Panel("https://cdn.artcharm.md/imagini/normalmap/HPL_wood_normal.jpg")

# ---- group: back wall
offset_back_wall = Panel("2")
addition_3 = Addition(Grosime=grosime, B=offset_back_wall)
subtraction_3 = Subtraction(Adancime=expression_4, B=addition_3)
double_grosime = Multiplication(Grosime=grosime, B=2)
pt_2 = ConstructPoint(XCoordinate=grosime, YCoordinate=subtraction_3, ZCoordinate=grosime)
subtraction_4 = Subtraction(Lungime=expression_5, B=double_grosime)
subtraction_5 = Subtraction(Inaltime=expression_3, B=double_grosime)
neg_2 = Negative(Value=grosime)
xz_2 = XZPlane(Origin=pt_2)
back_wall = DomainBox(Base=xz_2, X=subtraction_4, Grosime=subtraction_5, Z=neg_2)

# ---- group: Corp / Panel offset
capacul_offset_outside = Panel("0.5")
addition_4 = Addition(A=expression_5, B=capacul_offset_outside)
addition_5 = Addition(A=expression_4, B=capacul_offset_outside)
neg_3 = Negative(Value=capacul_offset_outside)
dom = ConstructDomain(DomainStart=neg_3, DomainEnd=addition_4)
dom_2 = ConstructDomain(DomainStart=neg_3, DomainEnd=addition_5)

capacul_offset_outside_2 = Panel("0.5")
addition_6 = Addition(A=expression_5, B=capacul_offset_outside_2)
addition_7 = Addition(A=expression_4, B=capacul_offset_outside_2)
neg_4 = Negative(Value=capacul_offset_outside_2)
dom_3 = ConstructDomain(DomainStart=neg_4, DomainEnd=addition_6)
dom_4 = ConstructDomain(DomainStart=neg_4, DomainEnd=addition_7)

# ----
panel_52 = Panel("https://cdn.artcharm.md/imagini/texturi/pal/PAL_F186_ST9.jpg")
panel_53 = Panel("https://cdn.artcharm.md/imagini/texturi/pal/PAL_F187_ST9.jpg")

panel_54 = Panel("https://cdn.artcharm.md/imagini/texturi/pal/PAL_H1715_ST12.jpg")
gltf2material = GlTF20Material(
    BaseColorFactor=RGB(255, 255, 255),
    BaseColorTexture=panel_54,
    MetallicFactor=0,
    RoughnessFactor=1,
    NormalTexture=wooden_normal_texture,
    EmissiveFactor=RGB(0, 0, 0),
    AlphaMode="OPAQUE",
    AlphaCutoff=0.5,
    DoubleSided=True)

# ---- group: Fatada attributes
attach_attributes = AttachAttributes(geo=fatada, direction=Toggle(True), issertar=Toggle(True), isdoor=Toggle(False), name="fatada", material="second")

# ---- group: Maner suruburi
xz_3 = XZPlane(Origin=Point(0, 0, 0))
neg_5 = Negative(Value=Slider(36, range=0..100))
division = Division(A=Slider(160, range=0..256), B=2)
cyl = Cylinder(Base=xz_3, Radius=Slider(2.5, range=1..10), Length=neg_5)
neg_6 = Negative(Value=division)
X = UnitX(Factor=[division, neg_6])
cap = CapHoles(Brep=cyl)
move = Move(Geometry=cap, Motion=X)  # -> Geometry, Transform

# ----
piece = Geometry(back_wall)
abs_placement = ABSPlacement(geo=piece, bool=Toggle(False), bool_2=Toggle(False), bool_3=Toggle(False), bool_4=Toggle(False))  # -> abs, piece

# ---- group: Sertar / PFL
subtraction_6 = Subtraction(A=expression_4, B="38", C="15")

# ----
neg_7 = Negative(Value=Slider(5, range=0..10))
Z = UnitZ(Factor=neg_7)
move_2 = Move(Geometry=move.Geometry, Motion=Z)  # -> Geometry, Transform

attach_attributes_2 = AttachAttributes(
    geo=abs_placement.piece,
    direction=Toggle(False),
    issertar=Toggle(False),
    isdoor=Toggle(False),
    name="spatele",
    material="interior")

# ----
# Handles
pt_3 = Point(Point(0, 0, 0))
aplicat_2 = Geometry(Tree({0;0}: [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], {0;1}: [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]))
geo = Geometry(Tree({0;0}: [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], {0;1}: [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]))
geo_2 = Geometry(Tree({0;0}: [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], {0;1}: [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]))
geo_3 = Geometry(Tree({0;0}: [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], {0;1}: [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]))
geo_4 = Geometry(Tree({0;0}: [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], {0;1}: [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]))
geo_5 = Geometry(Tree({0;0}: [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], {0;1}: [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]))
maner_attributes = ManerAttributes(geo=pt_3, p2o=True, aplicat=False)
maner_attributes_2 = ManerAttributes(geo=aplicat_2, p2o=False, aplicat=True)
maner_attributes_3 = ManerAttributes(geo=geo, p2o=False, aplicat=False)
maner_attributes_4 = ManerAttributes(geo=geo_2, p2o=False, aplicat=False)
maner_attributes_5 = ManerAttributes(geo=geo_3, p2o=False, aplicat=False)
maner_attributes_6 = ManerAttributes(geo=geo_4, p2o=False, aplicat=False)
maner_attributes_7 = ManerAttributes(geo=geo_5, p2o=False, aplicat=False)
handle_type_index_2 = Integer(handle_type_index)
filter_5 = StreamFilter(
    Gate=handle_type_index_2,
    Stream0=maner_attributes,
    Stream1=maner_attributes_2,
    Stream2=maner_attributes_3,
    Stream3=maner_attributes_4,
    Stream4=maner_attributes_5,
    Stream5=maner_attributes_6,
    Stream6=maner_attributes_7)
selected_handle = Geometry(filter_5)

# ---- group: Maner amplasare
list = ValueList({"Right": 0, "Down": 1, "Left": 2, "Up": 3}, selected="Up")
suruburi_5 = Boolean(suruburi_3)
gaurire_3 = Boolean(gaurire_2)
fatada_2 = Geometry(attach_attributes)
handle_offset_3 = Number(handle_offset_2)
selected_handle_2 = Geometry(selected_handle)
handle = Handle(
    suruburi=suruburi_5,
    gaurire=gaurire_3,
    fatada_box=fatada_2,
    offset=handle_offset_3,
    orientation=list,
    handle_geo=selected_handle_2)  # -> point, fatada, maner, suruburi_4

# ---- group: Sertar
gaurire_4 = Boolean(gaurire_2)
expression_8 = Expression(Lt=expression_5, Expression="Lt-18-6.5")
subtraction_7 = Subtraction(A=subtraction_2, B="30", C="20")
sertar_pal = SertarPAL(
    suruburi=suruburi_2,
    gaurire=gaurire_4,
    facade=handle.fatada,
    punct_1_x="24.5",
    punctul_2=expression_8,
    coordonata_y=grosime,
    coordonata_z="38",
    adancime_sertar=subtraction_6,
    h_sertar=subtraction_7)  # -> facade_4, sertar_2, suruburi_8

# ----
# PFL material
number_slider = Slider(0.7, range=0..1)
gltf2material_2 = GlTF20Material(
    BaseColorFactor=ColourSwatch(SwatchColor=RGB(255, 255, 255)),
    MetallicFactor=0,
    RoughnessFactor=number_slider,
    EmissiveFactor=RGB(0, 0, 0),
    AlphaMode="OPAQUE",
    AlphaCutoff=0.5,
    DoubleSided=True)

# ---- group: Preview suruburi
gltf2material_3 = GlTF20Material(
    BaseColorFactor=ColourSwatch(SwatchColor=RGB(255, 0, 0)),
    MetallicFactor=0,
    RoughnessFactor=Slider(0.7, range=0..1),
    EmissiveFactor=RGB(0, 0, 0),
    AlphaMode="OPAQUE",
    AlphaCutoff=0.5,
    DoubleSided=True)

# ---- group: Culori manere
gltf2material_4 = GlTF20Material(
    BaseColorFactor=ColourSwatch(SwatchColor=RGB(242, 242, 242)),
    MetallicFactor=Slider(1, range=0..1),
    RoughnessFactor=Slider(0.2, range=0..1),
    EmissiveFactor=RGB(0, 0, 0),
    AlphaMode="OPAQUE",
    AlphaCutoff=0.5,
    DoubleSided=True)

gltf2material_5 = GlTF20Material(
    BaseColorFactor=ColourSwatch(SwatchColor=RGB(151, 101, 48)),
    MetallicFactor=Slider(1, range=0..1),
    RoughnessFactor=Slider(0.2, range=0..1),
    EmissiveFactor=RGB(0, 0, 0),
    AlphaMode="OPAQUE",
    AlphaCutoff=0.5,
    DoubleSided=True)

gltf2material_6 = GlTF20Material(
    BaseColorFactor=ColourSwatch(SwatchColor=RGB(0, 0, 0)),
    MetallicFactor=Slider(0, range=0..1),
    RoughnessFactor=Slider(0.2, range=0..1),
    EmissiveFactor=RGB(0, 0, 0),
    AlphaMode="OPAQUE",
    AlphaCutoff=0.5,
    DoubleSided=True)

# Handles material
merge_25 = Merge(Data1=gltf2material_6, Data2=gltf2material_4, Data3=gltf2material_5)
maner_color_index_2 = Integer(maner_color_index)
item_7 = ListItem(List=merge_25, Index=maner_color_index_2, Wrap=True)

# ---- group: Background
background_doublesided = BooleanToggle(True)

# ---- group: Background / Background Wall
# Background Wall
panel_55 = Panel("https://cdn.artcharm.md/imagini/texturi/incapere/Wall-1_alpha.png")
gltf2material_7 = GlTF20Material(
    BaseColorFactor=RGB(255, 255, 255),
    BaseColorTexture=panel_55,
    MetallicFactor=0,
    RoughnessFactor=1,
    EmissiveFactor=RGB(0, 0, 0),
    AlphaMode="BLEND",
    AlphaCutoff=0.5,
    DoubleSided=background_doublesided)

# ---- group: Human material
gltf2material_8 = GlTF20Material(
    BaseColorFactor=ColourSwatch(SwatchColor=RGB(97, 97, 97)),
    MetallicFactor=0,
    RoughnessFactor="1",
    EmissiveFactor=RGB(0, 0, 0),
    AlphaMode="OPAQUE",
    AlphaCutoff=0.5,
    DoubleSided=True)

# ---- group: Background / Background Floor
# Background Floor
panel_56 = Panel("https://cdn.artcharm.md/imagini/texturi/incapere/Floor-1_alpha.png")
gltf2material_9 = GlTF20Material(
    BaseColorFactor=RGB(255, 255, 255),
    BaseColorTexture=panel_56,
    MetallicFactor=0,
    RoughnessFactor=1,
    EmissiveFactor=RGB(0, 0, 0),
    AlphaMode="BLEND",
    AlphaCutoff=0.5,
    DoubleSided=background_doublesided)

# ---- group: Background
background_scale_2 = Number(background_scale)
neg_8 = Negative(Value=background_scale_2)
dom_5 = ConstructDomain(DomainStart=neg_8, DomainEnd=background_scale_2)
xy = XYPlane(Origin=Point(0, 0, 0))
xz_4 = XZPlane(Origin=Point(0, 0, 0))
rectangle = Rectangle(Plane=[xy, xz_4], XSize=dom_5, YSize=[neg_8, background_scale_2], Radius=0)  # -> Rectangle, Length
Y = UnitY(Factor=1)
move_3 = Move(Geometry=rectangle.Rectangle, Motion=Y)  # -> Geometry, Transform
double = Multiplication(A=background_scale_2, B=2)
boundary = BoundarySurfaces(Edges=move_3.Geometry)
texture_mapping = TextureMapping(geo=boundary, scale=double, direction=degrees(1.570796327))  # -> flatten(mesh)
incapere = Mesh(texture_mapping)

# ---- group: Human
human_x_offset = Slider(233, range=0..1000)
lungime_2 = Number(expression_5)
human_y_offset = Slider(319, range=0..1000)
xy_2 = XYPlane(Origin=Point(0, 0, 0))
xz_5 = XZPlane(Origin=Point(0, 0, 0))
neg_9 = Negative(Value=lungime_2)
geo_6 = Geometry(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)
division_2 = Division(A=neg_9, B=2)
orient = Orient(Geometry=geo_6, Source=xy_2, Target=xz_5)  # -> Geometry, Transform
brec = BoundingRectangle(Geometry=orient.Geometry, Plane=xz_5, Axis=0, Slide=0, Union=True)  # -> Bounding, DimensionX, DimensionY
addition_8 = Addition(A=human_x_offset, B=brec.DimensionX)
subtraction_8 = Subtraction(A=division_2, B=addition_8)
neg_10 = Negative(Value=human_y_offset)
Z_2 = UnitZ(Factor=brec.DimensionY)
X_2 = UnitX(Factor=subtraction_8)
Y_2 = UnitY(Factor=neg_10)
comp = Compound(Transforms=flatten([Z_2, X_2, Y_2]))
move_4 = Move(Geometry=orient.Geometry, Motion=comp)  # -> Geometry, Transform

# ---- group: Laterala dreapta / Activatie pe fiecare latura
activat = BooleanToggle(True)
activat_2 = BooleanToggle(False)
activat_3 = BooleanToggle(True)
activat_4 = BooleanToggle(False)

# ---- group: Laterala dreapta / Tip surubul
list_2 = ValueList({"Rastex 15mm": 0, "Confirmat_L50": 1}, selected="Confirmat_L50")
list_3 = ValueList({"Rastex 15mm": 0, "Confirmat_L50": 1}, selected="Rastex 15mm")
list_4 = ValueList({"Rastex 15mm": 0, "Confirmat_L50": 1}, selected="Rastex 15mm")
list_5 = ValueList({"Rastex 15mm": 0, "Confirmat_L50": 1}, selected="Rastex 15mm")

# ---- group: Laterala dreapta / Offset pe fiecare latura
offset_dreapta = Slider(50, range=0..100)
offset_stanga = Slider(50, range=0..100)
offset_dreapta_2 = Slider(70, range=0..100)
offset_stanga_2 = Slider(50, range=0..100)
offset_dreapta_3 = Slider(50, range=0..100)
offset_stanga_3 = Slider(70, range=0..100)
offset_stanga_4 = Slider(50, range=0..100)
offset_dreapta_4 = Slider(50, range=0..100)

# ---- group: Laterala dreapta / Flip fata/spate
flip = BooleanToggle(True)
flip_2 = BooleanToggle(True)
flip_3 = BooleanToggle(True)
flip_4 = BooleanToggle(True)

# ----
entwine = Entwine(Branch00=incapere, Branch01=move_4.Geometry, FlattenInputs=True)
value_list = ValueList({"Scant dreapta": -1, "Scant stanga": 1, "Fara scant": 0}, selected="Scant stanga")
list_6 = ValueList({"Scant dreapta": -1, "Scant stanga": 1, "Fara scant": 0}, selected="Scant dreapta")
list_7 = ValueList({"Scant dreapta": -1, "Scant stanga": 1, "Fara scant": 0}, selected="Scant dreapta")
list_8 = ValueList({"Scant dreapta": -1, "Scant stanga": 1, "Fara scant": 0}, selected="Scant dreapta")

# ---- group: Laterala dreapta / Activatie pe fiecare latura
activat_5 = BooleanToggle(True)
activat_6 = BooleanToggle(False)
activat_7 = BooleanToggle(True)
activat_8 = BooleanToggle(False)

# ---- group: Laterala dreapta / Tip surubul
list_9 = ValueList({"Rastex 15mm": 0, "Confirmat_L50": 1}, selected="Confirmat_L50")
list_10 = ValueList({"Rastex 15mm": 0, "Confirmat_L50": 1}, selected="Rastex 15mm")
list_11 = ValueList({"Rastex 15mm": 0, "Confirmat_L50": 1}, selected="Rastex 15mm")
list_12 = ValueList({"Rastex 15mm": 0, "Confirmat_L50": 1}, selected="Rastex 15mm")

# ---- group: Laterala dreapta / Offset pe fiecare latura
offset_stanga_5 = Slider(50, range=0..100)
offset_dreapta_5 = Slider(70, range=0..100)
offset_stanga_6 = Slider(50, range=0..100)
offset_dreapta_6 = Slider(50, range=0..100)
offset_stanga_7 = Slider(70, range=0..100)
offset_dreapta_7 = Slider(50, range=0..100)
offset_stanga_8 = Slider(50, range=0..100)
offset_dreapta_8 = Slider(50, range=0..100)

# ---- group: Laterala dreapta / Flip fata/spate
flip_5 = BooleanToggle(True)
flip_6 = BooleanToggle(True)
flip_7 = BooleanToggle(False)
flip_8 = BooleanToggle(True)

# ---- group: Laterala dreapta / Amplasare șcant
value_list_2 = ValueList({"Scant dreapta": -1, "Scant stanga": 1, "Fara scant": 0}, selected="Scant stanga")
list_13 = ValueList({"Scant dreapta": -1, "Scant stanga": 1, "Fara scant": 0}, selected="Scant dreapta")
list_14 = ValueList({"Scant dreapta": -1, "Scant stanga": 1, "Fara scant": 0}, selected="Scant dreapta")
list_15 = ValueList({"Scant dreapta": -1, "Scant stanga": 1, "Fara scant": 0}, selected="Fara scant")

# ---- group: Spatele / Activatie pe fiecare latura
activat_9 = BooleanToggle(True)
activat_10 = BooleanToggle(True)
activat_11 = BooleanToggle(True)
activat_12 = BooleanToggle(True)

# ---- group: Spatele / Tip surubul
list_16 = ValueList({"Rastex 15mm": 0, "Confirmat_L50": 1}, selected="Confirmat_L50")
list_17 = ValueList({"Rastex 15mm": 0, "Confirmat_L50": 1}, selected="Rastex 15mm")
list_18 = ValueList({"Rastex 15mm": 0, "Confirmat_L50": 1}, selected="Rastex 15mm")
list_19 = ValueList({"Rastex 15mm": 0, "Confirmat_L50": 1}, selected="Rastex 15mm")

# ---- group: Spatele / Offset pe fiecare latura
offset_stanga_9 = Slider(50, range=0..100)
offset_dreapta_9 = Slider(50, range=0..100)
offset_stanga_10 = Slider(50, range=0..100)
offset_dreapta_10 = Slider(50, range=0..100)
offset_stanga_11 = Slider(100, range=0..100)
offset_dreapta_11 = Slider(100, range=0..100)
offset_stanga_12 = Slider(50, range=0..100)
offset_dreapta_12 = Slider(50, range=0..100)

# ---- group: Spatele / Flip fata/spate
flip_9 = BooleanToggle(False)
flip_10 = BooleanToggle(False)
flip_11 = BooleanToggle(False)
flip_12 = BooleanToggle(False)

# ---- group: Spatele / Amplasare șcant
value_list_3 = ValueList({"Scant dreapta": -1, "Scant stanga": 1, "Fara scant": 0}, selected="Scant stanga")
list_20 = ValueList({"Scant dreapta": -1, "Scant stanga": 1, "Fara scant": 0}, selected="Scant dreapta")
list_21 = ValueList({"Scant dreapta": -1, "Scant stanga": 1, "Fara scant": 0}, selected="Scant dreapta")
list_22 = ValueList({"Scant dreapta": -1, "Scant stanga": 1, "Fara scant": 0}, selected="Fara scant")

# ---- group: Hide environment
show_environment_3 = Boolean(show_environment_2)
null_2 = NullPlaceholder()
incapere_2 = Geometry(entwine)
filter_6 = StreamFilter(Gate=show_environment_3, Stream0=null_2, Stream1=incapere_2)
bang = ExplodeTree(Data=filter_6)  # -> Branch0, Branch1
dispatch = Dispatch(List=bang.Branch0, DispatchPattern=[True, False])  # -> ListA, ListB
human = GlTF20Display(Geometry=bang.Branch1, Material=gltf2material_8)
floor = GlTF20Display(Geometry=dispatch.ListA, Material=gltf2material_9)
wall = GlTF20Display(Geometry=dispatch.ListB, Material=gltf2material_7)

# ----
preview = CustomPreview(Material={diffuse=RGB(221, 160, 221), emission=RGB(66, 48, 66), shine=0.5, specular=RGB(255, 255, 255), transparency=0})
encoding = ValueList({"ASCII", "UTF_8", "UTF_8_NO_BOM"}, selected="ASCII")
extension = ValueList({"txt", "g", "gcode", "csv", "xml", "json", "ifc"}, selected="gcode")
end_of_line = ValueList({"CRLF", "LF", "CR"}, selected="CRLF")
exporttxt = TextExportOptions(Extension=extension, EndOfLine=end_of_line, Encoding=encoding, N=False)

# ---- group: Parameters
panel_57 = Panel("""Denumire fatada
Taiere in plus
Grosime material""")
selected_facade_name = Text()
overcut_adancime = Number()
grosime_material = Number()
merge_26 = Merge(Data1=flatten(selected_facade_name), Data2=flatten(overcut_adancime), Data3=flatten(grosime_material))
merge_27 = Merge(Data1=simplify(graft(panel_57)), Data2=simplify(graft(merge_26)))
join = TextJoin(Text=merge_27, Join=": ")  # -> flatten(Result)
join_2 = TextJoin(Text=flatten(join))

# ----
# Export the merged stream
# as a zip archive
# Export the archive: Finally, the archive can be exported using the standard ShapeDiver components.
# 
# Use the stream export options and specify the zip file type in the ContentType input (C).
panel_58 = Panel("zip,application/zip")
exportstream = StreamExportOptions(ContentType=panel_58, N=False)

# ---- group: Export_CSV
header = Panel("Material;Denumire;Lungime;Latime;Cantitate")
base_color_name_2 = Text(base_color_name)
second_color_name_2 = Text(second_color_name)
interior_color_name_2 = Text(interior_color_name)
encoding_2 = ValueList({"ASCII", "UTF_8", "UTF_8_NO_BOM"}, selected="UTF_8")
end_of_line_2 = ValueList({"CRLF", "LF", "CR"}, selected="CRLF")
extension_2 = ValueList({"txt", "g", "gcode", "csv", "xml", "json", "ifc"}, selected="csv")
exporttxt_2 = TextExportOptions(Extension=extension_2, EndOfLine=end_of_line_2, Encoding=encoding_2, N=False)

# ---- group: Export DWG
base_color_name_3 = Text(base_color_name)
second_color_name_3 = Text(second_color_name)
interior_color_name_3 = Text(interior_color_name)
maner_type_name = Text(handle_type_name)
maner_color_name = Text(manere_color_name)
concat_2 = Concatenate(FragmentA=maner_type_name, FragmentC="_", FragmentB=maner_color_name)
merge_28 = Merge(Data1=base_color_name_3, Data2=second_color_name_3, Data3=interior_color_name_3, Data4=concat_2, Data5="Suruburi")
data = Data(graft(merge_28))
export_polycurves_as = ValueList({"Splines", "Lines", "Arcs", "Polylines", "Polybulges", "3Dpolylines"}, selected="Splines")
export_polylines_as = ValueList({"Polylines", "Lines", "3Dpolylines", "Splines"}, selected="Polylines")
export_curves_as = ValueList({"Splines", "Lines", "3Dpolylines", "Polylines"}, selected="Splines")
export_lines_as = ValueList({"Lines", "Polylines", "3Dpolylines", "Splines"}, selected="Lines")
export_arcs_as = ValueList({"Arcs", "Lines", "Polylines", "Polybulges", "3Dpolylines", "Splines"}, selected="Arcs")
save_surfaces_as = ValueList({"Curves", "Meshes", "Solids"}, selected="Solids")
save_meshes_as = ValueList({"Meshes", "3Dfaces"}, selected="Meshes")
arc_normals = ValueList({"Preserve", "Flip"}, selected="Preserve")
color_array = ColorArray(L=data)
color_method = ValueList({"RGB", "ACI"}, selected="RGB")
format = ValueList({"dxf", "dwg"}, selected="dwg")
merge_29 = Merge(Data1="layer", Data2="color")
merge_30 = Merge(Data1=data, Data2=color_array)
constructattr = ConstructAttributes(Keys=merge_29, Values=merge_30)
exportdwgdxf = DrawingExportOptions(
    Format=format,
    SaveSurfacesAs=save_surfaces_as,
    SaveMeshesAs=save_meshes_as,
    Project=False,
    FullLayerPaths=False,
    ColorMethod=color_method,
    ArcNormals=arc_normals,
    LWPolylines=False,
    ExportLinesAs=export_lines_as,
    ExportArcsAs=export_arcs_as,
    ExportPolylinesAs=export_polylines_as,
    ExportCurvesAs=export_curves_as,
    ExportPolycurvesAs=export_polycurves_as,
    ExplodePolycurves=False,
    SplitAtKinks=False,
    N=False)

# ----
# Second color
roughness = Slider(0.7, range=0..1)
gltf2material_10 = GlTF20Material(
    BaseColorFactor=RGB(255, 255, 255),
    BaseColorTexture=panel_52,
    MetallicFactor=0,
    RoughnessFactor=roughness,
    NormalTexture=smooth_normal_texture,
    EmissiveFactor=RGB(0, 0, 0),
    AlphaMode="OPAQUE",
    AlphaCutoff=0.5,
    DoubleSided=True)
gltf2material_11 = GlTF20Material(
    BaseColorFactor=RGB(255, 255, 255),
    BaseColorTexture=panel_53,
    MetallicFactor=0,
    RoughnessFactor=roughness,
    NormalTexture=smooth_normal_texture,
    EmissiveFactor=RGB(0, 0, 0),
    AlphaMode="OPAQUE",
    AlphaCutoff=0.5,
    DoubleSided=True)
second_color_index_2 = Integer(second_color_index)

panel_59 = Panel("https://cdn.artcharm.md/imagini/texturi/pal/PAL_H3133_ST12.jpg")
gltf2material_12 = GlTF20Material(
    BaseColorFactor=RGB(255, 255, 255),
    BaseColorTexture=panel_59,
    MetallicFactor=0,
    RoughnessFactor=roughness,
    NormalTexture=wooden_normal_texture,
    EmissiveFactor=RGB(0, 0, 0),
    AlphaMode="OPAQUE",
    AlphaCutoff=0.5,
    DoubleSided=True)

panel_60 = Panel("https://cdn.artcharm.md/imagini/texturi/pal/PAL_H3157_ST12.jpg")
gltf2material_13 = GlTF20Material(
    BaseColorFactor=RGB(255, 255, 255),
    BaseColorTexture=panel_60,
    MetallicFactor=0,
    RoughnessFactor=roughness,
    NormalTexture=wooden_normal_texture,
    EmissiveFactor=RGB(0, 0, 0),
    AlphaMode="OPAQUE",
    AlphaCutoff=0.5,
    DoubleSided=True)

panel_61 = Panel("https://cdn.artcharm.md/imagini/texturi/pal/PAL_H3730_ST10.jpg")
gltf2material_14 = GlTF20Material(
    BaseColorFactor=RGB(255, 255, 255),
    BaseColorTexture=panel_61,
    MetallicFactor=0,
    RoughnessFactor=roughness,
    NormalTexture=wooden_normal_texture,
    EmissiveFactor=RGB(0, 0, 0),
    AlphaMode="OPAQUE",
    AlphaCutoff=0.5,
    DoubleSided=True)

panel_62 = Panel("https://cdn.artcharm.md/imagini/texturi/pal/PAL_H3170_ST12.jpg")
gltf2material_15 = GlTF20Material(
    BaseColorFactor=RGB(255, 255, 255),
    BaseColorTexture=panel_62,
    MetallicFactor=0,
    RoughnessFactor=roughness,
    NormalTexture=wooden_normal_texture,
    EmissiveFactor=RGB(0, 0, 0),
    AlphaMode="OPAQUE",
    AlphaCutoff=0.5,
    DoubleSided=True)

panel_63 = Panel("https://cdn.artcharm.md/imagini/texturi/pal/PAL_H1113_ST10.jpg")
gltf2material_16 = GlTF20Material(
    BaseColorFactor=RGB(255, 255, 255),
    BaseColorTexture=panel_63,
    MetallicFactor=0,
    RoughnessFactor=roughness,
    NormalTexture=wooden_normal_texture,
    EmissiveFactor=RGB(0, 0, 0),
    AlphaMode="OPAQUE",
    AlphaCutoff=0.5,
    DoubleSided=True)

panel_64 = Panel("https://cdn.artcharm.md/imagini/texturi/pal/PAL_H1399_ST10.jpg")
gltf2material_17 = GlTF20Material(
    BaseColorFactor=RGB(255, 255, 255),
    BaseColorTexture=panel_64,
    MetallicFactor=0,
    RoughnessFactor=roughness,
    NormalTexture=wooden_normal_texture,
    EmissiveFactor=RGB(0, 0, 0),
    AlphaMode="OPAQUE",
    AlphaCutoff=0.5,
    DoubleSided=True)

panel_65 = Panel("https://cdn.artcharm.md/imagini/texturi/pal/PAL_H309_ST12.jpg")
gltf2material_18 = GlTF20Material(
    BaseColorFactor=RGB(255, 255, 255),
    BaseColorTexture=panel_65,
    MetallicFactor=0,
    RoughnessFactor=roughness,
    NormalTexture=wooden_normal_texture,
    EmissiveFactor=RGB(0, 0, 0),
    AlphaMode="OPAQUE",
    AlphaCutoff=0.5,
    DoubleSided=True)

panel_66 = Panel("https://cdn.artcharm.md/imagini/texturi/pal/PAL_H305_ST12.jpg")
gltf2material_19 = GlTF20Material(
    BaseColorFactor=RGB(255, 255, 255),
    BaseColorTexture=panel_66,
    MetallicFactor=0,
    RoughnessFactor=roughness,
    NormalTexture=wooden_normal_texture,
    EmissiveFactor=RGB(0, 0, 0),
    AlphaMode="OPAQUE",
    AlphaCutoff=0.5,
    DoubleSided=True)

panel_67 = Panel("https://cdn.artcharm.md/imagini/texturi/pal/PAL_H1242_ST10.jpg")
gltf2material_20 = GlTF20Material(
    BaseColorFactor=RGB(255, 255, 255),
    BaseColorTexture=panel_67,
    MetallicFactor=0,
    RoughnessFactor=roughness,
    NormalTexture=wooden_normal_texture,
    EmissiveFactor=RGB(0, 0, 0),
    AlphaMode="OPAQUE",
    AlphaCutoff=0.5,
    DoubleSided=True)

panel_68 = Panel("https://cdn.artcharm.md/imagini/texturi/pal/PAL_H3133_ST12.jpg")
gltf2material_21 = GlTF20Material(
    BaseColorFactor=RGB(255, 255, 255),
    BaseColorTexture=panel_68,
    MetallicFactor=0,
    RoughnessFactor=roughness,
    NormalTexture=wooden_normal_texture,
    EmissiveFactor=RGB(0, 0, 0),
    AlphaMode="OPAQUE",
    AlphaCutoff=0.5,
    DoubleSided=True)

panel_69 = Panel("https://cdn.artcharm.md/imagini/texturi/pal/PAL_F206_ST9.jpg")
gltf2material_22 = GlTF20Material(
    BaseColorFactor=RGB(255, 255, 255),
    BaseColorTexture=panel_69,
    MetallicFactor=0,
    RoughnessFactor=roughness,
    NormalTexture=smooth_normal_texture,
    EmissiveFactor=RGB(0, 0, 0),
    AlphaMode="OPAQUE",
    AlphaCutoff=0.5,
    DoubleSided=True)

panel_70 = Panel("https://cdn.artcharm.md/imagini/texturi/pal/PAL_F800_ST9.jpg")
gltf2material_23 = GlTF20Material(
    BaseColorFactor=RGB(255, 255, 255),
    BaseColorTexture=panel_70,
    MetallicFactor=0,
    RoughnessFactor=roughness,
    NormalTexture=smooth_normal_texture,
    EmissiveFactor=RGB(0, 0, 0),
    AlphaMode="OPAQUE",
    AlphaCutoff=0.5,
    DoubleSided=True)

# ---- group: Corp
subtraction_9 = Subtraction(A=expression_5, B=grosime)
expression_9 = Expression(h=expression_3, th=grosime, Expression="h-th")
pt_4 = ConstructPoint(XCoordinate=0, YCoordinate=0, ZCoordinate=grosime)
pt_5 = ConstructPoint(XCoordinate=subtraction_9, YCoordinate=0, ZCoordinate=grosime)
expression_10 = Expression(h=expression_3, th=grosime, Expression="h-th*2")
expression_11 = Expression(h=expression_3, th=grosime, Expression="h-th*2")
xy_3 = XYPlane(Origin=Point(0, 0, 0))
pt_6 = ConstructPoint(XCoordinate=0, YCoordinate=0, ZCoordinate=expression_9)
fundul = DomainBox(Base=xy_3, X=dom, Y=dom_2, Z=grosime)
capacul = DomainBox(Base=pt_6, X=dom_3, Y=dom_4, Z=grosime)

# ----
yz_2 = YZPlane(Origin=pt_4)
yz_3 = YZPlane(Origin=pt_5)

# ---- group: Corp (continued)
lat_stanga = DomainBox(Base=yz_2, X=expression_4, Y=expression_10, Z=grosime)
lat_stanga_2 = DomainBox(Base=yz_3, X=expression_4, Y=expression_11, Z=grosime)

# ----
piece_2 = Geometry(fundul)
abs_placement_2 = ABSPlacement(geo=piece_2, bool=Toggle(False), bool_2=Toggle(False), bool_3=Toggle(False), bool_4=Toggle(False))  # -> abs, piece

piece_3 = Geometry(capacul)
abs_placement_3 = ABSPlacement(geo=piece_3, bool=Toggle(False), bool_2=Toggle(False), bool_3=Toggle(False), bool_4=Toggle(False))  # -> abs, piece

piece_4 = Geometry(lat_stanga)
abs_placement_4 = ABSPlacement(geo=piece_4, bool=Toggle(False), bool_2=Toggle(False), bool_3=Toggle(False), bool_4=Toggle(False))  # -> abs, piece

piece_5 = Geometry(lat_stanga_2)
abs_placement_5 = ABSPlacement(geo=piece_5, bool=Toggle(False), bool_2=Toggle(False), bool_3=Toggle(False), bool_4=Toggle(False))  # -> abs, piece

geo_7 = Geometry([abs_placement_2.abs, abs_placement_3.abs, abs_placement_4.abs, abs_placement_5.abs, abs_placement.abs])

attach_attributes_3 = AttachAttributes(
    geo=abs_placement_2.piece,
    direction=Toggle(False),
    issertar=Toggle(False),
    isdoor=Toggle(False),
    name="fundul",
    material="base")

attach_attributes_4 = AttachAttributes(
    geo=abs_placement_3.piece,
    direction=Toggle(False),
    issertar=Toggle(False),
    isdoor=Toggle(False),
    name="capacul",
    material="base")

attach_attributes_5 = AttachAttributes(
    geo=abs_placement_4.piece,
    direction=Toggle(False),
    issertar=Toggle(False),
    isdoor=Toggle(False),
    name="laterala",
    material="base")

attach_attributes_6 = AttachAttributes(
    geo=abs_placement_5.piece,
    direction=Toggle(False),
    issertar=Toggle(False),
    isdoor=Toggle(False),
    name="laterala",
    material="base")

noptiera = Geometry([sertar_pal.sertar_2, attach_attributes_3, attach_attributes_4, attach_attributes_5, attach_attributes_6, attach_attributes_2, sertar_pal.suruburi_8, sertar_pal.facade_4, handle.maner, handle.suruburi_4])

# ---- group: Aligment
noptiera_2 = Geometry(flatten(noptiera))
abs = Geometry(flatten(geo_7))
lungime_3 = Number(expression_5)
noptiera_level = Number(object_height)
adancime_2 = Number(expression_4)
negative_half = Division(A=lungime_3, B=-2)
Y_3 = UnitY(Factor=adancime_2)
X_3 = UnitX(Factor=negative_half)
Z_3 = UnitZ(Factor=noptiera_level)
neg_11 = Negative(Value=Y_3)
comp_2 = Compound(Transforms=[neg_11, Z_3, X_3])
transform_with_attributes = TransformWithAttributes(geo=noptiera_2, transform=comp_2)
move_5 = Move(Geometry=abs, Motion=comp_2)  # -> Geometry, Transform
noptiera_aligned = Geometry(transform_with_attributes)
abs_aligned = Geometry(move_5.Geometry)

# ----
filter_by_material = FilterByMaterial(geo=noptiera_aligned, material="base")  # -> target, rest
filter_by_name = FilterByName(geo=filter_by_material.target, name="laterala")  # -> target, rest
dispatch_2 = Dispatch(List=filter_by_name.target, DispatchPattern=[True, False])  # -> ListA, ListB
dispatch_3 = Dispatch(List=filter_by_name.rest, DispatchPattern=[True, False])  # -> ListA, ListB

# ---- group: Laterala dreapta
# Latura A
# Latura B
# Latura C
# Latura D
gaurire_5 = Boolean(gaurire_2)
piesa_toreț = Geometry(dispatch_2.ListA)
piese_plasti = Geometry([dispatch_3.ListA, dispatch_3.ListB])
screws_on_box = ScrewsOnBox_3(
    suruburi=suruburi_2,
    gaurire=gaurire_5,
    piesa_toreț=piesa_toreț,
    piese_plasti=piese_plasti,
    side_a=activat,
    side_b=activat_2,
    side_c=activat_3,
    side_d=activat_4,
    fixture_a=list_2,
    fixture_b=list_3,
    fixture_c=list_4,
    fixture_d=list_5,
    trim_aa=offset_stanga,
    trim_ab=offset_dreapta_2,
    trim_ba=offset_stanga_2,
    trim_bb=offset_dreapta_3,
    trim_ca=offset_stanga_3,
    trim_cb=offset_dreapta,
    trim_da=offset_stanga_4,
    trim_db=offset_dreapta_4,
    flip_a=flip,
    flip_b=flip_2,
    flip_c=flip_3,
    flip_d=flip_4,
    scant_optiune_a=value_list,
    scant_optiune_b=list_6,
    scant_optiune_c=list_7,
    scant_optiune_d=list_8)  # -> piese_plasti_2, piesa_toreț_2, suruburi_7
geo_8 = Geometry(screws_on_box.piese_plasti_2)
geo_9 = Geometry(screws_on_box.piesa_toreț_2)
geo_10 = Geometry(screws_on_box.suruburi_7)

# Latura A
# Latura B
# Latura C
# Latura D
gaurire_6 = Boolean(gaurire_2)
piesa_toreț_2 = Geometry(dispatch_2.ListB)
piese_plasti_2 = Geometry(geo_8)
screws_on_box_2 = ScrewsOnBox_3(
    suruburi=suruburi_2,
    gaurire=gaurire_6,
    piesa_toreț=piesa_toreț_2,
    piese_plasti=piese_plasti_2,
    side_a=activat_5,
    side_b=activat_6,
    side_c=activat_7,
    side_d=activat_8,
    fixture_a=list_9,
    fixture_b=list_10,
    fixture_c=list_11,
    fixture_d=list_12,
    trim_aa=offset_stanga_5,
    trim_ab=offset_dreapta_5,
    trim_ba=offset_stanga_6,
    trim_bb=offset_dreapta_6,
    trim_ca=offset_stanga_7,
    trim_cb=offset_dreapta_7,
    trim_da=offset_stanga_8,
    trim_db=offset_dreapta_8,
    flip_a=flip_5,
    flip_b=flip_6,
    flip_c=flip_7,
    flip_d=flip_8,
    scant_optiune_a=value_list_2,
    scant_optiune_b=list_13,
    scant_optiune_c=list_14,
    scant_optiune_d=list_15)  # -> piese_plasti_2, piesa_toreț_2, suruburi_7
geo_11 = Geometry(screws_on_box_2.piese_plasti_2)
geo_12 = Geometry(screws_on_box_2.piesa_toreț_2)
geo_13 = Geometry(screws_on_box_2.suruburi_7)

# ----
filter_by_name_2 = FilterByName(geo=filter_by_material.rest, name="spatele")  # -> target, rest

# ---- group: Spatele
# Latura A
# Latura B
# Latura C
# Latura D
piesa_toreț_3 = Geometry(filter_by_name_2.target)
piese_plasti_3 = Geometry([geo_11, geo_12, geo_9])
gaurire_7 = Boolean(gaurire_2)
screws_on_box_3 = ScrewsOnBox_4(
    suruburi=suruburi_2,
    gaurire=gaurire_7,
    piesa_toreț=piesa_toreț_3,
    piese_plasti=piese_plasti_3,
    side_a=activat_9,
    side_b=activat_10,
    side_c=activat_11,
    side_d=activat_12,
    fixture_a=list_16,
    fixture_b=list_17,
    fixture_c=list_18,
    fixture_d=list_19,
    trim_aa=offset_stanga_5,
    trim_ab=offset_dreapta_9,
    trim_ba=offset_stanga_10,
    trim_bb=offset_dreapta_10,
    trim_ca=offset_stanga_11,
    trim_cb=offset_dreapta_11,
    trim_da=offset_stanga_12,
    trim_db=offset_dreapta_12,
    flip_a=flip_9,
    flip_b=flip_10,
    flip_c=flip_11,
    flip_d=flip_12,
    scant_optiune_a=value_list_3,
    scant_optiune_b=list_20,
    scant_optiune_c=list_21,
    scant_optiune_d=list_22)  # -> piese_plasti_2, piesa_toreț_2, suruburi_7
geo_14 = Geometry(screws_on_box_3.piese_plasti_2)
geo_15 = Geometry(screws_on_box_3.piesa_toreț_2)
geo_16 = Geometry(screws_on_box_3.suruburi_7)

# ----
filter_by_name_3 = FilterByName(geo=filter_by_name_2.rest, name="surub")  # -> target, rest
noptiera_cu_gaurire = Geometry(flatten([geo_14, geo_15, filter_by_name_3.rest]))
suruburi_6 = Geometry(flatten([filter_by_name_3.target, geo_16, geo_13, geo_10]))

object = Geometry(noptiera_cu_gaurire)
clean = CleanTree(RemoveNulls=True, RemoveInvalid=True, RemoveEmpty=False, Tree=object)
filter_by_material_2 = FilterByMaterial_2(geo=clean, name="base")  # -> target, rest
filter_by_material_3 = FilterByMaterial_2(geo=filter_by_material_2.rest, name="second")  # -> target, rest
filter_by_material_4 = FilterByMaterial_2(geo=filter_by_material_3.rest, name="interior")  # -> target, rest
filter_by_material_5 = FilterByMaterial_2(geo=filter_by_material_4.rest, name="maner")  # -> target, rest
filter_by_material_6 = FilterByMaterial_2(geo=filter_by_material_5.rest, name="metal")  # -> target, rest
suruburi_7 = Geometry(flatten(suruburi_6))
entwine_2 = Entwine(
    Branch00=filter_by_material_2.target,
    Branch01=filter_by_material_3.target,
    Branch02=filter_by_material_4.target,
    Branch03=filter_by_material_5.target,
    Branch04=filter_by_material_6.target,
    Branch05=suruburi_7,
    FlattenInputs=True)

filter_by_name_4 = FilterByName(geo=filter_by_material_2.target, name="laterala")  # -> target, rest
geo_17 = Geometry(filter_by_name_4.target)
extractattr = ExtractAttributes(Object=geo_17)
bbox = BoundingBox(Content=geo_17, Plane=yz)  # -> Box, Box_2
injectattr = InjectAttributes(Object=bbox.Box, Attributes=extractattr)
geo_18 = Geometry([injectattr, filter_by_name_4.rest])

# ---- group: Export_CSV (continued)
sectie_1 = Sectie1(material_name=base_color_name_2, geo=flatten(geo_18))
sectie_1_2 = Sectie1(material_name=second_color_name_2, geo=flatten(filter_by_material_3.target))
sectie_1_3 = Sectie1(material_name=interior_color_name_2, geo=flatten(filter_by_material_4.target))
entwine_3 = Entwine(Branch00=header, Branch01=sectie_1, Branch02=sectie_1_2, Branch03=sectie_1_3, FlattenInputs=True)
export_detaliere = DownloadExport(Data=entwine_3, Options=exporttxt_2, Name="Masa machiaj MM06xx_detaliere")

# ---- group: Export DWG (continued)
injectattr_2 = InjectAttributes(Object=entwine_2, Attributes=constructattr)
export_dwg = DownloadExport(Data=injectattr_2, Options=exportdwgdxf, Name="Comoda_test_suruburi")

# ----
texture_mapping_2 = TextureMapping_2(geo=noptiera_cu_gaurire, scale=texture_scale)  # -> pal_mapped, rest_geo

# ---- group: XY orientation
list_23 = ValueList({"AngularDimension", "Arc", "Block", "Brep", "Circle", "Curve", "Dimension", "Ellipse", "Extrusion", "Hatch", "Leader", "Line", "LinearDimension", "Mesh", "Point", "Polyline", "Polysurface", "RadialDimension", "Surface", "Text", "TextDot"}, selected="Mesh")
filtertype = FilterByType(ObjectType=list_23, Geometry=noptiera_cu_gaurire, invertFilter=False, returnNulls=False)  # -> ExcludedGeometry, IncludedGeometry
bbox_2 = BoundingBox(Content=filtertype.ExcludedGeometry, Plane=PlaneXY(0, 0, 0))  # -> Box, Box_2
debrep = DeconstructBrep(Brep=bbox_2.Box)  # -> Faces, Edges, Vertices
pt_7 = Point(Point(0.5, 0.5, 0))
evalsrf = EvaluateSurface(Surface=reparameterize(debrep.Faces), Point=pt_7)  # -> Point, Normal, UDirection, VDirection, Frame
area = Area(Geometry=debrep.Faces)  # -> Area, Centroid
sort = SortList(Keys=area.Area, ValuesA=debrep.Faces)  # -> Keys, reverse(ValuesA)
item_8 = ListItem(List=sort.ValuesA, Index=0, Wrap=True)
pln = Plane(flatten(item_8))
xy_4 = XYPlane(Origin=Point(0, 0, 0))
orient_2 = Orient(Geometry=filtertype.ExcludedGeometry, Source=pln, Target=xy_4)  # -> Geometry, Transform

# ----
sertar_filter = SertarFilter(geo=flatten([texture_mapping_2.pal_mapped, texture_mapping_2.rest_geo]))  # -> flatten(target), rest

# ---- group: Deschidere sertar
subtraction_10 = Subtraction(A=expression_4, B="53")
expression_12 = Expression(x=subtraction_10, Expression="floor(x/50)*50-10")
neg_12 = Negative(Value=expression_12)
filter_7 = StreamFilter(Gate=vizualizare, Stream0=0, Stream1=neg_12)
Y_4 = UnitY(Factor=filter_7)
transform_with_attributes_2 = TransformWithAttributes(geo=sertar_filter.target, transform=Y_4)  # -> flatten(geo_2)

# ----
suruburi_8 = GlTF20Display(Geometry=[suruburi_6, abs_aligned], Material=gltf2material_3)

# ---- group: Zero alignment
yz_4 = YZPlane(Origin=Point(0, 0, 0))
movetoplane = MoveToPlane(Geometry=orient_2.Geometry, Plane=yz_4, Above=True, Below=True)  # -> Geometry, Transform
xz_6 = XZPlane(Origin=Point(0, 0, 0))
flippln = FlipPlane(Plane=xz_6, FlipX=False, FlipY=False, FlipZ=True)  # -> Flipped, R
movetoplane_2 = MoveToPlane(Geometry=movetoplane.Geometry, Plane=flippln.Flipped, Above=True, Below=True)  # -> Geometry, Transform
xy_5 = XYPlane(Origin=Point(0, 0, 0))
movetoplane_3 = MoveToPlane(Geometry=movetoplane_2.Geometry, Plane=xy_5, Above=True, Below=True)  # -> Geometry, Transform

# ----
cap_2 = CapHoles(Brep=movetoplane_3.Geometry)
panels = Geometry(simplify(graft(cap_2)))
py3 = Python3Script(B=panels)  # -> INFO, MPR; inputs B: tree of Brep
# ---------- py3: Python ----------
# -*- coding: utf-8 -*-
r"""
gh_brep2mpr.py -- Grasshopper Script component: raw Brep -> woodWOP MPR text.

Paste the whole file into a Rhino 8 Script component set to **Python 3**.
It is self-contained; nothing else needs to be on the module path.

Component setup
---------------
    input   B      Brep      access = Tree      (one part per branch)
    output  MPR    -                            (one MPR program per branch)
    output  INFO   -                            (one report line per part)

Takes raw solids with no attached data: the panel size and every drilling are
recognised from the geometry itself.

**Parts are assumed to arrive lying flat in the world XY plane** — thickness
along Z. Nothing is rotated out of that plane; a part that is not flat is
reported in INFO rather than corrected.

    - the world bounding box gives the panel size
    - the long side of the part is turned to X (LONG_X)
    - the part is turned over if all the vertical drilling would otherwise
      come from underneath (FLIP)
    - cylindrical faces become drillings, classified by where they break out:
        along Z, open at the top      -> <102 \BohrVert\
        along Z, open at the bottom   -> <131 \UfluBohr\
        along X or Y, open at an edge -> <103 \BohrHoriz\
        any other angle               -> <104 \BohrUniv\
    - an outline that is not the bounding rectangle becomes a contour ]1
      plus <105 \Konturfraesen\

Output is text, not files. Write it out with a File component, or feed it to a
Stream Contents component -- but write with CRLF: woodWOP reads an LF-only
program as one unparseable line and silently opens an empty default panel.
"""

import math

import Rhino
from Grasshopper import DataTree
from Grasshopper.Kernel.Data import GH_Path

# ---------------------------------------------------------------------------
# settings
# ---------------------------------------------------------------------------

SNAP = 0.0          # round drill diameters to this step (0 = leave exact)
MAX_DIA = 60.0      # larger round openings are not treated as drillings
BM_VERT = "LS"      # drill mode for vertical bores: LS SS LSL SSS
THICKNESS = None    # force a thickness in mm, or None to measure it
LONG_X = True       # turn the part so its long side runs along X
FLIP = True         # turn the part over if it would be drilled from below
CONTOUR = True      # emit a contour when the outline is not a rectangle
SAMPLES = 96        # points sampled per face loop

FACE_TOL = 0.02     # "breaks out through this face", mm
GEO_TOL = 1e-4

try:
    _doc = Rhino.RhinoDoc.ActiveDoc
    TOL = _doc.ModelAbsoluteTolerance
    UNITS = _doc.ModelUnitSystem
except Exception:
    TOL = 0.001
    UNITS = None
if not TOL or TOL <= 0:
    TOL = 0.001


# ---------------------------------------------------------------------------
# vector helpers -- plain 3-tuples, so no RhinoCommon operator overloading
# ---------------------------------------------------------------------------

def p3(p):
    return (p.X, p.Y, p.Z)


def vsub(a, b):
    return (a[0] - b[0], a[1] - b[1], a[2] - b[2])


def vadd(a, b):
    return (a[0] + b[0], a[1] + b[1], a[2] + b[2])


def vmul(a, s):
    return (a[0] * s, a[1] * s, a[2] * s)


def vdot(a, b):
    return a[0] * b[0] + a[1] * b[1] + a[2] * b[2]


def vlen(a):
    return math.sqrt(vdot(a, a))


def vnorm(a):
    n = vlen(a)
    return (0.0, 0.0, 0.0) if n < 1e-12 else (a[0] / n, a[1] / n, a[2] / n)


def canonical_axis(a):
    """+Z and -Z are the same hole axis; pick one representative direction."""
    a = vnorm(a)
    for c in a:
        if c > 1e-6:
            return a
        if c < -1e-6:
            return vmul(a, -1.0)
    return a


# in-plane rotations: both keep the part flat in XY (proper rotations)

def rot_z90(p):
    return (p[1], -p[0], p[2])


def rot_x180(p):
    return (p[0], -p[1], -p[2])


# ---------------------------------------------------------------------------
# MPR output
# ---------------------------------------------------------------------------

TWO_PI = 2.0 * math.pi
SEP = " "


def fnum(v, nd=3):
    """Macro parameter value: trimmed, e.g. 9.5 / 18 / 0."""
    try:
        v = round(float(v), nd)
    except (TypeError, ValueError):
        return "0"
    if abs(v) < 10 ** (-nd):
        v = 0.0
    s = ("%.*f" % (nd, v)).rstrip("0").rstrip(".")
    return "0" if s in ("", "-", "-0") else s


def cnum(v, nd=4):
    """Contour element coordinate: woodWOP writes these with four decimals."""
    try:
        v = float(v)
    except (TypeError, ValueError):
        return "0.0000"
    if abs(v) < 10 ** -(nd + 1):
        v = 0.0
    return "%.*f" % (nd, v)


def ds_code(ccw, sweep):
    """MPR parser constants: _cc=0 _cw=1 _CC=2 _CW=3 (section 4 of the spec)."""
    big = sweep > math.pi + 1e-9
    if ccw:
        return 2 if big else 0
    return 3 if big else 1


def arc_ds(p0, p1, centre, mid):
    """Direction code, using a point known to lie inside the arc."""
    def ang(p):
        return math.atan2(p[1] - centre[1], p[0] - centre[0])

    a0 = ang(p0)
    d1 = (ang(p1) - a0) % TWO_PI
    if mid is not None:
        dm = (ang(mid) - a0) % TWO_PI
        if 1e-9 < dm < d1:
            return ds_code(True, d1)
        return ds_code(False, TWO_PI - d1)
    return ds_code(True, d1) if d1 <= math.pi else ds_code(False, TWO_PI - d1)


class Part(object):
    def __init__(self):
        self.lx = self.ly = self.lz = 0.0
        self.macros = []            # (id, name, [(key, value), ...])
        self.contour = None         # [(kind, {param: value}), ...]
        self.notes = []


def render_mpr(part):
    """Build the MPR program text. Newlines are LF here -- convert on write."""
    out = []
    a = out.append
    a("[H")
    a('VERSION="4.0 Alpha"')
    a('INCH="0"')
    a('OP="0"')
    a('FM="1"')
    a('FW="700"')
    a('VIEW="NOMIRROR"')
    a("_BSX=%.6f" % part.lx)
    a("_BSY=%.6f" % part.ly)
    a("_BSZ=%.6f" % part.lz)
    a(SEP)

    if part.contour:
        a("]1")
        for i, (kind, vals) in enumerate(part.contour):
            a("$E%d" % i)
            a(kind)
            for k, v in vals:
                a("%s=%s" % (k, v))
            a(SEP)

    a("<100 \\WerkStck\\")
    a('LA="%s"' % fnum(part.lx))
    a('BR="%s"' % fnum(part.ly))
    a('DI="%s"' % fnum(part.lz))
    a('FNX="0"')
    a('FNY="0"')
    a('AX="0"')
    a('AY="0"')
    a(SEP)

    if part.contour:
        a("<105 \\Konturfraesen\\")
        a('EA="1:0"')
        a('MDA="TAN"')
        a('RK="NoWRK"')
        a('EE="1:%d"' % (len(part.contour) - 1))
        a('MDE="TAN_AB"')
        a('EM="0"')
        a('RI="1"')
        a('TNO=""')
        a('S_="STANDARD"')
        a('F_="0"')
        a('AB=""')
        a('ZA="@0"')
        a('STUFEN="0"')
        a('ZSTART="0"')
        a('ANZZST="1"')
        a(SEP)

    for mid, name, params in part.macros:
        a("<%d \\%s\\" % (mid, name))
        for k, v in params:
            a('%s="%s"' % (k, v))
        a(SEP)

    while out and out[-1] == SEP:
        out.pop()               # '!' follows the last block directly
    a("!")
    return "\n".join(out) + "\n"


# ---------------------------------------------------------------------------
# reading the Brep
# ---------------------------------------------------------------------------

class Hole(object):
    """A bore, as the two ends of its axis plus a diameter."""

    def __init__(self, p0, p1, dia):
        self.p0 = p0
        self.p1 = p1
        self.dia = dia

    def axis(self):
        return canonical_axis(vsub(self.p1, self.p0))

    def transform(self, fn):
        self.p0 = fn(self.p0)
        self.p1 = fn(self.p1)


class Seg(object):
    """One outline segment: a line, or an arc with centre and interior point."""

    def __init__(self, p0, p1, centre=None, radius=None, mid=None):
        self.p0 = p0
        self.p1 = p1
        self.centre = centre
        self.radius = radius
        self.mid = mid

    def transform(self, fn):
        self.p0 = fn(self.p0)
        self.p1 = fn(self.p1)
        if self.centre is not None:
            self.centre = fn(self.centre)
            self.mid = fn(self.mid)


def face_normal(face):
    """Outward normal of a face, honouring the face's orientation flag.

    Only ever called on planar faces, where the normal is the same everywhere,
    so evaluating at the middle of the domain is safe even when the face is
    trimmed.
    """
    n = p3(face.NormalAt(face.Domain(0).Mid, face.Domain(1).Mid))
    return vmul(n, -1.0) if face.OrientationIsReversed else n


def loop_points(face, count=SAMPLES):
    """Points sampled along the outer loop of a face."""
    crv = face.OuterLoop.To3dCurve()
    if crv is None:
        return []
    pts = []
    ts = crv.DivideByCount(count, True)
    if ts:
        pts = [p3(crv.PointAt(t)) for t in ts]
    if not pts:
        pts = [p3(crv.PointAtStart), p3(crv.PointAtEnd)]
    return pts


def loop_segments(face, notes):
    """Outer loop of a face as line / arc segments, in curve order."""
    crv = face.OuterLoop.To3dCurve()
    if crv is None:
        return []
    parts = crv.DuplicateSegments()
    if not parts:
        parts = [crv]
    segs = []
    for s in parts:
        p0, p1 = p3(s.PointAtStart), p3(s.PointAtEnd)
        if s.IsLinear(TOL):
            segs.append(Seg(p0, p1))
            continue
        ok, arc = s.TryGetArc(TOL)
        if ok:
            segs.append(Seg(p0, p1, p3(arc.Center), arc.Radius,
                            p3(arc.MidPoint)))
            continue
        notes.append("outline segment is neither line nor arc - "
                     "replaced by a straight chord")
        segs.append(Seg(p0, p1))
    return segs


def read_brep(brep, notes):
    """Everything we machine, in world coordinates.

    The part is taken to be lying flat already: thickness along Z. A part that
    clearly is not flat is reported rather than rotated, because turning it
    would silently contradict the layout the definition produced.
    """
    box = brep.GetBoundingBox(True)          # accurate, world aligned
    corners = [(x, y, z)
               for x in (box.Min.X, box.Max.X)
               for y in (box.Min.Y, box.Max.Y)
               for z in (box.Min.Z, box.Max.Z)]

    cylinders = []
    planars = []
    for face in brep.Faces:
        ok, cyl = face.UnderlyingSurface().TryGetCylinder(TOL)
        if ok:
            pts = loop_points(face)
            if not pts:
                continue
            axis = canonical_axis(p3(cyl.Axis))
            centre = p3(cyl.Center)
            base = vsub(centre, vmul(axis, vdot(centre, axis)))
            ts = [vdot(p, axis) for p in pts]
            cylinders.append((axis, base, cyl.Radius, min(ts), max(ts)))
            continue
        ok, _pl = face.TryGetPlane(TOL)
        if ok:
            planars.append((face_normal(face), loop_segments(face, notes)))

    holes = []
    for axis, base, radius, tmin, tmax in _merge(cylinders):
        if tmax - tmin < 0.05:
            continue
        holes.append(Hole(vadd(base, vmul(axis, tmin)),
                          vadd(base, vmul(axis, tmax)), 2.0 * radius))

    return corners, holes, planars


def _merge(cylinders):
    """Fold the half-cylinder patches of one bore back into a single hole."""
    groups = {}
    for axis, base, radius, tmin, tmax in cylinders:
        key = (tuple(round(c, 3) for c in axis),
               tuple(round(c, 3) for c in base),
               round(radius, 3))
        if key in groups:
            a, b, r, lo, hi = groups[key]
            groups[key] = (a, b, r, min(lo, tmin), max(hi, tmax))
        else:
            groups[key] = (axis, base, radius, tmin, tmax)
    return list(groups.values())


# ---------------------------------------------------------------------------
# orientation
# ---------------------------------------------------------------------------

def _bbox(corners, holes):
    pts = list(corners)
    for h in holes:
        pts.append(h.p0)
        pts.append(h.p1)
    xs = [p[0] for p in pts]
    ys = [p[1] for p in pts]
    zs = [p[2] for p in pts]
    return min(xs), min(ys), min(zs), max(xs), max(ys), max(zs)


def _apply(fn, corners, holes, planars):
    corners = [fn(c) for c in corners]
    for h in holes:
        h.transform(fn)
    for n, segs in planars:
        for s in segs:
            s.transform(fn)
    planars[:] = [(fn(n), segs) for n, segs in planars]
    return corners


def place(corners, holes, planars, notes):
    """Long side along X, drilling from above, part on the zero point.

    Both rotations are about Z or about X by 180 degrees, so the part stays
    flat in XY either way.
    """
    if LONG_X:
        x0, y0, _z0, x1, y1, _z1 = _bbox(corners, holes)
        if (x1 - x0) < (y1 - y0) - GEO_TOL:
            corners = _apply(rot_z90, corners, holes, planars)
            notes.append("turned 90 deg so the long side runs along X")

    if FLIP:
        _x0, _y0, z0, _x1, _y1, z1 = _bbox(corners, holes)
        top = bot = 0
        for h in holes:
            if abs(abs(h.axis()[2]) - 1.0) > 1e-3:
                continue
            if abs(max(h.p0[2], h.p1[2]) - z1) <= FACE_TOL:
                top += 1
            elif abs(min(h.p0[2], h.p1[2]) - z0) <= FACE_TOL:
                bot += 1
        if bot and not top:
            corners = _apply(rot_x180, corners, holes, planars)
            notes.append("turned over so the drilling is done from above")

    x0, y0, z0, _x1, _y1, _z1 = _bbox(corners, holes)
    if abs(x0) > GEO_TOL or abs(y0) > GEO_TOL or abs(z0) > GEO_TOL:
        corners = _apply(lambda p: vsub(p, (x0, y0, z0)),
                         corners, holes, planars)
    return corners


# ---------------------------------------------------------------------------
# features -> macros
# ---------------------------------------------------------------------------

def emit_hole(part, hole):
    dia = hole.dia
    if SNAP > 0:
        dia = round(dia / SNAP) * SNAP
    if dia > MAX_DIA:
        part.notes.append("round opening d=%s left as geometry, not drilled "
                          "(over MAX_DIA)" % fnum(dia))
        return

    p0, p1 = hole.p0, hole.p1
    ax, ay, az = hole.axis()

    # ---- vertical --------------------------------------------------------
    if abs(abs(az) - 1.0) < 1e-3:
        zlo, zhi = min(p0[2], p1[2]), max(p0[2], p1[2])
        x, y = p0[0], p0[1]
        open_top = abs(zhi - part.lz) <= FACE_TOL
        open_bot = abs(zlo) <= FACE_TOL
        if open_top:
            depth = part.lz if open_bot else part.lz - zlo
            part.macros.append((102, "BohrVert", [
                ("XA", fnum(x)), ("YA", fnum(y)),
                ("TI", fnum(depth)), ("DU", fnum(dia)),
                ("BM", BM_VERT), ("S_", "2"),
                ("AN", "1"), ("AB", "0"), ("WI", "0")]))
        elif open_bot:
            part.macros.append((131, "UfluBohr", [
                ("XA", fnum(x)), ("YA", fnum(y)),
                ("DU", fnum(dia)), ("WI", "0"),
                ("TI", fnum(zhi)), ("AB", "0"), ("F_", "STANDARD")]))
        else:
            part.notes.append("closed internal bore d=%s at X=%s Y=%s skipped"
                              % (fnum(dia), fnum(x), fnum(y)))
        return

    # ---- horizontal ------------------------------------------------------
    along_x = abs(abs(ax) - 1.0) < 1e-3
    along_y = abs(abs(ay) - 1.0) < 1e-3
    if abs(az) < 1e-3 and (along_x or along_y):
        i = 0 if along_x else 1
        lo, hi = (p0, p1) if p0[i] <= p1[i] else (p1, p0)
        limit = part.lx if along_x else part.ly
        if abs(lo[i]) <= FACE_TOL:
            bm, entry = ("XP" if along_x else "YP"), lo
        elif abs(hi[i] - limit) <= FACE_TOL:
            bm, entry = ("XM" if along_x else "YM"), hi
        else:
            part.notes.append("internal horizontal bore d=%s skipped "
                              "(reaches no edge)" % fnum(dia))
            return
        part.macros.append((103, "BohrHoriz", [
            ("XA", fnum(entry[0])), ("YA", fnum(entry[1])),
            ("ZA", fnum(entry[2])), ("DU", fnum(dia)),
            ("TI", fnum(hi[i] - lo[i])), ("BM", bm),
            ("AN", "1"), ("AB", "0"), ("F_", "STANDARD")]))
        return

    # ---- any other angle -------------------------------------------------
    d = vnorm(vsub(p0, p1))
    entry = p1
    if d[2] > 0:
        d = vmul(d, -1.0)
        entry = p0
    wi = math.degrees(math.acos(max(-1.0, min(1.0, -d[2]))))
    ca = math.degrees(math.atan2(d[1], d[0])) % 360.0
    part.macros.append((104, "BohrUniv", [
        ("XA", fnum(entry[0])), ("YA", fnum(entry[1])),
        ("ZA", fnum(entry[2])), ("CA", fnum(ca)), ("WI", fnum(wi)),
        ("DU", fnum(dia)), ("TI", fnum(vlen(vsub(p1, p0)))),
        ("AN", "1"), ("AB", "0"), ("F_", "STANDARD")]))
    part.notes.append("slanted bore as <104 BohrUniv> (CA=%s WI=%s) - needs a "
                      "swivel drilling unit" % (fnum(ca), fnum(wi)))


def outline(planars, part):
    """Contour elements for the top face, when it is not just the rectangle."""
    best = None
    best_z = None
    for normal, segs in planars:
        if abs(normal[2] - 1.0) > 1e-3 or not segs:
            continue
        z = max(s.p0[2] for s in segs)
        if best_z is None or z > best_z + GEO_TOL:
            best_z, best = z, segs
    if not best or abs(best_z - part.lz) > 0.5:
        return None

    elems = [("KP", [("X", cnum(best[0].p0[0])), ("Y", cnum(best[0].p0[1])),
                     ("Z", "0"), ("KO", "0")])]
    for s in best:
        if s.radius:
            elems.append(("KA", [("X", cnum(s.p1[0])), ("Y", cnum(s.p1[1])),
                                 ("R", cnum(s.radius)),
                                 ("DS", str(arc_ds(s.p0, s.p1, s.centre,
                                                   s.mid)))]))
        else:
            elems.append(("KL", [("X", cnum(s.p1[0])), ("Y", cnum(s.p1[1]))]))

    if len(elems) == 5 and all(k == "KL" for k, _v in elems[1:]):
        corners = set()
        for _k, vals in elems:
            d = dict(vals)
            corners.add((round(float(d["X"]), 2), round(float(d["Y"]), 2)))
        rect = {(0.0, 0.0), (round(part.lx, 2), 0.0),
                (round(part.lx, 2), round(part.ly, 2)),
                (0.0, round(part.ly, 2))}
        if corners == rect:
            return None                 # plain rectangle: WerkStck covers it
    return elems


def check_flat(part):
    """The script assumes the part already lies flat: thickness along Z.

    Nothing is rotated out of plane to fix it -- that would contradict the
    layout the definition produced -- but a part fed in on edge would quietly
    yield a program with the wrong size and the wrong drilling, so say so.
    """
    dims = (part.lx, part.ly, part.lz)
    thin = min(range(3), key=lambda i: dims[i])
    if thin != 2 and dims[thin] < 0.6 * sorted(dims)[1]:
        part.notes.append(
            "WARNING: this part is not lying flat in XY - its thinnest "
            "direction is %s (%s mm), so DI reads %s mm. Size and drilling "
            "below are almost certainly wrong."
            % ("XYZ"[thin], fnum(dims[thin]), fnum(part.lz)))


def brep_to_part(brep):
    part = Part()
    if brep is None or not brep.IsValid:
        raise ValueError("invalid Brep")

    corners, holes, planars = read_brep(brep, part.notes)
    corners = place(corners, holes, planars, part.notes)

    x0, y0, z0, x1, y1, z1 = _bbox(corners, holes)
    part.lx, part.ly = x1 - x0, y1 - y0
    part.lz = (z1 - z0) if THICKNESS is None else THICKNESS
    if part.lx < 1.0 or part.ly < 1.0 or part.lz < 0.5:
        raise ValueError("implausible part size %s x %s x %s mm"
                         % (fnum(part.lx), fnum(part.ly), fnum(part.lz)))
    check_flat(part)

    for hole in holes:
        emit_hole(part, hole)
    part.macros.sort(key=lambda m: (m[0],
                                    float(dict(m[2]).get("XA", 0)),
                                    float(dict(m[2]).get("YA", 0))))
    if CONTOUR:
        part.contour = outline(planars, part)
    return part


def describe(part):
    counts = {}
    for _mid, name, _p in part.macros:
        counts[name] = counts.get(name, 0) + 1
    detail = ", ".join("%d x %s" % (v, k) for k, v in sorted(counts.items()))
    if part.contour:
        detail += (", " if detail else "") + "contour"
    text = "%s x %s x %s mm   %s" % (fnum(part.lx), fnum(part.ly),
                                     fnum(part.lz), detail or "no machining")
    for note in dict.fromkeys(part.notes):
        text += "\n  note: %s" % note
    return text


# ---------------------------------------------------------------------------
# Grasshopper plumbing
# ---------------------------------------------------------------------------

def branches_of(tree):
    """Work whether the input access is Tree, List or Item."""
    if tree is None:
        return []
    if hasattr(tree, "Branches") and hasattr(tree, "Paths"):
        return list(zip(list(tree.Paths), [list(b) for b in tree.Branches]))
    if isinstance(tree, (list, tuple)):
        return [(GH_Path(0), list(tree))]
    return [(GH_Path(0), [tree])]


MPR = DataTree[object]()
INFO = DataTree[object]()

if UNITS is not None and UNITS != Rhino.UnitSystem.Millimeters:
    INFO.Add("WARNING: the document is not in millimetres (%s). woodWOP "
             "expects mm - every size below is wrong." % UNITS, GH_Path(0))

for path, items in branches_of(B):
    for brep in items:
        if brep is None:
            continue
        try:
            part = brep_to_part(brep)
            MPR.Add(render_mpr(part), path)
            INFO.Add(describe(part), path)
        except Exception as exc:
            MPR.Add(None, path)
            INFO.Add("ERROR: %s" % exc, path)
# ---------- end py3 ----------
txt = Text(py3.MPR)
listdexs = ListIndices(List=flatten(txt))

# ----
# Create individual streams
# Create Stream: The Create Stream component works similarly to the standard ShapeDiver Export components. Feed data (D) and export options (O) for the embedded file format you want to create a memory stream for.
createstream = CreateStream(Data=txt, Options=exporttxt)

concat_3 = Concatenate(FragmentA="Panel_", FragmentB=listdexs, FragmentC=".mpr")

# ----
# Merge streams in
# a single one
# Zip Streams: Merge several streams and specify a file name (including the extension) for each of the streams.
# 
# The components outputs a new stream representing a zip archive that contains all specified files.
export_name_dxf = Text(concat_3)
zipstreams = ZipStreams(Streams=flatten(createstream), Filenames=flatten(export_name_dxf))

text = Text("test-fitting")
exportemail = EmailExport(
    Data=zipstreams,
    Options=exportstream,
    Name=text,
    To="info@artcharm.md",
    CC="artcharm.prod@gmail.com",
    Subject=text,
    Body=join_2,
    AttachExport=True,
    AttachJSON=False)

# ----
# Base color
roughness_2 = Slider(0.7, range=0..1)
base_color_index_2 = Integer(base_color_index)

# ---- group: Basalt
gltf2material_24 = GlTF20Material(
    BaseColorFactor=RGB(255, 255, 255),
    BaseColorTexture=panel_44,
    MetallicFactor=0,
    RoughnessFactor=roughness_2,
    NormalTexture=smooth_normal_texture,
    EmissiveFactor=RGB(0, 0, 0),
    AlphaMode="OPAQUE",
    AlphaCutoff=0.5,
    DoubleSided=True)

# ---- group: Alpine White
gltf2material_25 = GlTF20Material(
    BaseColorFactor=RGB(255, 255, 255),
    BaseColorTexture=panel_33,
    MetallicFactor=0,
    RoughnessFactor=roughness_2,
    NormalTexture=smooth_normal_texture,
    EmissiveFactor=RGB(0, 0, 0),
    AlphaMode="OPAQUE",
    AlphaCutoff=0.5,
    DoubleSided=True)

# ---- group: Sand Beige
gltf2material_26 = GlTF20Material(
    BaseColorFactor=RGB(255, 255, 255),
    BaseColorTexture=panel_31,
    MetallicFactor=0,
    RoughnessFactor=roughness_2,
    NormalTexture=smooth_normal_texture,
    EmissiveFactor=RGB(0, 0, 0),
    AlphaMode="OPAQUE",
    AlphaCutoff=0.5,
    DoubleSided=True)

# ---- group: Cashmere Grey
gltf2material_27 = GlTF20Material(
    BaseColorFactor=RGB(255, 255, 255),
    BaseColorTexture=panel_29,
    MetallicFactor=0,
    RoughnessFactor=roughness_2,
    NormalTexture=smooth_normal_texture,
    EmissiveFactor=RGB(0, 0, 0),
    AlphaMode="OPAQUE",
    AlphaCutoff=0.5,
    DoubleSided=True)

# ---- group: Stone Grey
gltf2material_28 = GlTF20Material(
    BaseColorFactor=RGB(255, 255, 255),
    BaseColorTexture=panel_30,
    MetallicFactor=0,
    RoughnessFactor=roughness_2,
    NormalTexture=smooth_normal_texture,
    EmissiveFactor=RGB(0, 0, 0),
    AlphaMode="OPAQUE",
    AlphaCutoff=0.5,
    DoubleSided=True)

# ---- group: Pearl Grey
gltf2material_29 = GlTF20Material(
    BaseColorFactor=RGB(255, 255, 255),
    BaseColorTexture=panel_35,
    MetallicFactor=0,
    RoughnessFactor=roughness_2,
    NormalTexture=smooth_normal_texture,
    EmissiveFactor=RGB(0, 0, 0),
    AlphaMode="OPAQUE",
    AlphaCutoff=0.5,
    DoubleSided=True)

# ---- group: Dust grey
gltf2material_30 = GlTF20Material(
    BaseColorFactor=RGB(255, 255, 255),
    BaseColorTexture=panel_35,
    MetallicFactor=0,
    RoughnessFactor=roughness_2,
    NormalTexture=smooth_normal_texture,
    EmissiveFactor=RGB(0, 0, 0),
    AlphaMode="OPAQUE",
    AlphaCutoff=0.5,
    DoubleSided=True)

# ---- group: Onyx grey
gltf2material_31 = GlTF20Material(
    BaseColorFactor=RGB(255, 255, 255),
    BaseColorTexture=panel_36,
    MetallicFactor=0,
    RoughnessFactor=roughness_2,
    NormalTexture=smooth_normal_texture,
    EmissiveFactor=RGB(0, 0, 0),
    AlphaMode="OPAQUE",
    AlphaCutoff=0.5,
    DoubleSided=True)

# ---- group: Cubanit grey
gltf2material_32 = GlTF20Material(
    BaseColorFactor=RGB(255, 255, 255),
    BaseColorTexture=panel_32,
    MetallicFactor=0,
    RoughnessFactor=roughness_2,
    NormalTexture=smooth_normal_texture,
    EmissiveFactor=RGB(0, 0, 0),
    AlphaMode="OPAQUE",
    AlphaCutoff=0.5,
    DoubleSided=True)

# ----
merge_31 = Merge(
    Data1=gltf2material_25,
    Data2=gltf2material_26,
    Data3=gltf2material_27,
    Data4=gltf2material_28,
    Data5=gltf2material_29,
    Data6=gltf2material_30,
    Data7=gltf2material_31,
    Data8=gltf2material_32)
item_9 = ListItem(List=merge_31, Index=base_color_index_2, Wrap=True)

item_10 = ListItem(List=item_9, Index=0, Wrap=True)

merge_32 = Merge(
    Data1=gltf2material_25,
    Data2=gltf2material_27,
    Data3=gltf2material_28,
    Data4=gltf2material_31,
    Data5=gltf2material_19,
    Data6=gltf2material_15,
    Data7=gltf2material_22,
    Data8=item_10)
item_11 = ListItem(List=merge_32, Index=second_color_index_2, Wrap=True)

# ----
# Interior color
merge_33 = Merge(Data1=gltf2material_25, Data2=gltf2material_29, Data3=gltf2material_26, Data4=gltf2material_24)
interior_color_index_2 = Integer(interior_color_index)
item_12 = ListItem(List=merge_33, Index=interior_color_index_2, Wrap=True)

# ---- group: Display
noptiera_aligned_2 = Geometry([transform_with_attributes_2, sertar_filter.rest])
filter_by_material_7 = FilterByMaterial(geo=noptiera_aligned_2, material="base")  # -> target, rest
filter_by_material_8 = FilterByMaterial(geo=noptiera_aligned_2, material="second")  # -> target, rest
filter_by_material_9 = FilterByMaterial(geo=noptiera_aligned_2, material="interior")  # -> target, rest
filter_by_name_5 = FilterByName(geo=noptiera_aligned_2, name="maner")  # -> target, rest
base_color_2 = GlTF20Display(Geometry=filter_by_material_7.target, Material=item_9)
second_color_2 = GlTF20Display(Geometry=filter_by_material_8.target, Material=item_11)
interior_color_2 = GlTF20Display(Geometry=filter_by_material_9.target, Material=item_12)
manere = GlTF20Display(Geometry=filter_by_name_5.target, Material=item_7)

# ----
geo_19 = Geometry([filter_by_material_7.target, filter_by_material_8.target, filter_by_material_9.target, filter_by_name_5.target])

# ==== cluster TextureMapping
geo = ClusterInput()
scale = ClusterInput()
direction = ClusterInput()

# ---- group: Orientation detection
geo_2 = Geometry(graft(geo))
debox = DeconstructBox(Box=geo_2)  # -> Plane, X, Y, Z
dedomain = DeconstructDomain(Domain=debox.X)  # -> Start, End
dedomain_2 = DeconstructDomain(Domain=debox.Y)  # -> Start, End
dedomain_3 = DeconstructDomain(Domain=debox.Z)  # -> Start, End
subtraction = Subtraction(A=dedomain.Start, B=dedomain.End)
subtraction_2 = Subtraction(A=dedomain_2.Start, B=dedomain_2.End)
subtraction_3 = Subtraction(A=dedomain_3.Start, B=dedomain_3.End)
X = UnitX(Factor=1)
Y = UnitY(Factor=1)
Z = UnitZ(Factor=1)
abs = Absolute(Value=subtraction)
abs_2 = Absolute(Value=subtraction_2)
abs_3 = Absolute(Value=subtraction_3)
sort = SortList(Keys=[abs, abs_2, abs_3], ValuesA=[X, Y, Z])  # -> Keys, ValuesA
item = ListItem(List=sort.ValuesA, Index="1", Wrap=True)
item_2 = ListItem(List=sort.ValuesA, Index="2", Wrap=True)
xprod = CrossProduct(VectorA=item, VectorB=item_2, Unitize=False)  # -> Vector, Length

# ---- group: Edge detection
geo_3 = Geometry(graft(geo))
vec = Vector(xprod.Vector)
debrep = DeconstructBrep(Brep=geo_3)  # -> Faces, Edges, Vertices
pt = ConstructPoint(XCoordinate="0.5", YCoordinate="0.5", ZCoordinate=0)
evalsrf = EvaluateSurface(Surface=debrep.Faces, Point=pt)  # -> Point, Normal, UDirection, VDirection, Frame
dprod = DotProduct(VectorA=vec, VectorB=evalsrf.Normal, Unitize=False)
abs_4 = Absolute(Value=dprod)
round = Round(Number=abs_4)  # -> Nearest, Floor, Ceiling
equals = Equality(FirstNumber=round.Floor, SecondNumber="0")  # -> Equality, Inequality
dispatch = Dispatch(List=debrep.Faces, DispatchPattern=equals.Equality)  # -> ListA, ListB

# ---- group: Orientation detection / Vector debug
pt_2 = Point(Point(0, 0, 0))
amp = Amplitude(Vector=xprod.Vector, Amplitude="300")
vdis = VectorDisplay(Anchor=pt_2, Vector=amp)

# ---- group: Edge mapping
scale_2 = Number(scale)
geo_4 = Geometry(dispatch.ListA)
dim = Dimensions(Surface=geo_4)  # -> UDimension, VDimension
division = Division(A=dim.UDimension, B=dim.VDimension)
division_2 = Division(A=dim.VDimension, B=scale_2)
multiplication = Multiplication(A=division, B=division_2)
pt_3 = ConstructPoint(XCoordinate=".5", YCoordinate=".5", ZCoordinate=0)
larger = LargerThan(FirstNumber=dim.UDimension, SecondNumber=dim.VDimension)  # -> LargerThan, OrEqualTo
scale_nu = ScaleNU(Plane=PlaneXY(0, 0, 0), ScaleX=multiplication, ScaleY=division_2, ScaleZ=1)  # -> Geometry, Transform
evalsrf_2 = EvaluateSurface(Surface=geo_4, Point=pt_3)  # -> Point, Normal, UDirection, VDirection, Frame
multiplication_2 = Multiplication(A=larger.LargerThan, B=90)
rotate = Rotate(Angle=degrees(multiplication_2), Plane=evalsrf_2.Normal)  # -> Geometry, Transform
transformuv = TransformTextureUV(Mesh=geo_4, Transform=scale_nu.Transform)
transformuv_2 = TransformTextureUV(Mesh=transformuv, Transform=rotate.Transform)

# ----
scale_3 = Number(direction)

# ---- group: Surface mapping
vec_2 = Vector(xprod.Vector)
geo_5 = Geometry(dispatch.ListB)
scale_4 = Number(scale)
division_3 = Division(A=scale_4, B=2)
pl = PlaneNormal(Origin=Point(0, 0, 0), ZAxis=vec_2)
neg = Negative(Value=division_3)
dom = ConstructDomain(DomainStart=division_3, DomainEnd=neg)
planarmap = PlanarMapping(Mesh=geo_5, Plane=pl, XExtents=dom, YExtents=dom)  # -> MappedMesh, MappingPlane
rotate_2 = Rotate(Angle=degrees(scale_3), Plane=vec_2)  # -> Geometry, Transform
transformuv_3 = TransformTextureUV(Mesh=planarmap.MappedMesh, Transform=rotate_2.Transform)

# ----
mjoin = MeshJoin(Meshes=[transformuv_2, transformuv_3])
mesh = ClusterOutput(mjoin)

# ==== cluster AttachAttributes
geo = ClusterInput()
direction = ClusterInput()
issertar = ClusterInput()
isdoor = ClusterInput()
name = ClusterInput()
material = ClusterInput()
attributes_list = Panel("""direction
isSertar
isDoor
name
material""")
txt = Text(name)
txt_2 = Text(material)
direction_2 = Boolean(direction)
direction_3 = Boolean(issertar)
direction_4 = Boolean(isdoor)
merge = Merge(Data1=direction_2, Data2=direction_3, Data3=direction_4, Data4=txt, Data5=txt_2)
constructattr = ConstructAttributes(Keys=attributes_list, Values=merge)
injectattr = InjectAttributes(Object=geo, Attributes=constructattr)
brep = ClusterOutput(injectattr)

# ==== cluster TransformWithAttributes
transform = ClusterInput()
geo = ClusterInput()
extractattr = ExtractAttributes(Object=geo)
move = Move(Geometry=geo, Motion=transform)  # -> Geometry, Transform
injectattr = InjectAttributes(Object=move.Geometry, Attributes=extractattr)
geo_2 = ClusterOutput(injectattr)

# ==== cluster FilterByMaterial
material = ClusterInput()
geo = ClusterInput()
geo_2 = Geometry(geo)
accesskey = AccessKey(Object=geo_2, Key="material")
lng = ListLength(List=geo_2)
material_2 = Text(material)
repeat = RepeatData(Data=False, Length=lng)
mindex = MemberIndex(Set=accesskey, Member=material_2)  # -> Index, Count
replace = ReplaceItems(List=repeat, Item=True, Indices=mindex.Index, Wrap=False)
dispatch = Dispatch(List=geo_2, DispatchPattern=replace)  # -> ListA, ListB
geo_3 = Geometry(dispatch.ListA)
geo_4 = Geometry(dispatch.ListB)
target = ClusterOutput(geo_3)
rest = ClusterOutput(geo_4)

# ==== cluster FilterByName
name = ClusterInput()
geo = ClusterInput()
geo_2 = Geometry(geo)
accesskey = AccessKey(Object=geo_2, Key="name")
lng = ListLength(List=geo_2)
txt = Text(name)
repeat = RepeatData(Data=False, Length=lng)
mindex = MemberIndex(Set=accesskey, Member=txt)  # -> Index, Count
replace = ReplaceItems(List=repeat, Item=True, Indices=mindex.Index, Wrap=False)
dispatch = Dispatch(List=geo_2, DispatchPattern=replace)  # -> ListA, ListB
geo_3 = Geometry(dispatch.ListA)
geo_4 = Geometry(dispatch.ListB)
target = ClusterOutput(geo_3)
rest = ClusterOutput(geo_4)

# ==== cluster TextureMapping_2
geo = ClusterInput()
scale = ClusterInput()
filter_by_name = FilterByName(geo=geo, name="maner")  # -> target, rest

# ---- group: Orientation detection
geo_2 = Geometry(graft(filter_by_name.rest))
debox = DeconstructBox(Box=geo_2)  # -> Plane, X, Y, Z

# ----
vec = Vector(debox.Plane)

# ---- group: Edge detection
vec_2 = Vector(vec)
geo_3 = Geometry(filter_by_name.rest)
debrep = DeconstructBrep(Brep=geo_3)  # -> Faces, Edges, Vertices
pt = ConstructPoint(XCoordinate="0.5", YCoordinate="0.5", ZCoordinate=0)
evalsrf = EvaluateSurface(Surface=debrep.Faces, Point=pt)  # -> Point, Normal, UDirection, VDirection, Frame
dprod = DotProduct(VectorA=vec_2, VectorB=evalsrf.Normal, Unitize=False)
abs = Absolute(Value=dprod)
round = Round(Number=abs)  # -> Nearest, Floor, Ceiling
equals = Equality(FirstNumber=round.Floor, SecondNumber="0")  # -> Equality, Inequality
dispatch = Dispatch(List=debrep.Faces, DispatchPattern=equals.Equality)  # -> ListA, ListB

# ---- group: Orientation detection / Vector debug
pt_2 = Point(Point(0, 0, 0))
amp = Amplitude(Vector=vec, Amplitude="300")
vdis = VectorDisplay(Anchor=pt_2, Vector=amp)

# ----
expression = Expression(x=vec, Expression="if(x={0,1,0},true,false)|if(x={0,-1,0},true,false)")

# ---- group: Edge mapping
scale_2 = Number(scale)
geo_4 = Geometry(dispatch.ListA)
dim = Dimensions(Surface=geo_4)  # -> UDimension, VDimension
division = Division(A=dim.UDimension, B=dim.VDimension)
division_2 = Division(A=dim.VDimension, B=scale_2)
multiplication = Multiplication(A=division, B=division_2)
pt_3 = ConstructPoint(XCoordinate=".5", YCoordinate=".5", ZCoordinate=0)
larger = LargerThan(FirstNumber=dim.UDimension, SecondNumber=dim.VDimension)  # -> LargerThan, OrEqualTo
scale_nu = ScaleNU(Plane=PlaneXY(0, 0, 0), ScaleX=multiplication, ScaleY=division_2, ScaleZ=1)  # -> Geometry, Transform
evalsrf_2 = EvaluateSurface(Surface=geo_4, Point=pt_3)  # -> Point, Normal, UDirection, VDirection, Frame
multiplication_2 = Multiplication(A=larger.LargerThan, B=90)
rotate = Rotate(Angle=degrees(multiplication_2), Plane=evalsrf_2.Normal)  # -> Geometry, Transform
transformuv = TransformTextureUV(Mesh=geo_4, Transform=scale_nu.Transform)
transformuv_2 = TransformTextureUV(Mesh=transformuv, Transform=rotate.Transform)

# ----
geo_5 = Geometry(graft(filter_by_name.rest))
accesskey = AccessKey(Object=geo_5, Key="direction")
bool = Boolean(accesskey)
or = GateOr(A=bool, B=expression)
and = GateAnd(A=bool, B=expression)
xor = GateXor(A=bool, B=expression)
expression_2 = Expression(x=xor, Expression="if(x=true,90,0)")

# ---- group: Surface mapping
vec_3 = Vector(vec)
geo_6 = Geometry(dispatch.ListB)
scale_3 = Number(scale)
division_3 = Division(A=scale_3, B=2)
pl = PlaneNormal(Origin=Point(0, 0, 0), ZAxis=vec_3)
neg = Negative(Value=division_3)
dom = ConstructDomain(DomainStart=division_3, DomainEnd=neg)
planarmap = PlanarMapping(Mesh=geo_6, Plane=pl, XExtents=dom, YExtents=dom)  # -> MappedMesh, MappingPlane
rotate_2 = Rotate(Angle=degrees(expression_2), Plane=vec_3)  # -> Geometry, Transform
transformuv_3 = TransformTextureUV(Mesh=planarmap.MappedMesh, Transform=rotate_2.Transform)

# ----
mjoin = MeshJoin(Meshes=[transformuv_2, transformuv_3])  # -> flatten(Mesh)
geo_7 = Geometry(flatten(filter_by_name.rest))
extractattr = ExtractAttributes(Object=geo_7)
injectattr = InjectAttributes(Object=mjoin, Attributes=extractattr)

manere = Geometry(filter_by_name.target)
pal_mapped = ClusterOutput(injectattr)
rest_geo = ClusterOutput(manere)

# ==== cluster SertarPAL
coordonata_y = ClusterInput()  # Coordonata pe Y a partii din fata al sertarului
coordonata_z = ClusterInput()  # Coordonata pe Z al punctului din fata de jos
adancime_sertar = ClusterInput()  # Adancimea maximala posibila pentru sertar
h_sertar = ClusterInput()
gaurire = ClusterInput()
facade = ClusterInput()
punct_1_x = ClusterInput()  # Punctul din stanga, fata, jos, al sertarului. Se indica coordonata x al punctului.
punctul_2 = ClusterInput()  # Punctul din dreapta, fata, jos, al sertarului. Se indica coordonata x al punctului.
suruburi = ClusterInput()
gaurire_2 = Boolean(gaurire)
suruburi_2 = Boolean(suruburi)
facade_2 = Geometry(facade)
x1_number = Number(punct_1_x)
x2_number = Number(punctul_2)
y_number = Number(coordonata_y)
z_number = Number(coordonata_z)
adancime_sertar_2 = Integer(adancime_sertar)
h_sertar_2 = Integer(h_sertar)
expression = Expression(x=adancime_sertar_2, Expression="floor(x/50)*50-10")
grosime_pal = Panel("18")
expression_2 = Expression(X=x1_number, Expression="X+18")
expression_3 = Expression(Z=z_number, Expression="Z+30")
addition = Addition(A=x1_number, B=18)
addition_2 = Addition(A=z_number, B=12)
addition_3 = Addition(A=expression, B=y_number)
expression_4 = Expression(x=adancime_sertar_2, Expression="floor(x/50)*50-10")
expression_5 = Expression(x=adancime_sertar_2, Expression="floor(x/50)*50-10")
expression_6 = Expression(x=adancime_sertar_2, Expression="floor(x/50)*50-10")
expression_7 = Expression(P1=x1_number, P2=x2_number, Expression="P2-P1-36")
expression_8 = Expression(P1=x1_number, P2=x2_number, Expression="P2-P1-36")
expression_9 = Expression(Hs=h_sertar_2, Expression="Hs-30")
pt = ConstructPoint(XCoordinate=x1_number, YCoordinate=y_number, ZCoordinate=z_number)
pt_2 = ConstructPoint(XCoordinate=x2_number, YCoordinate=y_number, ZCoordinate=z_number)
pt_3 = ConstructPoint(XCoordinate=addition, YCoordinate=y_number, ZCoordinate=addition_2)
pt_4 = ConstructPoint(XCoordinate=expression_2, YCoordinate=addition_3, ZCoordinate=expression_3)
yz = YZPlane(Origin=pt)
yz_2 = YZPlane(Origin=pt_2)
xy = XYPlane(Origin=pt_3)
xz = XZPlane(Origin=pt_4)
neg = Negative(Value=grosime_pal)
box = DomainBox(Base=yz, X=expression_4, Y=h_sertar_2, Z=grosime_pal)
box_2 = DomainBox(Base=yz_2, X=expression_5, Y=h_sertar_2, Z=neg)
box_3 = DomainBox(Base=xy, X=expression_7, Y=expression_6, Z=Domain(0, 18))
box_4 = DomainBox(Base=xz, X=expression_8, Y=expression_9, Z=grosime_pal)
toggle = BooleanToggle(True)
toggle_2 = BooleanToggle(False)
attach_attributes = AttachAttributes(geo=box, direction=Toggle(False), issertar=toggle, isdoor=toggle_2, name="sertar", material="interior")
attach_attributes_2 = AttachAttributes(geo=box_2, direction=Toggle(False), issertar=toggle, isdoor=toggle_2, name="sertar", material="interior")
attach_attributes_3 = AttachAttributes(geo=box_3, direction=Toggle(False), issertar=toggle, isdoor=toggle_2, name="sertar", material="interior")
attach_attributes_4 = AttachAttributes(geo=box_4, direction=Toggle(False), issertar=toggle, isdoor=toggle_2, name="sertar", material="interior")

# ---- group: Laterala stanga / Activatie pe fiecare latura
activat = BooleanToggle(False)
activat_2 = BooleanToggle(False)
activat_3 = BooleanToggle(False)
activat_4 = BooleanToggle(True)

# ---- group: Laterala stanga / Tip surubul
list = ValueList({"Rastex 15mm": 0, "Confirmat_L50": 1}, selected="Confirmat_L50")
list_2 = ValueList({"Rastex 15mm": 0, "Confirmat_L50": 1}, selected="Rastex 15mm")
list_3 = ValueList({"Rastex 15mm": 0, "Confirmat_L50": 1}, selected="Rastex 15mm")
list_4 = ValueList({"Rastex 15mm": 0, "Confirmat_L50": 1}, selected="Rastex 15mm")

# ---- group: Laterala stanga / Offset pe fiecare latura
offset_stanga = Slider(50, range=0..100)
offset_dreapta = Slider(70, range=0..100)
offset_stanga_2 = Slider(50, range=0..100)
offset_dreapta_2 = Slider(50, range=0..100)
offset_stanga_3 = Slider(70, range=0..100)
offset_dreapta_3 = Slider(50, range=0..100)
offset_stanga_4 = Slider(50, range=0..100)
offset_dreapta_4 = Slider(80, range=0..100)

# ---- group: Laterala stanga / Flip fata/spate
flip = BooleanToggle(True)
flip_2 = BooleanToggle(True)
flip_3 = BooleanToggle(True)
flip_4 = BooleanToggle(True)

# ---- group: Laterala stanga / Amplasare șcant
value_list = ValueList({"Scant dreapta": -1, "Scant stanga": 1, "Fara scant": 0}, selected="Fara scant")
list_5 = ValueList({"Scant dreapta": -1, "Scant stanga": 1, "Fara scant": 0}, selected="Fara scant")
list_6 = ValueList({"Scant dreapta": -1, "Scant stanga": 1, "Fara scant": 0}, selected="Fara scant")
list_7 = ValueList({"Scant dreapta": -1, "Scant stanga": 1, "Fara scant": 0}, selected="Fara scant")

# ---- group: Laterala stanga
# Latura A
# Latura B
# Latura C
# Latura D
suruburi_3 = Boolean(suruburi_2)
gaurire_3 = Boolean(gaurire_2)
piesa_toreț = Geometry(attach_attributes)
piese_plasti = Geometry(facade_2)
screws_on_box = ScrewsOnBox_2(
    suruburi=suruburi_3,
    gaurire=gaurire_3,
    piesa_toreț=piesa_toreț,
    piese_plasti=piese_plasti,
    side_a=activat,
    side_b=activat_2,
    side_c=activat_3,
    side_d=activat_4,
    fixture_a=list,
    fixture_b=list_2,
    fixture_c=list_3,
    fixture_d=list_4,
    trim_aa=offset_stanga,
    trim_ab=offset_dreapta,
    trim_ba=offset_stanga_2,
    trim_bb=offset_dreapta_2,
    trim_ca=offset_stanga_3,
    trim_cb=offset_dreapta_3,
    trim_da=offset_stanga_4,
    trim_db=offset_dreapta_4,
    flip_a=flip,
    flip_b=flip_2,
    flip_c=flip_3,
    flip_d=flip_4,
    scant_optiune_a=value_list,
    scant_optiune_b=list_5,
    scant_optiune_c=list_6,
    scant_optiune_d=list_7)  # -> piese_plasti_2, piesa_toreț_2, suruburi_7
geo = Geometry(screws_on_box.piese_plasti_2)
geo_2 = Geometry(screws_on_box.piesa_toreț_2)

# ---- group: Laterala dreapta / Activatie pe fiecare latura
activat_5 = BooleanToggle(False)
activat_6 = BooleanToggle(False)
activat_7 = BooleanToggle(False)
activat_8 = BooleanToggle(True)

# ---- group: Laterala dreapta / Tip surubul
list_8 = ValueList({"Rastex 15mm": 0, "Confirmat_L50": 1}, selected="Confirmat_L50")
list_9 = ValueList({"Rastex 15mm": 0, "Confirmat_L50": 1}, selected="Rastex 15mm")
list_10 = ValueList({"Rastex 15mm": 0, "Confirmat_L50": 1}, selected="Rastex 15mm")
list_11 = ValueList({"Rastex 15mm": 0, "Confirmat_L50": 1}, selected="Rastex 15mm")

# ---- group: Laterala dreapta / Offset pe fiecare latura
offset_stanga_5 = Slider(50, range=0..100)
offset_dreapta_5 = Slider(70, range=0..100)
offset_stanga_6 = Slider(50, range=0..100)
offset_dreapta_6 = Slider(50, range=0..100)
offset_stanga_7 = Slider(70, range=0..100)
offset_dreapta_7 = Slider(50, range=0..100)
offset_stanga_8 = Slider(50, range=0..100)
offset_dreapta_8 = Slider(80, range=0..100)

# ---- group: Laterala dreapta / Flip fata/spate
flip_5 = BooleanToggle(True)
flip_6 = BooleanToggle(True)
flip_7 = BooleanToggle(True)
flip_8 = BooleanToggle(False)

# ---- group: Laterala dreapta / Amplasare șcant
value_list_2 = ValueList({"Scant dreapta": -1, "Scant stanga": 1, "Fara scant": 0}, selected="Scant stanga")
list_12 = ValueList({"Scant dreapta": -1, "Scant stanga": 1, "Fara scant": 0}, selected="Scant dreapta")
list_13 = ValueList({"Scant dreapta": -1, "Scant stanga": 1, "Fara scant": 0}, selected="Scant dreapta")
list_14 = ValueList({"Scant dreapta": -1, "Scant stanga": 1, "Fara scant": 0}, selected="Fara scant")

# ---- group: Laterala dreapta
# Latura A
# Latura B
# Latura C
# Latura D
suruburi_4 = Boolean(suruburi_2)
gaurire_4 = Boolean(gaurire_2)
piesa_toreț_2 = Geometry(attach_attributes_2)
piese_plasti_2 = Geometry(geo)
screws_on_box_2 = ScrewsOnBox_2(
    suruburi=suruburi_4,
    gaurire=gaurire_4,
    piesa_toreț=piesa_toreț_2,
    piese_plasti=piese_plasti_2,
    side_a=activat_5,
    side_b=activat_6,
    side_c=activat_7,
    side_d=activat_8,
    fixture_a=list_8,
    fixture_b=list_9,
    fixture_c=list_10,
    fixture_d=list_11,
    trim_aa=offset_stanga_5,
    trim_ab=offset_dreapta_5,
    trim_ba=offset_stanga_6,
    trim_bb=offset_dreapta_6,
    trim_ca=offset_stanga_7,
    trim_cb=offset_dreapta_7,
    trim_da=offset_stanga_8,
    trim_db=offset_dreapta_8,
    flip_a=flip_5,
    flip_b=flip_6,
    flip_c=flip_7,
    flip_d=flip_8,
    scant_optiune_a=value_list_2,
    scant_optiune_b=list_12,
    scant_optiune_c=list_13,
    scant_optiune_d=list_14)  # -> piese_plasti_2, piesa_toreț_2, suruburi_7
geo_3 = Geometry(screws_on_box_2.piese_plasti_2)
geo_4 = Geometry(screws_on_box_2.piesa_toreț_2)

# ---- group: Fundul / Activatie pe fiecare latura
activat_9 = BooleanToggle(True)
activat_10 = BooleanToggle(True)
activat_11 = BooleanToggle(False)
activat_12 = BooleanToggle(True)

# ---- group: Fundul / Tip surubul
list_15 = ValueList({"Rastex 15mm": 0, "Confirmat_L50": 1}, selected="Rastex 15mm")
list_16 = ValueList({"Rastex 15mm": 0, "Confirmat_L50": 1}, selected="Rastex 15mm")
list_17 = ValueList({"Rastex 15mm": 0, "Confirmat_L50": 1}, selected="Rastex 15mm")
list_18 = ValueList({"Rastex 15mm": 0, "Confirmat_L50": 1}, selected="Rastex 15mm")

# ---- group: Fundul / Offset pe fiecare latura
offset_stanga_9 = Slider(100, range=0..100)
offset_dreapta_9 = Slider(100, range=0..100)
offset_stanga_10 = Slider(80, range=0..100)
offset_dreapta_10 = Slider(80, range=0..100)
offset_stanga_11 = Slider(70, range=0..100)
offset_dreapta_11 = Slider(50, range=0..100)
offset_stanga_12 = Slider(80, range=0..100)
offset_dreapta_12 = Slider(80, range=0..100)

# ---- group: Fundul / Flip fata/spate
flip_9 = BooleanToggle(False)
flip_10 = BooleanToggle(False)
flip_11 = BooleanToggle(True)
flip_12 = BooleanToggle(False)

# ---- group: Fundul / Amplasare șcant
value_list_3 = ValueList({"Scant dreapta": -1, "Scant stanga": 1, "Fara scant": 0}, selected="Scant stanga")
list_19 = ValueList({"Scant dreapta": -1, "Scant stanga": 1, "Fara scant": 0}, selected="Scant dreapta")
list_20 = ValueList({"Scant dreapta": -1, "Scant stanga": 1, "Fara scant": 0}, selected="Scant dreapta")
list_21 = ValueList({"Scant dreapta": -1, "Scant stanga": 1, "Fara scant": 0}, selected="Scant stanga")

# ---- group: Fundul
# Latura A
# Latura B
# Latura C
# Latura D
piesa_toreț_3 = Geometry(attach_attributes_3)
piese_plasti_3 = Geometry([geo_4, geo_2, geo_3])
suruburi_5 = Boolean(suruburi_2)
gaurire_5 = Boolean(gaurire_2)
screws_on_box_3 = ScrewsOnBox(
    suruburi=suruburi_5,
    gaurire=gaurire_5,
    piesa_toreț=piesa_toreț_3,
    piese_plasti=piese_plasti_3,
    side_a=activat_9,
    side_b=activat_10,
    side_c=activat_11,
    side_d=activat_12,
    fixture_a=list_15,
    fixture_b=list_16,
    fixture_c=list_17,
    fixture_d=list_18,
    trim_aa=offset_stanga_9,
    trim_ab=offset_dreapta_9,
    trim_ba=offset_stanga_10,
    trim_bb=offset_dreapta_10,
    trim_ca=offset_stanga_11,
    trim_cb=offset_dreapta_11,
    trim_da=offset_stanga_12,
    trim_db=offset_dreapta_12,
    flip_a=flip_9,
    flip_b=flip_10,
    flip_c=flip_11,
    flip_d=flip_12,
    scant_optiune_a=value_list_3,
    scant_optiune_b=list_19,
    scant_optiune_c=list_20,
    scant_optiune_d=list_21)  # -> piese_plasti_2, piesa_toreț_2, suruburi_7
geo_5 = Geometry(screws_on_box_3.piese_plasti_2)
geo_6 = Geometry(screws_on_box_3.piesa_toreț_2)

# ---- group: Spatele / Activatie pe fiecare latura
activat_13 = BooleanToggle(True)
activat_14 = BooleanToggle(True)
activat_15 = BooleanToggle(False)
activat_16 = BooleanToggle(True)

# ---- group: Spatele / Tip surubul
list_22 = ValueList({"Rastex 15mm": 0, "Confirmat_L50": 1}, selected="Confirmat_L50")
list_23 = ValueList({"Rastex 15mm": 0, "Confirmat_L50": 1}, selected="Rastex 15mm")
list_24 = ValueList({"Rastex 15mm": 0, "Confirmat_L50": 1}, selected="Rastex 15mm")
list_25 = ValueList({"Rastex 15mm": 0, "Confirmat_L50": 1}, selected="Rastex 15mm")

# ---- group: Spatele / Offset pe fiecare latura
offset_stanga_13 = Slider(70, range=0..100)
offset_dreapta_13 = Slider(70, range=0..100)
offset_stanga_14 = Slider(50, range=0..100)
offset_dreapta_14 = Slider(50, range=0..100)
offset_stanga_15 = Slider(70, range=0..100)
offset_dreapta_15 = Slider(50, range=0..100)
offset_stanga_16 = Slider(50, range=0..100)
offset_dreapta_16 = Slider(50, range=0..100)

# ---- group: Spatele / Flip fata/spate
flip_13 = BooleanToggle(True)
flip_14 = BooleanToggle(False)
flip_15 = BooleanToggle(True)
flip_16 = BooleanToggle(False)

# ---- group: Spatele / Amplasare șcant
value_list_4 = ValueList({"Scant dreapta": -1, "Scant stanga": 1, "Fara scant": 0}, selected="Scant stanga")
list_26 = ValueList({"Scant dreapta": -1, "Scant stanga": 1, "Fara scant": 0}, selected="Fara scant")
list_27 = ValueList({"Scant dreapta": -1, "Scant stanga": 1, "Fara scant": 0}, selected="Scant dreapta")
list_28 = ValueList({"Scant dreapta": -1, "Scant stanga": 1, "Fara scant": 0}, selected="Fara scant")

# ---- group: Spatele
# Latura A
# Latura B
# Latura C
# Latura D
suruburi_6 = Boolean(suruburi_2)
gaurire_6 = Boolean(gaurire_2)
piesa_toreț_4 = Geometry(attach_attributes_4)
piese_plasti_4 = Geometry([geo_5, geo_6])
screws_on_box_4 = ScrewsOnBox(
    suruburi=suruburi_6,
    gaurire=gaurire_6,
    piesa_toreț=piesa_toreț_4,
    piese_plasti=piese_plasti_4,
    side_a=activat_13,
    side_b=activat_14,
    side_c=activat_15,
    side_d=activat_16,
    fixture_a=list_22,
    fixture_b=list_23,
    fixture_c=list_24,
    fixture_d=list_25,
    trim_aa=offset_stanga_13,
    trim_ab=offset_dreapta_13,
    trim_ba=offset_stanga_14,
    trim_bb=offset_dreapta_14,
    trim_ca=offset_stanga_15,
    trim_cb=offset_dreapta_15,
    trim_da=offset_stanga_16,
    trim_db=offset_dreapta_16,
    flip_a=flip_13,
    flip_b=flip_14,
    flip_c=flip_15,
    flip_d=flip_16,
    scant_optiune_a=value_list_4,
    scant_optiune_b=list_26,
    scant_optiune_c=list_27,
    scant_optiune_d=list_28)  # -> piese_plasti_2, piesa_toreț_2, suruburi_7
geo_7 = Geometry(screws_on_box_4.piese_plasti_2)
geo_8 = Geometry(screws_on_box_4.piesa_toreț_2)

# ----
suruburi_7 = Geometry(flatten([screws_on_box_4.suruburi_7, screws_on_box_3.suruburi_7, screws_on_box_2.suruburi_7, screws_on_box.suruburi_7]))

attach_attributes_5 = AttachAttributes(geo=suruburi_7, direction=Toggle(False), issertar=Toggle(False), isdoor=Toggle(False), name="surub", material="surub")

filter_by_name = FilterByName(geo=[geo_7, geo_8], name="fatada")  # -> target, rest
facade_3 = Geometry(filter_by_name.target)
sertar = Geometry(filter_by_name.rest)
sertar_2 = ClusterOutput(sertar)
facade_4 = ClusterOutput(facade_3)
suruburi_8 = ClusterOutput(attach_attributes_5)

# ==== cluster ColorArray
L = ClusterInput()
cset = CreateSet(List=flatten(L))  # -> Set, Map
lng = ListLength(List=cset.Map)
lastdex = LastIndex(List=cset.Map)
expression = Expression(y=lng, Expression="1-(1/y)")
item = ListItem(List=cset.Map, Index=lastdex, Wrap=True)
remap = RemapNumbers(Value=cset.Map, Source=item, Target=expression)  # -> Mapped, Clipped
roundd = RoundToDecimalPlace(NumberX=remap.Mapped, DecimalPlace=2, RoundType=0)  # -> Rounded, Difference
hsl = ColourHSL(Alpha=1, Hue=roundd.Rounded, Saturation=0.5, Luminance=0.8)  # -> graft(Colour)
C = ClusterOutput(hsl)

# ==== cluster FilterByMaterial_2
name = ClusterInput()
geo = ClusterInput()
geo_2 = Geometry(geo)
accesskey = AccessKey(Object=geo_2, Key="material")
lng = ListLength(List=geo_2)
txt = Text(name)
repeat = RepeatData(Data=False, Length=lng)
mindex = MemberIndex(Set=accesskey, Member=txt)  # -> Index, Count
replace = ReplaceItems(List=repeat, Item=True, Indices=mindex.Index, Wrap=False)
dispatch = Dispatch(List=geo_2, DispatchPattern=replace)  # -> ListA, ListB
geo_3 = Geometry(dispatch.ListA)
geo_4 = Geometry(dispatch.ListB)
target = ClusterOutput(geo_3)
rest = ClusterOutput(geo_4)

# ==== cluster Sectie1
material_name = ClusterInput()
geo = ClusterInput()
geo_2 = Geometry(geo)

# ---- group: Debug
lng = ListLength()
series = Series(Start=0, Step=1, Count=lng)
concat = Concatenate(FragmentA="Length_", FragmentB=series)  # -> graft(Result)
concat_2 = Concatenate(FragmentA="width_", FragmentB=series)  # -> graft(Result)
merge = Merge(Data1=concat_2, Data2=concat)

# ----
debox = DeconstructBox(Box=geo_2)  # -> Plane, X, Y, Z
num = Number(graft(debox.X))
num_2 = Number(graft(debox.Y))
merge_2 = Merge(Data1=num, Data2=num_2)

num_3 = Number(debox.Z)
expression = Expression(x=num_3, Expression="if(x=36,2,1)")
preview = CustomPreview(
    Geometry=geo_2,
    Material={diffuse=RGB(221, 160, 221), emission=RGB(66, 48, 66), shine=0.5, specular=RGB(255, 255, 255), transparency=0})
accesskey = AccessKey(Object=geo_2, Key="name")
accesskey_2 = AccessKey(Object=geo_2, Key="direction")
tstat = TreeStatistics(Tree=merge_2)  # -> Paths, Length, Count

# ---- group: Reorder
dispatch = Dispatch(List=expression, DispatchPattern=accesskey_2)  # -> ListA, ListB
merge_3 = Merge(Data1=dispatch.ListA, Data2=dispatch.ListB)

dispatch_2 = Dispatch(List=accesskey, DispatchPattern=accesskey_2)  # -> ListA, ListB
merge_4 = Merge(Data1=dispatch_2.ListA, Data2=dispatch_2.ListB)

# ----
dispatch_3 = Dispatch(List=tstat.Paths, DispatchPattern=accesskey_2)  # -> ListA, ListB
branch = TreeBranch(Tree=merge_2, Path=dispatch_3.ListA, MaintainPaths=True)
branch_2 = TreeBranch(Tree=merge_2, Path=dispatch_3.ListB, MaintainPaths=True)
rev = ReverseList(List=branch_2)
flip = FlipMatrix(Data=branch)
flip_2 = FlipMatrix(Data=rev)
merge_5 = Merge(Data1=flip, Data2=flip_2)
bang = ExplodeTree(Data=merge_5)  # -> Branch0, Branch1
panel = Panel(merge_3)
concat_3 = Concatenate(FragmentE=bang.Branch0, FragmentG=";", FragmentF=bang.Branch1)

concat_4 = Concatenate(
    FragmentE=material_name,
    FragmentG=";",
    FragmentF=merge_4,
    FragmentC=";",
    FragmentA=concat_3,
    FragmentB=";",
    FragmentD=panel)

table = ClusterOutput(concat_4)

# ==== cluster SertarFilter: Sertar filter
geo = ClusterInput()
geo_2 = Geometry(geo)
accesskey = AccessKey(Object=geo_2, Key="isSertar")
dispatch = Dispatch(List=geo_2, DispatchPattern=accesskey)  # -> ListA, ListB
geo_3 = Geometry(dispatch.ListA)
geo_4 = Geometry(dispatch.ListB)
target = ClusterOutput(geo_3)
rest = ClusterOutput(geo_4)

# ==== cluster Handle
fatada_box = ClusterInput()
gaurire = ClusterInput()
suruburi = ClusterInput()
offset = ClusterInput()
orientation = ClusterInput()
handle_geo = ClusterInput()
suruburi_2 = Boolean(suruburi)
gaurire_2 = Boolean(gaurire)
debox = DeconstructBox(Box=fatada_box)  # -> Plane, X, Y, Z

# ---- group: Maner type check
geo = Geometry(handle_geo)
accesskey = AccessKey(Object=flatten(geo), Key="aplicat")
accesskey_2 = AccessKey(Object=flatten(geo), Key="P2O")
item = ListItem(List=accesskey, Index=0, Wrap=True)
item_2 = ListItem(List=accesskey_2, Index=0, Wrap=True)
null = NullPlaceholder()
filter = StreamFilter(Gate=item_2, Stream0=geo, Stream1=null)

# ----
planesrf = PlaneSurface(Plane=debox.Plane, XSize=debox.X, YSize=debox.Y)

# ---- group: Clamp offset
explode = Explode(Curve=planesrf, Recursive=True)  # -> Segments, Vertices
len = Length(Curve=explode.Segments)
sort = SortList(Keys=len)  # -> Keys, ValuesA
item_3 = ListItem(List=sort.Keys, Index=0, Wrap=True)
division = Division(A=item_3, B=2)
clamp = Clamp(Value=offset, Domain=division)
subtraction = Subtraction(A=clamp, B=1)

# ----
neg = Negative(Value=subtraction)
filter_2 = StreamFilter(Gate=item, Stream0=neg, Stream1=0)
offset_2 = OffsetCurve(Curve=planesrf, Distance=filter_2, Corners=1)
debrep = DeconstructBrep(Brep=offset_2)  # -> Faces, Edges, Vertices
midpt = CurveMiddle(Curve=debrep.Edges)
x_plus_one = XPlusOne(NumberX=orientation)
item_4 = ListItem(List=midpt, Index=orientation, Wrap=True)
transform_with_attributes = TransformWithAttributes(geo=filter, transform=item_4)
multiplication = Multiplication(A=x_plus_one, B="90")
xz = XZPlane(Origin=item_4)

extractattr = ExtractAttributes(Object=transform_with_attributes)
rotate = Rotate(Geometry=transform_with_attributes, Angle=degrees(multiplication), Plane=xz)  # -> Geometry, Transform
injectattr = InjectAttributes(Object=rotate.Geometry, Attributes=extractattr)

point = ClusterOutput(item_4)
bang = ExplodeTree(Data=injectattr)  # -> _0000, _0001
gaurire_3 = Boolean(gaurire_2)
geo_2 = Geometry(bang._0000)
geo_3 = Geometry(bang._0001)

attach_attributes = AttachAttributes(geo=geo_2, direction=Toggle(True), issertar=Toggle(True), isdoor=Toggle(False), name="maner", material="maner")  # -> flatten(brep)

attach_attributes_2 = AttachAttributes(geo=geo_3, direction=Toggle(True), issertar=Toggle(True), isdoor=Toggle(False), name="surub", material="surub")

gate = StreamGate(Stream=attach_attributes_2, Gate=gaurire_3)  # -> Target0, Target1

# ---- group: maner gaurire
geo_4 = Geometry(fatada_box)
is_p2o = Boolean(item_2)
gate_2 = StreamGate(Stream=geo_4, Gate=is_p2o)  # -> Target0, Target1
gate_3 = StreamGate(Stream=gate_2.Target0, Gate=gaurire_3)  # -> Target0, Target1
sdiff = SolidDifference(BrepsA=flatten(gate_3.Target1), BrepsB=flatten(gate.Target1))
extractattr_2 = ExtractAttributes(Object=geo_4)
injectattr_2 = InjectAttributes(Object=sdiff, Attributes=extractattr_2)
filter_3 = StreamFilter(Gate=gaurire_2, Stream0=gate_3.Target0, Stream1=injectattr_2)
filter_4 = StreamFilter(Gate=is_p2o, Stream0=filter_3, Stream1=gate_2.Target1)  # -> flatten(Stream)

# ----
suruburi_3 = Boolean(suruburi_2)
null_2 = NullPlaceholder()
filter_5 = StreamFilter(Gate=suruburi_3, Stream0=null_2, Stream1=gate.Target0)
fatada = ClusterOutput(filter_4)
maner = ClusterOutput(attach_attributes)
suruburi_4 = ClusterOutput(filter_5)

# ==== cluster ScrewsOnBox_3

xz = XZPlane(Origin=Point(0, 0, 0))
xz_2 = XZPlane(Origin=Point(0, 0, 0))
flippln = FlipPlane(Plane=xz, FlipX=False, FlipY=False, FlipZ=True)  # -> Flipped, R
flippln_2 = FlipPlane(Plane=xz_2, FlipX=False, FlipY=False, FlipZ=True)  # -> Flipped, R
cyl = Cylinder(Base=xz, Radius=expr("x/2", Slider(7, range=0..10)), Length=Slider(18, range=0..100))
cyl_2 = Cylinder(Base=xz_2, Radius=expr("x/2", Slider(5, range=0..10)), Length=Slider(9, range=0..100))
merge = Merge(Data1=cyl_2, Data2=cyl)

piesa_toreț = ClusterInput()
piese_plasti = ClusterInput()
suruburi = ClusterInput()
gaurire = ClusterInput()
panel = Panel("Z:\Obiecte modelate\Suruburi\Scant\32x8.3dm")
cap = CapHoles(Brep=cyl_2)
rastex_15mm = Geometry(flatten(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))
panel_2 = Panel("Z:\Obiecte modelate\Suruburi\Confirmate\Conf_L-50_PAL-18.3dm")
gaurire_2 = Boolean(gaurire)
suruburi_2 = Boolean(suruburi)

plasti = Geometry(flatten(piese_plasti))
suruburi_3 = Boolean(suruburi_2)
gate = StreamGate(Stream=plasti, Gate=suruburi_3)  # -> Target0, Target1
plasti_2 = Geometry(gate.Target0)
plasti_cu_surub = Geometry(gate.Target1)

geo = Geometry(cap)

toret = Geometry(piesa_toreț)
suruburi_4 = Boolean(suruburi_2)
gate_2 = StreamGate(Stream=toret, Gate=suruburi_4)  # -> Target0, Target1
toret_2 = Geometry(gate_2.Target0)
toret_cu_surub = Geometry(gate_2.Target1)

debox = DeconstructBox(Box=toret_cu_surub)  # -> Plane, X, Y, Z
dedomain = DeconstructDomain(Domain=debox.Z)  # -> Start, End
expression = Expression(x=dedomain.Start, y=dedomain.End, Expression="x-(x-y)/2")
amp = Amplitude(Vector=debox.Plane, Amplitude=expression)
move = Move(Geometry=debox.Plane, Motion=amp)  # -> Geometry, Transform
rectangle = Rectangle(Plane=move.Geometry, XSize=debox.X, YSize=debox.Y, Radius=0)  # -> Rectangle, Length
explode = Explode(Curve=rectangle.Rectangle, Recursive=True)  # -> Segments, Vertices

merge_2 = Merge(Data1=rastex_15mm, Data2=geo)

# ---- group: Suruburi
confirmat_l50 = Geometry(flatten([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]))
rastex_15mm_2 = Geometry(flatten([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]))
scant = Geometry(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)

# ----
fixture_a = ClusterInput()
fixture_d = ClusterInput()
fixture_b = ClusterInput()
fixture_c = ClusterInput()
int = Integer(fixture_a)
int_2 = Integer(fixture_b)
int_3 = Integer(fixture_c)
int_4 = Integer(fixture_d)
filter = StreamFilter(Gate=int, Stream0=rastex_15mm_2, Stream1=confirmat_l50)
filter_2 = StreamFilter(Gate=int_2, Stream0=rastex_15mm_2, Stream1=confirmat_l50)
filter_3 = StreamFilter(Gate=int_3, Stream0=rastex_15mm_2, Stream1=confirmat_l50)
filter_4 = StreamFilter(Gate=int_4, Stream0=rastex_15mm_2, Stream1=confirmat_l50)
geo_2 = Geometry(filter)
geo_3 = Geometry(filter_2)
geo_4 = Geometry(filter_3)
geo_5 = Geometry(filter_4)
fixture_a_2 = ExplodeTree(Data=graft(geo_2))  # -> Branch0, Branch1
fixture_b_2 = ExplodeTree(Data=graft(geo_3))  # -> Branch0, Branch1
fixture_c_2 = ExplodeTree(Data=graft(geo_4))  # -> Branch0, Branch1
fixture_d_2 = ExplodeTree(Data=graft(geo_5))  # -> Branch0, Branch1
merge_3 = Merge(Data1=fixture_a_2.Branch0, Data2=fixture_b_2.Branch0, Data3=fixture_c_2.Branch0, Data4=fixture_d_2.Branch0)
merge_4 = Merge(Data1=fixture_a_2.Branch1, Data2=fixture_b_2.Branch1, Data3=fixture_c_2.Branch1, Data4=fixture_d_2.Branch1)

number_slider = Slider(32, range=1..50)

# ---- group: Vectors
deplane = DeconstructPlane(Plane=debox.Plane)  # -> Origin, XAxis, YAxis, ZAxis
neg = Negative(Value=deplane.XAxis)
neg_2 = Negative(Value=deplane.YAxis)
merge_5 = Merge(Data1=deplane.XAxis, Data2=deplane.YAxis, Data3=neg, Data4=neg_2)

# ----
trim_aa = ClusterInput()
trim_ab = ClusterInput()
trim_ba = ClusterInput()
trim_bb = ClusterInput()
trim_ca = ClusterInput()
trim_cb = ClusterInput()
trim_da = ClusterInput()
trim_db = ClusterInput()
scant_optiune_a = ClusterInput()
scant_optiune_b = ClusterInput()
scant_optiune_c = ClusterInput()
scant_optiune_d = ClusterInput()
side_a = ClusterInput()
side_c = ClusterInput()
side_d = ClusterInput()
flip_a = ClusterInput()
flip_c = ClusterInput()
flip_d = ClusterInput()
side_b = ClusterInput()
flip_b = ClusterInput()
side_a_2 = Boolean(side_a)
side_b_2 = Boolean(side_b)
side_c_2 = Boolean(side_c)
side_d_2 = Boolean(side_d)
flip_a_2 = Boolean(flip_a)
flip_b_2 = Boolean(flip_b)
flip_c_2 = Boolean(flip_c)
flip_d_2 = Boolean(flip_d)
trim_aa_2 = Number(trim_aa)
trim_ab_2 = Number(trim_ab)
trim_ba_2 = Number(trim_ba)
trim_bb_2 = Number(trim_bb)
trim_ca_2 = Number(trim_ca)
trim_cb_2 = Number(trim_cb)
trim_da_2 = Number(trim_da)
trim_db_2 = Number(trim_db)
dom = ConstructDomain(DomainStart=trim_aa_2, DomainEnd=trim_ab_2)
dom_2 = ConstructDomain(DomainStart=trim_ba_2, DomainEnd=trim_bb_2)
dom_3 = ConstructDomain(DomainStart=trim_ca_2, DomainEnd=trim_cb_2)
dom_4 = ConstructDomain(DomainStart=trim_da_2, DomainEnd=trim_db_2)
multiplication = Multiplication(A=number_slider, B=scant_optiune_a)
multiplication_2 = Multiplication(A=number_slider, B=scant_optiune_b)
multiplication_3 = Multiplication(A=number_slider, B=scant_optiune_c)
multiplication_4 = Multiplication(A=number_slider, B=scant_optiune_d)

# ---- group: Activate
merge_6 = Merge(Data1=side_a_2, Data2=side_b_2, Data3=side_c_2, Data4=side_d_2)

# ---- group: Flip
merge_7 = Merge(Data1=flip_a_2, Data2=flip_b_2, Data3=flip_c_2, Data4=flip_d_2)

# ----
merge_8 = Merge(Data1=multiplication, Data2=multiplication_2, Data3=multiplication_3, Data4=multiplication_4)
merge_9 = Merge(Data1=dom, Data2=dom_2, Data3=dom_3, Data4=dom_4)

# ---- group: Culling
cull = CullPattern(List=merge_5, CullPattern=merge_6)  # -> graft(List)
cull_2 = CullPattern(List=explode.Segments, CullPattern=merge_6)  # -> graft(List)
cull_3 = CullPattern(List=merge_4, CullPattern=merge_6)  # -> graft(List)
cull_4 = CullPattern(List=merge_3, CullPattern=merge_6)  # -> graft(List)
cull_5 = CullPattern(List=merge_9, CullPattern=merge_6)  # -> graft(List)
cull_6 = CullPattern(List=merge_7, CullPattern=merge_6)  # -> graft(List)
cull_7 = CullPattern(List=merge_8, CullPattern=merge_6)  # -> graft(List)

# ---- group: Orientation
pl = ConstructPlane(Origin=Point(0, 0, 0), XAxis=debox.Plane, YAxis=cull)
flippln_3 = FlipPlane(Plane=pl, FlipX=cull_6, FlipY=cull_6, FlipZ=True)  # -> Flipped, R
xz_3 = XZPlane(Origin=Point(0, 0, 0))
orient = Orient(Geometry=cull_4, Source=xz_3, Target=flippln_3.Flipped)  # -> Geometry, Transform

# ----
scant_2 = Orient(Geometry=scant, Source=xz_3, Target=flippln_3.Flipped)  # -> Geometry, Transform
orient_2 = Orient(Geometry=cull_3, Source=xz_3, Target=flippln_3.Flipped)  # -> Geometry, Transform
abs = Absolute(Value=cull_7)
box = Geometry(toret_cu_surub)
gaurire_3 = Boolean(gaurire_2)
gaurire_4 = Boolean(gaurire_2)
suruburi_5 = Boolean(suruburi_2)
plasti_3 = Geometry(plasti_2)
suruburi_6 = Boolean(suruburi_2)
box_2 = Geometry(toret_2)

# ---- group: Position
len = Length(Curve=cull_2)
dedomain_2 = DeconstructDomain(Domain=cull_5)  # -> Start, End

# ---- group: Clamping offset
half = Division(A=len, B=2)
dom_5 = ConstructDomain(DomainStart=0, DomainEnd=half)
clamp = Clamp(Value=dedomain_2.Start, Domain=dom_5)
subtraction = Subtraction(A=len, B=clamp, C=1)
dom_6 = ConstructDomain(DomainStart=0, DomainEnd=subtraction)
clamp_2 = Clamp(Value=dedomain_2.End, Domain=dom_6)

# ---- group: Position (continued)
subtraction_2 = Subtraction(A=clamp, B=1)
neg_3 = Negative(Value=subtraction_2)
neg_4 = Negative(Value=clamp_2)
ext = ExtendCurve(Curve=cull_2, Type=0, Start=neg_3, End=neg_4)

# ---- group: Length min treshold
len_2 = Length(Curve=ext)
expression_2 = Expression(x=len_2, y=Slider(180, range=0..1000), Expression="floor(x/y)")
clamp_3 = Clamp(Value=expression_2, Domain=Domain(1, 100))

# ----
len_3 = Length(Curve=ext)

# ---- group: Scant instancing
divide = DivideCurve(Curve=ext, Count=clamp_3, Kinks=False)  # -> Points, Tangents, Parameters
round = Round(Number=divide.Parameters)  # -> Nearest, Floor, Ceiling
eval = EvaluateCurve(Curve=ext, Parameter=round.Nearest)  # -> Point, Tangent, Angle

# ---- group: If less than (t) - 1 point
len_4 = Length(Curve=ext)
t_treshold_for_1_point = Slider(64, range=0..1000)
expression_3 = Expression(x=len_4, t=t_treshold_for_1_point, Expression="if(x<t,1,0)")
midpt = CurveMiddle(Curve=ext)
bang = ExplodeTree(Data=midpt)  # -> _0000000, _0000001, Branch2, Branch3
bang_2 = ExplodeTree(Data=expression_3)  # -> _0000000, _0000001, Branch2, Branch3
bang_3 = ExplodeTree(Data=eval.Point)  # -> _00000000, _00000010, Branch2, Branch3
filter_5 = StreamFilter(Gate=bang_2._0000000, Stream0=bang_3._00000000, Stream1=bang._0000000)
filter_6 = StreamFilter(Gate=bang_2._0000001, Stream0=bang_3._00000010, Stream1=bang._0000001)
filter_7 = StreamFilter(Gate=bang_2.Branch2, Stream0=bang_3.Branch2, Stream1=bang.Branch2)
filter_8 = StreamFilter(Gate=bang_2.Branch3, Stream0=bang_3.Branch3, Stream1=bang.Branch3)
entwine = Entwine(Branch00=filter_5, Branch01=filter_6, Branch02=filter_7, Branch03=filter_8, FlattenInputs=True)
clean = CleanTree(RemoveNulls=True, RemoveInvalid=True, RemoveEmpty=True, Tree=entwine)

# ----
amp_2 = Amplitude(Vector=eval.Tangent, Amplitude=cull_7)
move_2 = Move(Geometry=clean, Motion=amp_2)  # -> Geometry, Transform
cull_8 = CullPattern(List=move_2.Geometry, CullPattern=graft(abs))

# ---- group: Scant instancing (continued)
geo_6 = Geometry(cull_8)

# ----
move_3 = Move(Geometry=scant_2.Geometry, Motion=geo_6)  # -> Geometry, Transform
gate_3 = StreamGate(Stream=move_3.Geometry, Gate=gaurire_2)  # -> Target0, Target1

# ---- group: Position (continued)
divide_2 = DivideCurve(Curve=ext, Count=clamp_3, Kinks=False)  # -> Points, Tangents, Parameters
round_2 = Round(Number=divide_2.Parameters)  # -> Nearest, Floor, Ceiling
eval_2 = EvaluateCurve(Curve=ext, Parameter=round_2.Nearest)  # -> Point, Tangent, Angle

# ---- group: If less than (t) - 1 point
len_5 = Length(Curve=ext)
t_treshold_for_1_point_2 = Slider(64, range=0..1000)
expression_4 = Expression(x=len_5, t=t_treshold_for_1_point_2, Expression="if(x<t,1,0)")
midpt_2 = CurveMiddle(Curve=ext)
bang_4 = ExplodeTree(Data=midpt_2)  # -> _0000000, _0000001, Branch2, Branch3
bang_5 = ExplodeTree(Data=expression_4)  # -> _0000000, _0000001, Branch2, Branch3
bang_6 = ExplodeTree(Data=eval_2.Point)  # -> _00000000, _00000010, Branch2, Branch3
filter_9 = StreamFilter(Gate=bang_5._0000000, Stream0=bang_6._00000000, Stream1=bang_4._0000000)
filter_10 = StreamFilter(Gate=bang_5._0000001, Stream0=bang_6._00000010, Stream1=bang_4._0000001)
filter_11 = StreamFilter(Gate=bang_5.Branch2, Stream0=bang_6.Branch2, Stream1=bang_4.Branch2)
filter_12 = StreamFilter(Gate=bang_5.Branch3, Stream0=bang_6.Branch3, Stream1=bang_4.Branch3)
entwine_2 = Entwine(Branch00=filter_9, Branch01=filter_10, Branch02=filter_11, Branch03=filter_12, FlattenInputs=True)
clean_2 = CleanTree(RemoveNulls=True, RemoveInvalid=True, RemoveEmpty=True, Tree=entwine_2)

# ---- group: Position (continued)
geo_7 = Geometry(clean_2)

# ----
move_4 = Move(Geometry=orient_2.Geometry, Motion=geo_7)  # -> Geometry, Transform
move_5 = Move(Geometry=orient.Geometry, Motion=geo_7)  # -> Geometry, Transform
A = Geometry(flatten(move_4.Geometry))
B = Geometry(flatten(move_5.Geometry))
gate_4 = StreamGate(Stream=A, Gate=gaurire_2)  # -> Target0, Target1

plasti_4 = Geometry(plasti_cu_surub)
extractattr = ExtractAttributes(Object=plasti_4)
sdiff = SolidDifference(BrepsA=flatten(plasti_4), BrepsB=flatten([gate_4.Target1, gate_3.Target1]))
injectattr = InjectAttributes(Object=sdiff, Attributes=extractattr)

gate_5 = StreamGate(Stream=B, Gate=gaurire_2)  # -> Target0, Target1

toret_3 = Geometry(box)
extractattr_2 = ExtractAttributes(Object=toret_3)
sdiff_2 = SolidDifference(BrepsA=flatten(toret_3), BrepsB=flatten([gate_5.Target1, gate_3.Target1]))
injectattr_2 = InjectAttributes(Object=sdiff_2, Attributes=extractattr_2)

plasti_cu_surub_2 = Geometry(plasti_4)
brep = Geometry(injectattr)
toret_4 = Geometry(toret_3)
brep_2 = Geometry(injectattr_2)
filter_13 = StreamFilter(Gate=gaurire_3, Stream0=plasti_cu_surub_2, Stream1=brep)
filter_14 = StreamFilter(Gate=gaurire_4, Stream0=toret_4, Stream1=brep_2)
geo_8 = Geometry(flatten([gate_3.Target0, gate_5.Target0, gate_4.Target0]))
filter_15 = StreamFilter(Gate=suruburi_5, Stream0=plasti_3, Stream1=filter_13)
filter_16 = StreamFilter(Gate=suruburi_6, Stream0=box_2, Stream1=filter_14)
suruburi_7 = ClusterOutput(geo_8)
geo_9 = Geometry(flatten(filter_15))
geo_10 = Geometry(flatten(filter_16))
piesa_toreț_2 = ClusterOutput(geo_10)
piese_plasti_2 = ClusterOutput(geo_9)

# ==== cluster ScrewsOnBox_4

xz = XZPlane(Origin=Point(0, 0, 0))
xz_2 = XZPlane(Origin=Point(0, 0, 0))
flippln = FlipPlane(Plane=xz, FlipX=False, FlipY=False, FlipZ=True)  # -> Flipped, R
flippln_2 = FlipPlane(Plane=xz_2, FlipX=False, FlipY=False, FlipZ=True)  # -> Flipped, R
cyl = Cylinder(Base=xz, Radius=expr("x/2", Slider(7, range=0..10)), Length=Slider(18, range=0..100))
cyl_2 = Cylinder(Base=xz_2, Radius=expr("x/2", Slider(5, range=0..10)), Length=Slider(9, range=0..100))
merge = Merge(Data1=cyl_2, Data2=cyl)

piesa_toreț = ClusterInput()
piese_plasti = ClusterInput()
suruburi = ClusterInput()
gaurire = ClusterInput()
panel = Panel("Z:\Obiecte modelate\Suruburi\Scant\32x8.3dm")
cap = CapHoles(Brep=cyl_2)
rastex_15mm = Geometry(flatten(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))
panel_2 = Panel("Z:\Obiecte modelate\Suruburi\Confirmate\Conf_L-50_PAL-18.3dm")
gaurire_2 = Boolean(gaurire)
suruburi_2 = Boolean(suruburi)

plasti = Geometry(flatten(piese_plasti))
suruburi_3 = Boolean(suruburi_2)
gate = StreamGate(Stream=plasti, Gate=suruburi_3)  # -> Target0, Target1
plasti_2 = Geometry(gate.Target0)
plasti_cu_surub = Geometry(gate.Target1)

geo = Geometry(cap)

toret = Geometry(piesa_toreț)
suruburi_4 = Boolean(suruburi_2)
gate_2 = StreamGate(Stream=toret, Gate=suruburi_4)  # -> Target0, Target1
toret_2 = Geometry(gate_2.Target0)
toret_cu_surub = Geometry(gate_2.Target1)

debox = DeconstructBox(Box=toret_cu_surub)  # -> Plane, X, Y, Z
dedomain = DeconstructDomain(Domain=debox.Z)  # -> Start, End
expression = Expression(x=dedomain.Start, y=dedomain.End, Expression="x-(x-y)/2")
amp = Amplitude(Vector=debox.Plane, Amplitude=expression)
move = Move(Geometry=debox.Plane, Motion=amp)  # -> Geometry, Transform
rectangle = Rectangle(Plane=move.Geometry, XSize=debox.X, YSize=debox.Y, Radius=0)  # -> Rectangle, Length
explode = Explode(Curve=rectangle.Rectangle, Recursive=True)  # -> Segments, Vertices

merge_2 = Merge(Data1=rastex_15mm, Data2=geo)

# ---- group: Suruburi
confirmat_l50 = Geometry(flatten([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]))
rastex_15mm_2 = Geometry(flatten([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]))
scant = Geometry(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)

# ----
fixture_a = ClusterInput()
fixture_d = ClusterInput()
fixture_b = ClusterInput()
fixture_c = ClusterInput()
int = Integer(fixture_a)
int_2 = Integer(fixture_b)
int_3 = Integer(fixture_c)
int_4 = Integer(fixture_d)
filter = StreamFilter(Gate=int, Stream0=rastex_15mm_2, Stream1=confirmat_l50)
filter_2 = StreamFilter(Gate=int_2, Stream0=rastex_15mm_2, Stream1=confirmat_l50)
filter_3 = StreamFilter(Gate=int_3, Stream0=rastex_15mm_2, Stream1=confirmat_l50)
filter_4 = StreamFilter(Gate=int_4, Stream0=rastex_15mm_2, Stream1=confirmat_l50)
geo_2 = Geometry(filter)
geo_3 = Geometry(filter_2)
geo_4 = Geometry(filter_3)
geo_5 = Geometry(filter_4)
fixture_a_2 = ExplodeTree(Data=graft(geo_2))  # -> Branch0, Branch1
fixture_b_2 = ExplodeTree(Data=graft(geo_3))  # -> Branch0, Branch1
fixture_c_2 = ExplodeTree(Data=graft(geo_4))  # -> Branch0, Branch1
fixture_d_2 = ExplodeTree(Data=graft(geo_5))  # -> Branch0, Branch1
merge_3 = Merge(Data1=fixture_a_2.Branch0, Data2=fixture_b_2.Branch0, Data3=fixture_c_2.Branch0, Data4=fixture_d_2.Branch0)
merge_4 = Merge(Data1=fixture_a_2.Branch1, Data2=fixture_b_2.Branch1, Data3=fixture_c_2.Branch1, Data4=fixture_d_2.Branch1)

number_slider = Slider(32, range=1..50)

# ---- group: Vectors
deplane = DeconstructPlane(Plane=debox.Plane)  # -> Origin, XAxis, YAxis, ZAxis
neg = Negative(Value=deplane.XAxis)
neg_2 = Negative(Value=deplane.YAxis)
merge_5 = Merge(Data1=deplane.XAxis, Data2=deplane.YAxis, Data3=neg, Data4=neg_2)

# ----
trim_aa = ClusterInput()
trim_ab = ClusterInput()
trim_ba = ClusterInput()
trim_bb = ClusterInput()
trim_ca = ClusterInput()
trim_cb = ClusterInput()
trim_da = ClusterInput()
trim_db = ClusterInput()
scant_optiune_a = ClusterInput()
scant_optiune_b = ClusterInput()
scant_optiune_c = ClusterInput()
scant_optiune_d = ClusterInput()
side_a = ClusterInput()
side_c = ClusterInput()
side_d = ClusterInput()
flip_a = ClusterInput()
flip_c = ClusterInput()
flip_d = ClusterInput()
side_b = ClusterInput()
flip_b = ClusterInput()
side_a_2 = Boolean(side_a)
side_b_2 = Boolean(side_b)
side_c_2 = Boolean(side_c)
side_d_2 = Boolean(side_d)
flip_a_2 = Boolean(flip_a)
flip_b_2 = Boolean(flip_b)
flip_c_2 = Boolean(flip_c)
flip_d_2 = Boolean(flip_d)
trim_aa_2 = Number(trim_aa)
trim_ab_2 = Number(trim_ab)
trim_ba_2 = Number(trim_ba)
trim_bb_2 = Number(trim_bb)
trim_ca_2 = Number(trim_ca)
trim_cb_2 = Number(trim_cb)
trim_da_2 = Number(trim_da)
trim_db_2 = Number(trim_db)
dom = ConstructDomain(DomainStart=trim_aa_2, DomainEnd=trim_ab_2)
dom_2 = ConstructDomain(DomainStart=trim_ba_2, DomainEnd=trim_bb_2)
dom_3 = ConstructDomain(DomainStart=trim_ca_2, DomainEnd=trim_cb_2)
dom_4 = ConstructDomain(DomainStart=trim_da_2, DomainEnd=trim_db_2)
multiplication = Multiplication(A=number_slider, B=scant_optiune_a)
multiplication_2 = Multiplication(A=number_slider, B=scant_optiune_b)
multiplication_3 = Multiplication(A=number_slider, B=scant_optiune_c)
multiplication_4 = Multiplication(A=number_slider, B=scant_optiune_d)

# ---- group: Activate
merge_6 = Merge(Data1=side_a_2, Data2=side_b_2, Data3=side_c_2, Data4=side_d_2)

# ---- group: Flip
merge_7 = Merge(Data1=flip_a_2, Data2=flip_b_2, Data3=flip_c_2, Data4=flip_d_2)

# ----
merge_8 = Merge(Data1=multiplication, Data2=multiplication_2, Data3=multiplication_3, Data4=multiplication_4)
merge_9 = Merge(Data1=dom, Data2=dom_2, Data3=dom_3, Data4=dom_4)

# ---- group: Culling
cull = CullPattern(List=merge_5, CullPattern=merge_6)  # -> graft(List)
cull_2 = CullPattern(List=explode.Segments, CullPattern=merge_6)  # -> graft(List)
cull_3 = CullPattern(List=merge_4, CullPattern=merge_6)  # -> graft(List)
cull_4 = CullPattern(List=merge_3, CullPattern=merge_6)  # -> graft(List)
cull_5 = CullPattern(List=merge_9, CullPattern=merge_6)  # -> graft(List)
cull_6 = CullPattern(List=merge_7, CullPattern=merge_6)  # -> graft(List)
cull_7 = CullPattern(List=merge_8, CullPattern=merge_6)  # -> graft(List)

# ---- group: Orientation
pl = ConstructPlane(Origin=Point(0, 0, 0), XAxis=debox.Plane, YAxis=cull)
flippln_3 = FlipPlane(Plane=pl, FlipX=cull_6, FlipY=cull_6, FlipZ=True)  # -> Flipped, R
xz_3 = XZPlane(Origin=Point(0, 0, 0))
orient = Orient(Geometry=cull_4, Source=xz_3, Target=flippln_3.Flipped)  # -> Geometry, Transform

# ----
scant_2 = Orient(Geometry=scant, Source=xz_3, Target=flippln_3.Flipped)  # -> Geometry, Transform
orient_2 = Orient(Geometry=cull_3, Source=xz_3, Target=flippln_3.Flipped)  # -> Geometry, Transform
abs = Absolute(Value=cull_7)
box = Geometry(toret_cu_surub)
gaurire_3 = Boolean(gaurire_2)
gaurire_4 = Boolean(gaurire_2)
suruburi_5 = Boolean(suruburi_2)
plasti_3 = Geometry(plasti_2)
suruburi_6 = Boolean(suruburi_2)
box_2 = Geometry(toret_2)

# ---- group: Position
len = Length(Curve=cull_2)
dedomain_2 = DeconstructDomain(Domain=cull_5)  # -> Start, End

# ---- group: Clamping offset
half = Division(A=len, B=2)
dom_5 = ConstructDomain(DomainStart=0, DomainEnd=half)
clamp = Clamp(Value=dedomain_2.Start, Domain=dom_5)
subtraction = Subtraction(A=len, B=clamp, C=1)
dom_6 = ConstructDomain(DomainStart=0, DomainEnd=subtraction)
clamp_2 = Clamp(Value=dedomain_2.End, Domain=dom_6)

# ---- group: Position (continued)
subtraction_2 = Subtraction(A=clamp, B=1)
neg_3 = Negative(Value=subtraction_2)
neg_4 = Negative(Value=clamp_2)
ext = ExtendCurve(Curve=cull_2, Type=0, Start=neg_3, End=neg_4)

# ---- group: Length min treshold
len_2 = Length(Curve=ext)
expression_2 = Expression(x=len_2, y=Slider(180, range=0..1000), Expression="floor(x/y)")
clamp_3 = Clamp(Value=expression_2, Domain=Domain(1, 100))

# ----
len_3 = Length(Curve=ext)

# ---- group: Scant instancing
divide = DivideCurve(Curve=ext, Count=clamp_3, Kinks=False)  # -> Points, Tangents, Parameters
round = Round(Number=divide.Parameters)  # -> Nearest, Floor, Ceiling
eval = EvaluateCurve(Curve=ext, Parameter=round.Nearest)  # -> Point, Tangent, Angle

# ---- group: If less than (t) - 1 point
len_4 = Length(Curve=ext)
t_treshold_for_1_point = Slider(64, range=0..1000)
expression_3 = Expression(x=len_4, t=t_treshold_for_1_point, Expression="if(x<t,1,0)")
midpt = CurveMiddle(Curve=ext)
bang = ExplodeTree(Data=midpt)  # -> _0000000, _0000001, _0000002, _0000003
bang_2 = ExplodeTree(Data=expression_3)  # -> _0000000, _0000001, _0000002, _0000003
bang_3 = ExplodeTree(Data=eval.Point)  # -> _00000000, _00000010, _00000020, _00000030
filter_5 = StreamFilter(Gate=bang_2._0000000, Stream0=bang_3._00000000, Stream1=bang._0000000)
filter_6 = StreamFilter(Gate=bang_2._0000001, Stream0=bang_3._00000010, Stream1=bang._0000001)
filter_7 = StreamFilter(Gate=bang_2._0000002, Stream0=bang_3._00000020, Stream1=bang._0000002)
filter_8 = StreamFilter(Gate=bang_2._0000003, Stream0=bang_3._00000030, Stream1=bang._0000003)
entwine = Entwine(Branch00=filter_5, Branch01=filter_6, Branch02=filter_7, Branch03=filter_8, FlattenInputs=True)
clean = CleanTree(RemoveNulls=True, RemoveInvalid=True, RemoveEmpty=True, Tree=entwine)

# ----
amp_2 = Amplitude(Vector=eval.Tangent, Amplitude=cull_7)
move_2 = Move(Geometry=clean, Motion=amp_2)  # -> Geometry, Transform
cull_8 = CullPattern(List=move_2.Geometry, CullPattern=graft(abs))

# ---- group: Scant instancing (continued)
geo_6 = Geometry(cull_8)

# ----
move_3 = Move(Geometry=scant_2.Geometry, Motion=geo_6)  # -> Geometry, Transform
gate_3 = StreamGate(Stream=move_3.Geometry, Gate=gaurire_2)  # -> Target0, Target1

# ---- group: Position (continued)
divide_2 = DivideCurve(Curve=ext, Count=clamp_3, Kinks=False)  # -> Points, Tangents, Parameters
round_2 = Round(Number=divide_2.Parameters)  # -> Nearest, Floor, Ceiling
eval_2 = EvaluateCurve(Curve=ext, Parameter=round_2.Nearest)  # -> Point, Tangent, Angle

# ---- group: If less than (t) - 1 point
len_5 = Length(Curve=ext)
t_treshold_for_1_point_2 = Slider(64, range=0..1000)
expression_4 = Expression(x=len_5, t=t_treshold_for_1_point_2, Expression="if(x<t,1,0)")
midpt_2 = CurveMiddle(Curve=ext)
bang_4 = ExplodeTree(Data=midpt_2)  # -> _0000000, _0000001, _0000002, _0000003
bang_5 = ExplodeTree(Data=expression_4)  # -> _0000000, _0000001, _0000002, _0000003
bang_6 = ExplodeTree(Data=eval_2.Point)  # -> _00000000, _00000010, _00000020, _00000030
filter_9 = StreamFilter(Gate=bang_5._0000000, Stream0=bang_6._00000000, Stream1=bang_4._0000000)
filter_10 = StreamFilter(Gate=bang_5._0000001, Stream0=bang_6._00000010, Stream1=bang_4._0000001)
filter_11 = StreamFilter(Gate=bang_5._0000002, Stream0=bang_6._00000020, Stream1=bang_4._0000002)
filter_12 = StreamFilter(Gate=bang_5._0000003, Stream0=bang_6._00000030, Stream1=bang_4._0000003)
entwine_2 = Entwine(Branch00=filter_9, Branch01=filter_10, Branch02=filter_11, Branch03=filter_12, FlattenInputs=True)
clean_2 = CleanTree(RemoveNulls=True, RemoveInvalid=True, RemoveEmpty=True, Tree=entwine_2)

# ---- group: Position (continued)
geo_7 = Geometry(clean_2)

# ----
move_4 = Move(Geometry=orient_2.Geometry, Motion=geo_7)  # -> Geometry, Transform
move_5 = Move(Geometry=orient.Geometry, Motion=geo_7)  # -> Geometry, Transform
A = Geometry(flatten(move_4.Geometry))
B = Geometry(flatten(move_5.Geometry))
gate_4 = StreamGate(Stream=A, Gate=gaurire_2)  # -> Target0, Target1

plasti_4 = Geometry(plasti_cu_surub)
extractattr = ExtractAttributes(Object=plasti_4)
sdiff = SolidDifference(BrepsA=flatten(plasti_4), BrepsB=flatten([gate_4.Target1, gate_3.Target1]))
injectattr = InjectAttributes(Object=sdiff, Attributes=extractattr)

gate_5 = StreamGate(Stream=B, Gate=gaurire_2)  # -> Target0, Target1

toret_3 = Geometry(box)
extractattr_2 = ExtractAttributes(Object=toret_3)
sdiff_2 = SolidDifference(BrepsA=flatten(toret_3), BrepsB=flatten([gate_5.Target1, gate_3.Target1]))
injectattr_2 = InjectAttributes(Object=sdiff_2, Attributes=extractattr_2)

plasti_cu_surub_2 = Geometry(plasti_4)
brep = Geometry(injectattr)
toret_4 = Geometry(toret_3)
brep_2 = Geometry(injectattr_2)
filter_13 = StreamFilter(Gate=gaurire_3, Stream0=plasti_cu_surub_2, Stream1=brep)
filter_14 = StreamFilter(Gate=gaurire_4, Stream0=toret_4, Stream1=brep_2)
geo_8 = Geometry(flatten([gate_3.Target0, gate_5.Target0, gate_4.Target0]))
filter_15 = StreamFilter(Gate=suruburi_5, Stream0=plasti_3, Stream1=filter_13)
filter_16 = StreamFilter(Gate=suruburi_6, Stream0=box_2, Stream1=filter_14)
suruburi_7 = ClusterOutput(geo_8)
geo_9 = Geometry(flatten(filter_15))
geo_10 = Geometry(flatten(filter_16))
piesa_toreț_2 = ClusterOutput(geo_10)
piese_plasti_2 = ClusterOutput(geo_9)

# ==== cluster ManerAttributes
p2o = ClusterInput()
aplicat = ClusterInput()
attributes_list = Panel("""P2O
aplicat""")
p2o_2 = Boolean(p2o)
p2o_3 = Boolean(aplicat)
geo = ClusterInput()
merge = Merge(Data1=p2o_2, Data2=p2o_3)
constructattr = ConstructAttributes(Keys=attributes_list, Values=merge)
injectattr = InjectAttributes(Object=geo, Attributes=constructattr)
maner = ClusterOutput(injectattr)

# ==== cluster ABSPlacement: ABS placement
toggle = BooleanToggle(True)
toggle_2 = BooleanToggle(True)
toggle_3 = BooleanToggle(True)
toggle_4 = BooleanToggle(True)
bool = ClusterInput()
bool_2 = ClusterInput()
bool_3 = ClusterInput()
bool_4 = ClusterInput()
geo = ClusterInput()
bool_5 = Boolean(bool)
bool_6 = Boolean(bool_2)
bool_7 = Boolean(bool_3)
bool_8 = Boolean(bool_4)
geo_2 = Geometry(geo)
debox = DeconstructBox(Box=geo_2)  # -> Plane, X, Y, Z
filter = StreamFilter(Gate=bool_5, Stream0=0, Stream1="2")
filter_2 = StreamFilter(Gate=bool_6, Stream0=0, Stream1="2")
filter_3 = StreamFilter(Gate=bool_7, Stream0=0, Stream1="2")
filter_4 = StreamFilter(Gate=bool_8, Stream0=0, Stream1="2")
trim_domain = TrimDomain(start=filter, domain=debox.X, end=filter_2)
trim_domain_2 = TrimDomain(start=filter_3, domain=debox.Y, end=filter_4)
box = DomainBox(Base=debox.Plane, X=trim_domain, Y=trim_domain_2, Z=debox.Z)

debox_2 = DeconstructBox(Box=box)  # -> Plane, X, Y, Z
dedomain = DeconstructDomain(Domain=debox_2.Z)  # -> Start, End
expression = Expression(x=dedomain.Start, y=dedomain.End, Expression="x-(x-y)/2")
amp = Amplitude(Vector=debox_2.Plane, Amplitude=expression)
move = Move(Geometry=debox_2.Plane, Motion=amp)  # -> Geometry, Transform
rectangle = Rectangle(Plane=move.Geometry, XSize=debox_2.X, YSize=debox_2.Y, Radius=0)  # -> Rectangle, Length
explode = Explode(Curve=rectangle.Rectangle, Recursive=True)  # -> Segments, Vertices

bang = ExplodeTree(Data=graft(explode.Segments))  # -> Branch0, Branch1, Branch2, Branch3
filter_5 = StreamFilter(Gate=bool_5, Stream0=-2, Stream1=0)
filter_6 = StreamFilter(Gate=bool_6, Stream0=-2, Stream1=0)
filter_7 = StreamFilter(Gate=bool_8, Stream0=-2, Stream1=0)
filter_8 = StreamFilter(Gate=bool_7, Stream0=-2, Stream1=0)

ext = ExtendCurve(Curve=bang.Branch0, Type=0, Start=filter_5, End=filter_6)
ext_2 = ExtendCurve(Curve=bang.Branch1, Type=0, Start=filter_8, End=filter_7)
ext_3 = ExtendCurve(Curve=bang.Branch2, Type=0, Start=filter_6, End=filter_5)
ext_4 = ExtendCurve(Curve=bang.Branch3, Type=0, Start=filter_7, End=filter_8)

crv = Curve(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)
crv_2 = Curve(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)

deplane = DeconstructPlane(Plane=debox_2.Plane)  # -> Origin, XAxis, YAxis, ZAxis
neg = Negative(Value=deplane.YAxis)
pl = ConstructPlane(Origin=Point(0, 0, 0), XAxis=deplane.ZAxis, YAxis=neg)
end = EndPoints(Curve=ext)  # -> Start, End
orient = Orient(Geometry=crv_2, Source=PlaneXY(0, 0, 0), Target=pl)  # -> Geometry, Transform
move_2 = Move(Geometry=orient.Geometry, Motion=end.Start)  # -> Geometry, Transform
item = ListItem(List=move_2.Geometry, Index=Slider(1, range=0..3), Wrap=True)
swp1 = Sweep1(Rail=ext, Sections=item, Miter=1)

deplane_2 = DeconstructPlane(Plane=debox_2.Plane)  # -> Origin, XAxis, YAxis, ZAxis
pl_2 = ConstructPlane(Origin=Point(0, 0, 0), XAxis=deplane_2.ZAxis, YAxis=deplane_2.XAxis)
end_2 = EndPoints(Curve=ext_2)  # -> Start, End
orient_2 = Orient(Geometry=crv_2, Source=PlaneXY(0, 0, 0), Target=pl_2)  # -> Geometry, Transform
move_3 = Move(Geometry=orient_2.Geometry, Motion=end_2.Start)  # -> Geometry, Transform
item_2 = ListItem(List=move_3.Geometry, Index=Slider(2, range=0..3), Wrap=True)
swp1_2 = Sweep1(Rail=ext_2, Sections=item_2, Miter=1)

deplane_3 = DeconstructPlane(Plane=debox_2.Plane)  # -> Origin, XAxis, YAxis, ZAxis
pl_3 = ConstructPlane(Origin=Point(0, 0, 0), XAxis=deplane_3.ZAxis, YAxis=deplane_3.YAxis)
end_3 = EndPoints(Curve=ext_3)  # -> Start, End
orient_3 = Orient(Geometry=crv_2, Source=PlaneXY(0, 0, 0), Target=pl_3)  # -> Geometry, Transform
move_4 = Move(Geometry=orient_3.Geometry, Motion=end_3.Start)  # -> Geometry, Transform
item_3 = ListItem(List=move_4.Geometry, Index=Slider(0, range=0..3), Wrap=True)
swp1_3 = Sweep1(Rail=ext_3, Sections=item_3, Miter=1)

deplane_4 = DeconstructPlane(Plane=debox_2.Plane)  # -> Origin, XAxis, YAxis, ZAxis
neg_2 = Negative(Value=deplane_4.XAxis)
pl_4 = ConstructPlane(Origin=Point(0, 0, 0), XAxis=deplane_4.ZAxis, YAxis=neg_2)
end_4 = EndPoints(Curve=ext_4)  # -> Start, End
orient_4 = Orient(Geometry=crv_2, Source=PlaneXY(0, 0, 0), Target=pl_4)  # -> Geometry, Transform
move_5 = Move(Geometry=orient_4.Geometry, Motion=end_4.Start)  # -> Geometry, Transform
item_4 = ListItem(List=move_5.Geometry, Index=Slider(3, range=0..3), Wrap=True)
swp1_4 = Sweep1(Rail=ext_4, Sections=item_4, Miter=1)

item_5 = ListItem(List=swp1, Index=0, Wrap=True)
debrep = DeconstructBrep(Brep=item_5)  # -> Faces, Edges, Vertices
item_6 = ListItem(List=debrep.Edges, Index=Slider(1, range=0..5), Wrap=True)
end_5 = EndPoints(Curve=item_6)  # -> Start, End
rad = Radians(Degrees=Slider(90, range=-90..90))
ln = Line(StartPoint=end_5.End, EndPoint=end_5.Start)
revsrf = Revolution(Curve=item_6, Axis=ln, Domain=rad)

item_7 = ListItem(List=swp1, Index=0, Wrap=True)
debrep_2 = DeconstructBrep(Brep=item_7)  # -> Faces, Edges, Vertices
item_8 = ListItem(List=debrep_2.Edges, Index=Slider(3, range=0..5), Wrap=True)
end_6 = EndPoints(Curve=item_8)  # -> Start, End
rad_2 = Radians(Degrees=Slider(90, range=-90..90))
ln_2 = Line(StartPoint=end_6.End, EndPoint=end_6.Start)
revsrf_2 = Revolution(Curve=item_8, Axis=ln_2, Domain=rad_2)

item_9 = ListItem(List=swp1_2, Index=0, Wrap=True)
debrep_3 = DeconstructBrep(Brep=item_9)  # -> Faces, Edges, Vertices
item_10 = ListItem(List=debrep_3.Edges, Index=Slider(1, range=0..5), Wrap=True)
end_7 = EndPoints(Curve=item_10)  # -> Start, End
rad_3 = Radians(Degrees=Slider(90, range=-90..90))
ln_3 = Line(StartPoint=end_7.End, EndPoint=end_7.Start)
revsrf_3 = Revolution(Curve=item_10, Axis=ln_3, Domain=rad_3)

item_11 = ListItem(List=swp1_2, Index=0, Wrap=True)
debrep_4 = DeconstructBrep(Brep=item_11)  # -> Faces, Edges, Vertices
item_12 = ListItem(List=debrep_4.Edges, Index=Slider(3, range=0..5), Wrap=True)
end_8 = EndPoints(Curve=item_12)  # -> Start, End
rad_4 = Radians(Degrees=Slider(90, range=-90..90))
ln_4 = Line(StartPoint=end_8.End, EndPoint=end_8.Start)
revsrf_4 = Revolution(Curve=item_12, Axis=ln_4, Domain=rad_4)

item_13 = ListItem(List=swp1_3, Index=0, Wrap=True)
debrep_5 = DeconstructBrep(Brep=item_13)  # -> Faces, Edges, Vertices
item_14 = ListItem(List=debrep_5.Edges, Index=Slider(1, range=0..5), Wrap=True)
end_9 = EndPoints(Curve=item_14)  # -> Start, End
rad_5 = Radians(Degrees=Slider(90, range=-90..90))
ln_5 = Line(StartPoint=end_9.End, EndPoint=end_9.Start)
revsrf_5 = Revolution(Curve=item_14, Axis=ln_5, Domain=rad_5)

item_15 = ListItem(List=swp1_3, Index=0, Wrap=True)
debrep_6 = DeconstructBrep(Brep=item_15)  # -> Faces, Edges, Vertices
item_16 = ListItem(List=debrep_6.Edges, Index=Slider(3, range=0..5), Wrap=True)
end_10 = EndPoints(Curve=item_16)  # -> Start, End
rad_6 = Radians(Degrees=Slider(90, range=-90..90))
ln_6 = Line(StartPoint=end_10.End, EndPoint=end_10.Start)
revsrf_6 = Revolution(Curve=item_16, Axis=ln_6, Domain=rad_6)

item_17 = ListItem(List=swp1_4, Index=0, Wrap=True)
debrep_7 = DeconstructBrep(Brep=item_17)  # -> Faces, Edges, Vertices
item_18 = ListItem(List=debrep_7.Edges, Index=Slider(1, range=0..5), Wrap=True)
end_11 = EndPoints(Curve=item_18)  # -> Start, End
rad_7 = Radians(Degrees=Slider(90, range=-90..90))
ln_7 = Line(StartPoint=end_11.End, EndPoint=end_11.Start)
revsrf_7 = Revolution(Curve=item_18, Axis=ln_7, Domain=rad_7)

item_19 = ListItem(List=swp1_4, Index=0, Wrap=True)
debrep_8 = DeconstructBrep(Brep=item_19)  # -> Faces, Edges, Vertices
item_20 = ListItem(List=debrep_8.Edges, Index=Slider(3, range=0..5), Wrap=True)
end_12 = EndPoints(Curve=item_20)  # -> Start, End
rad_8 = Radians(Degrees=Slider(90, range=-90..90))
ln_8 = Line(StartPoint=end_12.End, EndPoint=end_12.Start)
revsrf_8 = Revolution(Curve=item_20, Axis=ln_8, Domain=rad_8)

join = BrepJoin(Breps=flatten([revsrf, revsrf_2, swp1]))  # -> Breps, Closed
join_2 = BrepJoin(Breps=flatten([revsrf_5, revsrf_6, swp1_3]))  # -> Breps, Closed
join_3 = BrepJoin(Breps=flatten([swp1_2, revsrf_3, revsrf_4]))  # -> Breps, Closed
join_4 = BrepJoin(Breps=flatten([revsrf_7, swp1_4, revsrf_8]))  # -> Breps, Closed
cap = CapHoles(Brep=join.Breps)
cap_2 = CapHoles(Brep=join_2.Breps)
cap_3 = CapHoles(Brep=join_3.Breps)
cap_4 = CapHoles(Brep=join_4.Breps)
null = NullPlaceholder()

filter_9 = StreamFilter(Gate=bool_5, Stream0=null, Stream1=cap_4)
filter_10 = StreamFilter(Gate=bool_6, Stream0=null, Stream1=cap_3)
filter_11 = StreamFilter(Gate=bool_7, Stream0=null, Stream1=cap)
filter_12 = StreamFilter(Gate=bool_8, Stream0=null, Stream1=cap_2)

merge = Merge(Data1=flatten(filter_9), Data2=flatten(filter_10), Data3=flatten(filter_11), Data4=flatten(filter_12))
geo_3 = Geometry(flatten(merge))
geo_4 = Geometry(box)
abs = ClusterOutput(geo_3)
piece = ClusterOutput(geo_4)

# ==== cluster ScrewsOnBox
piesa_toreț = ClusterInput()
piese_plasti = ClusterInput()
suruburi = ClusterInput()
gaurire = ClusterInput()
panel = Panel("Z:\Obiecte modelate\Suruburi\Scant\32x8.3dm")
panel_2 = Panel("Z:\Obiecte modelate\Suruburi\Confirmate\Conf_L-50_PAL-18.3dm")
gaurire_2 = Boolean(gaurire)
suruburi_2 = Boolean(suruburi)

toret = Geometry(piesa_toreț)
suruburi_3 = Boolean(suruburi_2)
gate = StreamGate(Stream=toret, Gate=suruburi_3)  # -> Target0, Target1
toret_2 = Geometry(gate.Target0)
toret_cu_surub = Geometry(gate.Target1)

plasti = Geometry(piese_plasti)
suruburi_4 = Boolean(suruburi_2)
gate_2 = StreamGate(Stream=plasti, Gate=suruburi_4)  # -> Target0, Target1
plasti_2 = Geometry(gate_2.Target0)
plasti_cu_surub = Geometry(gate_2.Target1)

debox = DeconstructBox(Box=toret_cu_surub)  # -> Plane, X, Y, Z
dedomain = DeconstructDomain(Domain=debox.Z)  # -> Start, End
expression = Expression(x=dedomain.Start, y=dedomain.End, Expression="x-(x-y)/2")
amp = Amplitude(Vector=debox.Plane, Amplitude=expression)
move = Move(Geometry=debox.Plane, Motion=amp)  # -> Geometry, Transform
rectangle = Rectangle(Plane=move.Geometry, XSize=debox.X, YSize=debox.Y, Radius=0)  # -> Rectangle, Length
explode = Explode(Curve=rectangle.Rectangle, Recursive=True)  # -> Segments, Vertices

# ---- group: Suruburi
rastex_15mm = Geometry(flatten(Tree({0}: [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], {0;0;0;1}: [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])))
confirmat_l50 = Geometry(flatten([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]))
scant = Geometry(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)

# ----
fixture_a = ClusterInput()
fixture_d = ClusterInput()
fixture_b = ClusterInput()
fixture_c = ClusterInput()
int = Integer(fixture_a)
int_2 = Integer(fixture_b)
int_3 = Integer(fixture_c)
int_4 = Integer(fixture_d)
filter = StreamFilter(Gate=int, Stream0=rastex_15mm, Stream1=confirmat_l50)
filter_2 = StreamFilter(Gate=int_2, Stream0=rastex_15mm, Stream1=confirmat_l50)
filter_3 = StreamFilter(Gate=int_3, Stream0=rastex_15mm, Stream1=confirmat_l50)
filter_4 = StreamFilter(Gate=int_4, Stream0=rastex_15mm, Stream1=confirmat_l50)
geo = Geometry(filter)
geo_2 = Geometry(filter_2)
geo_3 = Geometry(filter_3)
geo_4 = Geometry(filter_4)
fixture_a_2 = ExplodeTree(Data=graft(geo))  # -> Branch0, Branch1
fixture_b_2 = ExplodeTree(Data=graft(geo_2))  # -> Branch0, Branch1
fixture_c_2 = ExplodeTree(Data=graft(geo_3))  # -> Branch0, Branch1
fixture_d_2 = ExplodeTree(Data=graft(geo_4))  # -> Branch0, Branch1
merge = Merge(Data1=fixture_a_2.Branch0, Data2=fixture_b_2.Branch0, Data3=fixture_c_2.Branch0, Data4=fixture_d_2.Branch0)
merge_2 = Merge(Data1=fixture_a_2.Branch1, Data2=fixture_b_2.Branch1, Data3=fixture_c_2.Branch1, Data4=fixture_d_2.Branch1)

number_slider = Slider(32, range=1..50)

# ---- group: Vectors
deplane = DeconstructPlane(Plane=debox.Plane)  # -> Origin, XAxis, YAxis, ZAxis
neg = Negative(Value=deplane.XAxis)
neg_2 = Negative(Value=deplane.YAxis)
merge_3 = Merge(Data1=deplane.XAxis, Data2=deplane.YAxis, Data3=neg, Data4=neg_2)

# ----
trim_aa = ClusterInput()
trim_ab = ClusterInput()
trim_ba = ClusterInput()
trim_bb = ClusterInput()
trim_ca = ClusterInput()
trim_cb = ClusterInput()
trim_da = ClusterInput()
trim_db = ClusterInput()
scant_optiune_a = ClusterInput()
scant_optiune_b = ClusterInput()
scant_optiune_c = ClusterInput()
scant_optiune_d = ClusterInput()
side_a = ClusterInput()
side_c = ClusterInput()
side_d = ClusterInput()
flip_a = ClusterInput()
flip_c = ClusterInput()
flip_d = ClusterInput()
side_b = ClusterInput()
flip_b = ClusterInput()
side_a_2 = Boolean(side_a)
side_b_2 = Boolean(side_b)
side_c_2 = Boolean(side_c)
side_d_2 = Boolean(side_d)
flip_a_2 = Boolean(flip_a)
flip_b_2 = Boolean(flip_b)
flip_c_2 = Boolean(flip_c)
flip_d_2 = Boolean(flip_d)
trim_aa_2 = Number(trim_aa)
trim_ab_2 = Number(trim_ab)
trim_ba_2 = Number(trim_ba)
trim_bb_2 = Number(trim_bb)
trim_ca_2 = Number(trim_ca)
trim_cb_2 = Number(trim_cb)
trim_da_2 = Number(trim_da)
trim_db_2 = Number(trim_db)
dom = ConstructDomain(DomainStart=trim_aa_2, DomainEnd=trim_ab_2)
dom_2 = ConstructDomain(DomainStart=trim_ba_2, DomainEnd=trim_bb_2)
dom_3 = ConstructDomain(DomainStart=trim_ca_2, DomainEnd=trim_cb_2)
dom_4 = ConstructDomain(DomainStart=trim_da_2, DomainEnd=trim_db_2)
multiplication = Multiplication(A=number_slider, B=scant_optiune_a)
multiplication_2 = Multiplication(A=number_slider, B=scant_optiune_b)
multiplication_3 = Multiplication(A=number_slider, B=scant_optiune_c)
multiplication_4 = Multiplication(A=number_slider, B=scant_optiune_d)

# ---- group: Activate
merge_4 = Merge(Data1=side_a_2, Data2=side_b_2, Data3=side_c_2, Data4=side_d_2)

# ---- group: Flip
merge_5 = Merge(Data1=flip_a_2, Data2=flip_b_2, Data3=flip_c_2, Data4=flip_d_2)

# ----
merge_6 = Merge(Data1=multiplication, Data2=multiplication_2, Data3=multiplication_3, Data4=multiplication_4)
merge_7 = Merge(Data1=dom, Data2=dom_2, Data3=dom_3, Data4=dom_4)

# ---- group: Culling
cull = CullPattern(List=merge_3, CullPattern=merge_4)  # -> graft(List)
cull_2 = CullPattern(List=explode.Segments, CullPattern=merge_4)  # -> graft(List)
cull_3 = CullPattern(List=merge_2, CullPattern=merge_4)  # -> graft(List)
cull_4 = CullPattern(List=merge, CullPattern=merge_4)  # -> graft(List)
cull_5 = CullPattern(List=merge_7, CullPattern=merge_4)  # -> graft(List)
cull_6 = CullPattern(List=merge_5, CullPattern=merge_4)  # -> graft(List)
cull_7 = CullPattern(List=merge_6, CullPattern=merge_4)  # -> graft(List)

# ---- group: Orientation
pl = ConstructPlane(Origin=Point(0, 0, 0), XAxis=debox.Plane, YAxis=cull)
flippln = FlipPlane(Plane=pl, FlipX=cull_6, FlipY=cull_6, FlipZ=True)  # -> Flipped, R
xz = XZPlane(Origin=Point(0, 0, 0))
orient = Orient(Geometry=cull_4, Source=xz, Target=flippln.Flipped)  # -> Geometry, Transform

# ----
scant_2 = Orient(Geometry=scant, Source=xz, Target=flippln.Flipped)  # -> Geometry, Transform
orient_2 = Orient(Geometry=cull_3, Source=xz, Target=flippln.Flipped)  # -> Geometry, Transform
abs = Absolute(Value=cull_7)
box = Geometry(toret_cu_surub)
gaurire_3 = Boolean(gaurire_2)
gaurire_4 = Boolean(gaurire_2)
suruburi_5 = Boolean(suruburi_2)
plasti_3 = Geometry(plasti_2)
suruburi_6 = Boolean(suruburi_2)
box_2 = Geometry(toret_2)

# ---- group: Position
len = Length(Curve=cull_2)
dedomain_2 = DeconstructDomain(Domain=cull_5)  # -> Start, End

# ---- group: Clamping offset
half = Division(A=len, B=2)
dom_5 = ConstructDomain(DomainStart=0, DomainEnd=half)
clamp = Clamp(Value=dedomain_2.Start, Domain=dom_5)
subtraction = Subtraction(A=len, B=clamp, C=1)
dom_6 = ConstructDomain(DomainStart=0, DomainEnd=subtraction)
clamp_2 = Clamp(Value=dedomain_2.End, Domain=dom_6)

# ---- group: Position (continued)
subtraction_2 = Subtraction(A=clamp, B=1)
neg_3 = Negative(Value=subtraction_2)
neg_4 = Negative(Value=clamp_2)
ext = ExtendCurve(Curve=cull_2, Type=0, Start=neg_3, End=neg_4)

# ---- group: Length min treshold
len_2 = Length(Curve=ext)
expression_2 = Expression(x=len_2, y=Slider(180, range=0..1000), Expression="floor(x/y)")
clamp_3 = Clamp(Value=expression_2, Domain=Domain(1, 100))

# ----
len_3 = Length(Curve=ext)

# ---- group: Scant instancing
divide = DivideCurve(Curve=ext, Count=clamp_3, Kinks=False)  # -> Points, Tangents, Parameters
round = Round(Number=divide.Parameters)  # -> Nearest, Floor, Ceiling
eval = EvaluateCurve(Curve=ext, Parameter=round.Nearest)  # -> Point, Tangent, Angle

# ---- group: If less than (t) - 1 point
len_4 = Length(Curve=ext)
t_treshold_for_1_point = Slider(64, range=0..1000)
expression_3 = Expression(x=len_4, t=t_treshold_for_1_point, Expression="if(x<t,1,0)")
midpt = CurveMiddle(Curve=ext)
bang = ExplodeTree(Data=midpt)  # -> Branch0, Branch1, Branch2, Branch3
bang_2 = ExplodeTree(Data=expression_3)  # -> Branch0, Branch1, Branch2, Branch3
bang_3 = ExplodeTree(Data=eval.Point)  # -> _0000, _0010, _0020, Branch3
filter_5 = StreamFilter(Gate=bang_2.Branch0, Stream0=bang_3._0000, Stream1=bang.Branch0)
filter_6 = StreamFilter(Gate=bang_2.Branch1, Stream0=bang_3._0010, Stream1=bang.Branch1)
filter_7 = StreamFilter(Gate=bang_2.Branch2, Stream0=bang_3._0020, Stream1=bang.Branch2)
filter_8 = StreamFilter(Gate=bang_2.Branch3, Stream0=bang_3.Branch3, Stream1=bang.Branch3)
entwine = Entwine(Branch00=filter_5, Branch01=filter_6, Branch02=filter_7, Branch03=filter_8, FlattenInputs=True)
clean = CleanTree(RemoveNulls=True, RemoveInvalid=True, RemoveEmpty=True, Tree=entwine)

# ----
amp_2 = Amplitude(Vector=eval.Tangent, Amplitude=cull_7)
move_2 = Move(Geometry=clean, Motion=amp_2)  # -> Geometry, Transform
cull_8 = CullPattern(List=move_2.Geometry, CullPattern=graft(abs))

# ---- group: Scant instancing (continued)
geo_5 = Geometry(cull_8)

# ----
move_3 = Move(Geometry=scant_2.Geometry, Motion=geo_5)  # -> Geometry, Transform
gate_3 = StreamGate(Stream=move_3.Geometry, Gate=gaurire_2)  # -> Target0, Target1

# ---- group: Position (continued)
divide_2 = DivideCurve(Curve=ext, Count=clamp_3, Kinks=False)  # -> Points, Tangents, Parameters
round_2 = Round(Number=divide_2.Parameters)  # -> Nearest, Floor, Ceiling
eval_2 = EvaluateCurve(Curve=ext, Parameter=round_2.Nearest)  # -> Point, Tangent, Angle

# ---- group: If less than (t) - 1 point
len_5 = Length(Curve=ext)
t_treshold_for_1_point_2 = Slider(64, range=0..1000)
expression_4 = Expression(x=len_5, t=t_treshold_for_1_point_2, Expression="if(x<t,1,0)")
midpt_2 = CurveMiddle(Curve=ext)
bang_4 = ExplodeTree(Data=midpt_2)  # -> Branch0, Branch1, Branch2, Branch3
bang_5 = ExplodeTree(Data=expression_4)  # -> Branch0, Branch1, Branch2, Branch3
bang_6 = ExplodeTree(Data=eval_2.Point)  # -> _0000, _0010, _0020, Branch3
filter_9 = StreamFilter(Gate=bang_5.Branch0, Stream0=bang_6._0000, Stream1=bang_4.Branch0)
filter_10 = StreamFilter(Gate=bang_5.Branch1, Stream0=bang_6._0010, Stream1=bang_4.Branch1)
filter_11 = StreamFilter(Gate=bang_5.Branch2, Stream0=bang_6._0020, Stream1=bang_4.Branch2)
filter_12 = StreamFilter(Gate=bang_5.Branch3, Stream0=bang_6.Branch3, Stream1=bang_4.Branch3)
entwine_2 = Entwine(Branch00=filter_9, Branch01=filter_10, Branch02=filter_11, Branch03=filter_12, FlattenInputs=True)
clean_2 = CleanTree(RemoveNulls=True, RemoveInvalid=True, RemoveEmpty=True, Tree=entwine_2)

# ---- group: Position (continued)
geo_6 = Geometry(clean_2)

# ----
move_4 = Move(Geometry=orient_2.Geometry, Motion=geo_6)  # -> Geometry, Transform
move_5 = Move(Geometry=orient.Geometry, Motion=geo_6)  # -> Geometry, Transform
A = Geometry(flatten(move_4.Geometry))
B = Geometry(flatten(move_5.Geometry))
gate_4 = StreamGate(Stream=A, Gate=gaurire_2)  # -> Target0, Target1

plasti_4 = Geometry(plasti_cu_surub)
extractattr = ExtractAttributes(Object=plasti_4)
sdiff = SolidDifference(BrepsA=flatten(plasti_4), BrepsB=flatten([gate_4.Target1, gate_3.Target1]))
injectattr = InjectAttributes(Object=sdiff, Attributes=extractattr)

gate_5 = StreamGate(Stream=B, Gate=gaurire_2)  # -> Target0, Target1

toret_3 = Geometry(box)
extractattr_2 = ExtractAttributes(Object=toret_3)
sdiff_2 = SolidDifference(BrepsA=flatten(toret_3), BrepsB=flatten([gate_5.Target1, gate_3.Target1]))
injectattr_2 = InjectAttributes(Object=sdiff_2, Attributes=extractattr_2)

plasti_cu_surub_2 = Geometry(plasti_4)
brep = Geometry(injectattr)
toret_4 = Geometry(toret_3)
brep_2 = Geometry(injectattr_2)
filter_13 = StreamFilter(Gate=gaurire_3, Stream0=plasti_cu_surub_2, Stream1=brep)
filter_14 = StreamFilter(Gate=gaurire_4, Stream0=toret_4, Stream1=brep_2)
filter_15 = StreamFilter(Gate=suruburi_5, Stream0=plasti_3, Stream1=filter_13)
filter_16 = StreamFilter(Gate=suruburi_6, Stream0=box_2, Stream1=filter_14)
geo_7 = Geometry([gate_3.Target0, gate_5.Target0, gate_4.Target0])
suruburi_7 = ClusterOutput(geo_7)
geo_8 = Geometry(filter_15)
geo_9 = Geometry(filter_16)
piesa_toreț_2 = ClusterOutput(geo_9)
piese_plasti_2 = ClusterOutput(geo_8)

# ==== cluster ScrewsOnBox_2
piesa_toreț = ClusterInput()
piese_plasti = ClusterInput()
suruburi = ClusterInput()
gaurire = ClusterInput()
panel = Panel("Z:\Obiecte modelate\Suruburi\Scant\32x8.3dm")
panel_2 = Panel("Z:\Obiecte modelate\Suruburi\Confirmate\Conf_L-50_PAL-18.3dm")
gaurire_2 = Boolean(gaurire)
suruburi_2 = Boolean(suruburi)

toret = Geometry(piesa_toreț)
suruburi_3 = Boolean(suruburi_2)
gate = StreamGate(Stream=toret, Gate=suruburi_3)  # -> Target0, Target1
toret_2 = Geometry(gate.Target0)
toret_cu_surub = Geometry(gate.Target1)

plasti = Geometry(piese_plasti)
suruburi_4 = Boolean(suruburi_2)
gate_2 = StreamGate(Stream=plasti, Gate=suruburi_4)  # -> Target0, Target1
plasti_2 = Geometry(gate_2.Target0)
plasti_cu_surub = Geometry(gate_2.Target1)

debox = DeconstructBox(Box=toret_cu_surub)  # -> Plane, X, Y, Z
dedomain = DeconstructDomain(Domain=debox.Z)  # -> Start, End
expression = Expression(x=dedomain.Start, y=dedomain.End, Expression="x-(x-y)/2")
amp = Amplitude(Vector=debox.Plane, Amplitude=expression)
move = Move(Geometry=debox.Plane, Motion=amp)  # -> Geometry, Transform
rectangle = Rectangle(Plane=move.Geometry, XSize=debox.X, YSize=debox.Y, Radius=0)  # -> Rectangle, Length
explode = Explode(Curve=rectangle.Rectangle, Recursive=True)  # -> Segments, Vertices

# ---- group: Suruburi
rastex_15mm = Geometry(flatten(Tree({0}: [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], {0;0;0;1}: [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])))
confirmat_l50 = Geometry(flatten([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]))
scant = Geometry(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)

# ----
fixture_a = ClusterInput()
fixture_d = ClusterInput()
fixture_b = ClusterInput()
fixture_c = ClusterInput()
int = Integer(fixture_a)
int_2 = Integer(fixture_b)
int_3 = Integer(fixture_c)
int_4 = Integer(fixture_d)
filter = StreamFilter(Gate=int, Stream0=rastex_15mm, Stream1=confirmat_l50)
filter_2 = StreamFilter(Gate=int_2, Stream0=rastex_15mm, Stream1=confirmat_l50)
filter_3 = StreamFilter(Gate=int_3, Stream0=rastex_15mm, Stream1=confirmat_l50)
filter_4 = StreamFilter(Gate=int_4, Stream0=rastex_15mm, Stream1=confirmat_l50)
geo = Geometry(filter)
geo_2 = Geometry(filter_2)
geo_3 = Geometry(filter_3)
geo_4 = Geometry(filter_4)
fixture_a_2 = ExplodeTree(Data=graft(geo))  # -> Branch0, Branch1
fixture_b_2 = ExplodeTree(Data=graft(geo_2))  # -> Branch0, Branch1
fixture_c_2 = ExplodeTree(Data=graft(geo_3))  # -> Branch0, Branch1
fixture_d_2 = ExplodeTree(Data=graft(geo_4))  # -> Branch0, Branch1
merge = Merge(Data1=fixture_a_2.Branch0, Data2=fixture_b_2.Branch0, Data3=fixture_c_2.Branch0, Data4=fixture_d_2.Branch0)
merge_2 = Merge(Data1=fixture_a_2.Branch1, Data2=fixture_b_2.Branch1, Data3=fixture_c_2.Branch1, Data4=fixture_d_2.Branch1)

number_slider = Slider(32, range=1..50)

# ---- group: Vectors
deplane = DeconstructPlane(Plane=debox.Plane)  # -> Origin, XAxis, YAxis, ZAxis
neg = Negative(Value=deplane.XAxis)
neg_2 = Negative(Value=deplane.YAxis)
merge_3 = Merge(Data1=deplane.XAxis, Data2=deplane.YAxis, Data3=neg, Data4=neg_2)

# ----
trim_aa = ClusterInput()
trim_ab = ClusterInput()
trim_ba = ClusterInput()
trim_bb = ClusterInput()
trim_ca = ClusterInput()
trim_cb = ClusterInput()
trim_da = ClusterInput()
trim_db = ClusterInput()
scant_optiune_a = ClusterInput()
scant_optiune_b = ClusterInput()
scant_optiune_c = ClusterInput()
scant_optiune_d = ClusterInput()
side_a = ClusterInput()
side_c = ClusterInput()
side_d = ClusterInput()
flip_a = ClusterInput()
flip_c = ClusterInput()
flip_d = ClusterInput()
side_b = ClusterInput()
flip_b = ClusterInput()
side_a_2 = Boolean(side_a)
side_b_2 = Boolean(side_b)
side_c_2 = Boolean(side_c)
side_d_2 = Boolean(side_d)
flip_a_2 = Boolean(flip_a)
flip_b_2 = Boolean(flip_b)
flip_c_2 = Boolean(flip_c)
flip_d_2 = Boolean(flip_d)
trim_aa_2 = Number(trim_aa)
trim_ab_2 = Number(trim_ab)
trim_ba_2 = Number(trim_ba)
trim_bb_2 = Number(trim_bb)
trim_ca_2 = Number(trim_ca)
trim_cb_2 = Number(trim_cb)
trim_da_2 = Number(trim_da)
trim_db_2 = Number(trim_db)
dom = ConstructDomain(DomainStart=trim_aa_2, DomainEnd=trim_ab_2)
dom_2 = ConstructDomain(DomainStart=trim_ba_2, DomainEnd=trim_bb_2)
dom_3 = ConstructDomain(DomainStart=trim_ca_2, DomainEnd=trim_cb_2)
dom_4 = ConstructDomain(DomainStart=trim_da_2, DomainEnd=trim_db_2)
multiplication = Multiplication(A=number_slider, B=scant_optiune_a)
multiplication_2 = Multiplication(A=number_slider, B=scant_optiune_b)
multiplication_3 = Multiplication(A=number_slider, B=scant_optiune_c)
multiplication_4 = Multiplication(A=number_slider, B=scant_optiune_d)

# ---- group: Activate
merge_4 = Merge(Data1=side_a_2, Data2=side_b_2, Data3=side_c_2, Data4=side_d_2)

# ---- group: Flip
merge_5 = Merge(Data1=flip_a_2, Data2=flip_b_2, Data3=flip_c_2, Data4=flip_d_2)

# ----
merge_6 = Merge(Data1=multiplication, Data2=multiplication_2, Data3=multiplication_3, Data4=multiplication_4)
merge_7 = Merge(Data1=dom, Data2=dom_2, Data3=dom_3, Data4=dom_4)

# ---- group: Culling
cull = CullPattern(List=merge_3, CullPattern=merge_4)  # -> graft(List)
cull_2 = CullPattern(List=explode.Segments, CullPattern=merge_4)  # -> graft(List)
cull_3 = CullPattern(List=merge_2, CullPattern=merge_4)  # -> graft(List)
cull_4 = CullPattern(List=merge, CullPattern=merge_4)  # -> graft(List)
cull_5 = CullPattern(List=merge_7, CullPattern=merge_4)  # -> graft(List)
cull_6 = CullPattern(List=merge_5, CullPattern=merge_4)  # -> graft(List)
cull_7 = CullPattern(List=merge_6, CullPattern=merge_4)  # -> graft(List)

# ---- group: Orientation
pl = ConstructPlane(Origin=Point(0, 0, 0), XAxis=debox.Plane, YAxis=cull)
flippln = FlipPlane(Plane=pl, FlipX=cull_6, FlipY=cull_6, FlipZ=True)  # -> Flipped, R
xz = XZPlane(Origin=Point(0, 0, 0))
orient = Orient(Geometry=cull_4, Source=xz, Target=flippln.Flipped)  # -> Geometry, Transform

# ----
scant_2 = Orient(Geometry=scant, Source=xz, Target=flippln.Flipped)  # -> Geometry, Transform
orient_2 = Orient(Geometry=cull_3, Source=xz, Target=flippln.Flipped)  # -> Geometry, Transform
abs = Absolute(Value=cull_7)
box = Geometry(toret_cu_surub)
gaurire_3 = Boolean(gaurire_2)
gaurire_4 = Boolean(gaurire_2)
suruburi_5 = Boolean(suruburi_2)
plasti_3 = Geometry(plasti_2)
suruburi_6 = Boolean(suruburi_2)
box_2 = Geometry(toret_2)

# ---- group: Position
len = Length(Curve=cull_2)
dedomain_2 = DeconstructDomain(Domain=cull_5)  # -> Start, End

# ---- group: Clamping offset
half = Division(A=len, B=2)
dom_5 = ConstructDomain(DomainStart=0, DomainEnd=half)
clamp = Clamp(Value=dedomain_2.Start, Domain=dom_5)
subtraction = Subtraction(A=len, B=clamp, C=1)
dom_6 = ConstructDomain(DomainStart=0, DomainEnd=subtraction)
clamp_2 = Clamp(Value=dedomain_2.End, Domain=dom_6)

# ---- group: Position (continued)
subtraction_2 = Subtraction(A=clamp, B=1)
neg_3 = Negative(Value=subtraction_2)
neg_4 = Negative(Value=clamp_2)
ext = ExtendCurve(Curve=cull_2, Type=0, Start=neg_3, End=neg_4)

# ---- group: Length min treshold
len_2 = Length(Curve=ext)
expression_2 = Expression(x=len_2, y=Slider(180, range=0..1000), Expression="floor(x/y)")
clamp_3 = Clamp(Value=expression_2, Domain=Domain(1, 100))

# ----
len_3 = Length(Curve=ext)

# ---- group: Scant instancing
divide = DivideCurve(Curve=ext, Count=clamp_3, Kinks=False)  # -> Points, Tangents, Parameters
round = Round(Number=divide.Parameters)  # -> Nearest, Floor, Ceiling
eval = EvaluateCurve(Curve=ext, Parameter=round.Nearest)  # -> Point, Tangent, Angle

# ---- group: If less than (t) - 1 point
len_4 = Length(Curve=ext)
t_treshold_for_1_point = Slider(64, range=0..1000)
expression_3 = Expression(x=len_4, t=t_treshold_for_1_point, Expression="if(x<t,1,0)")
midpt = CurveMiddle(Curve=ext)
bang = ExplodeTree(Data=midpt)  # -> Branch0, Branch1, Branch2, Branch3
bang_2 = ExplodeTree(Data=expression_3)  # -> Branch0, Branch1, Branch2, Branch3
bang_3 = ExplodeTree(Data=eval.Point)  # -> _0000, Branch1, Branch2, Branch3
filter_5 = StreamFilter(Gate=bang_2.Branch0, Stream0=bang_3._0000, Stream1=bang.Branch0)
filter_6 = StreamFilter(Gate=bang_2.Branch1, Stream0=bang_3.Branch1, Stream1=bang.Branch1)
filter_7 = StreamFilter(Gate=bang_2.Branch2, Stream0=bang_3.Branch2, Stream1=bang.Branch2)
filter_8 = StreamFilter(Gate=bang_2.Branch3, Stream0=bang_3.Branch3, Stream1=bang.Branch3)
entwine = Entwine(Branch00=filter_5, Branch01=filter_6, Branch02=filter_7, Branch03=filter_8, FlattenInputs=True)
clean = CleanTree(RemoveNulls=True, RemoveInvalid=True, RemoveEmpty=True, Tree=entwine)

# ----
amp_2 = Amplitude(Vector=eval.Tangent, Amplitude=cull_7)
move_2 = Move(Geometry=clean, Motion=amp_2)  # -> Geometry, Transform
cull_8 = CullPattern(List=move_2.Geometry, CullPattern=graft(abs))

# ---- group: Scant instancing (continued)
geo_5 = Geometry(cull_8)

# ----
move_3 = Move(Geometry=scant_2.Geometry, Motion=geo_5)  # -> Geometry, Transform
gate_3 = StreamGate(Stream=move_3.Geometry, Gate=gaurire_2)  # -> Target0, Target1

# ---- group: Position (continued)
divide_2 = DivideCurve(Curve=ext, Count=clamp_3, Kinks=False)  # -> Points, Tangents, Parameters
round_2 = Round(Number=divide_2.Parameters)  # -> Nearest, Floor, Ceiling
eval_2 = EvaluateCurve(Curve=ext, Parameter=round_2.Nearest)  # -> Point, Tangent, Angle

# ---- group: If less than (t) - 1 point
len_5 = Length(Curve=ext)
t_treshold_for_1_point_2 = Slider(64, range=0..1000)
expression_4 = Expression(x=len_5, t=t_treshold_for_1_point_2, Expression="if(x<t,1,0)")
midpt_2 = CurveMiddle(Curve=ext)
bang_4 = ExplodeTree(Data=midpt_2)  # -> Branch0, Branch1, Branch2, Branch3
bang_5 = ExplodeTree(Data=expression_4)  # -> Branch0, Branch1, Branch2, Branch3
bang_6 = ExplodeTree(Data=eval_2.Point)  # -> _0000, Branch1, Branch2, Branch3
filter_9 = StreamFilter(Gate=bang_5.Branch0, Stream0=bang_6._0000, Stream1=bang_4.Branch0)
filter_10 = StreamFilter(Gate=bang_5.Branch1, Stream0=bang_6.Branch1, Stream1=bang_4.Branch1)
filter_11 = StreamFilter(Gate=bang_5.Branch2, Stream0=bang_6.Branch2, Stream1=bang_4.Branch2)
filter_12 = StreamFilter(Gate=bang_5.Branch3, Stream0=bang_6.Branch3, Stream1=bang_4.Branch3)
entwine_2 = Entwine(Branch00=filter_9, Branch01=filter_10, Branch02=filter_11, Branch03=filter_12, FlattenInputs=True)
clean_2 = CleanTree(RemoveNulls=True, RemoveInvalid=True, RemoveEmpty=True, Tree=entwine_2)

# ---- group: Position (continued)
geo_6 = Geometry(clean_2)

# ----
move_4 = Move(Geometry=orient_2.Geometry, Motion=geo_6)  # -> Geometry, Transform
move_5 = Move(Geometry=orient.Geometry, Motion=geo_6)  # -> Geometry, Transform
A = Geometry(flatten(move_4.Geometry))
B = Geometry(flatten(move_5.Geometry))
gate_4 = StreamGate(Stream=A, Gate=gaurire_2)  # -> Target0, Target1

plasti_4 = Geometry(plasti_cu_surub)
extractattr = ExtractAttributes(Object=plasti_4)
sdiff = SolidDifference(BrepsA=flatten(plasti_4), BrepsB=flatten([gate_4.Target1, gate_3.Target1]))
injectattr = InjectAttributes(Object=sdiff, Attributes=extractattr)

gate_5 = StreamGate(Stream=B, Gate=gaurire_2)  # -> Target0, Target1

toret_3 = Geometry(box)
extractattr_2 = ExtractAttributes(Object=toret_3)
sdiff_2 = SolidDifference(BrepsA=flatten(toret_3), BrepsB=flatten([gate_5.Target1, gate_3.Target1]))
injectattr_2 = InjectAttributes(Object=sdiff_2, Attributes=extractattr_2)

plasti_cu_surub_2 = Geometry(plasti_4)
brep = Geometry(injectattr)
toret_4 = Geometry(toret_3)
brep_2 = Geometry(injectattr_2)
filter_13 = StreamFilter(Gate=gaurire_3, Stream0=plasti_cu_surub_2, Stream1=brep)
filter_14 = StreamFilter(Gate=gaurire_4, Stream0=toret_4, Stream1=brep_2)
filter_15 = StreamFilter(Gate=suruburi_5, Stream0=plasti_3, Stream1=filter_13)
filter_16 = StreamFilter(Gate=suruburi_6, Stream0=box_2, Stream1=filter_14)
geo_7 = Geometry([gate_3.Target0, gate_5.Target0, gate_4.Target0])
suruburi_7 = ClusterOutput(geo_7)
geo_8 = Geometry(filter_15)
geo_9 = Geometry(filter_16)
piesa_toreț_2 = ClusterOutput(geo_9)
piese_plasti_2 = ClusterOutput(geo_8)

# ==== cluster TrimDomain
start = ClusterInput()
domain = ClusterInput()
end = ClusterInput()
domain_2 = Domain(domain)
dedomain = DeconstructDomain(Domain=domain_2)  # -> Start, End
addition = Addition(A=dedomain.Start, B=start)
subtraction = Subtraction(A=dedomain.End, B=end)
dom = ConstructDomain(DomainStart=addition, DomainEnd=subtraction)
I = ClusterOutput(dom)
